# Grasshopper definition columns.gh (Grasshopper 0.9.66)

fillet_radius = Slider(2000, range=0..10000)
center_point = Slider(3678, range=0..10000)
bottom_point = Point(<point referenced from the Rhino model>)
Z = UnitZ(Factor=1)
top_point = Point(<point referenced from the Rhino model>)
Z_2 = UnitZ(Factor=center_point)
move = Move(Geometry=bottom_point, Motion=Z_2)  # -> Geometry, Transform
pl_3pt = Plane3Pt(PointA=move.Geometry, PointB=bottom_point, PointC=top_point)
line = LineSDL(Start=bottom_point, Direction=pl_3pt, Length=Slider(2000, range=0..10000))
end = EndPoints(Curve=line)  # -> Start, End
number_slider = Slider(816, range=0..1000)
weave = Weave(Pattern=[0, 1, 2], Stream0=bottom_point, Stream1=move.Geometry, Stream2=top_point, NullGaps=False)
dist = Distance(PointA=bottom_point, PointB=top_point)
line_2 = LineSDL(Start=bottom_point, Direction=Z, Length=dist)
pl_3pt_2 = Plane3Pt(PointA=bottom_point, PointB=end.End, PointC=move.Geometry)
amp = Amplitude(Vector=pl_3pt_2, Amplitude=expr("-a", Slider(9736, range=0..10000)))
pline = PolyLine(Vertices=weave, Closed=False)
amp_2 = Amplitude(Vector=pl_3pt_2, Amplitude=expr("a", Slider(2400, range=0..10000)))
offset = Offset(Curve=pline, Distance=number_slider, Plane=pl_3pt, Corners=1)
rad = Radians(Degrees=Slider(1.06, range=0..20))
rotate = Rotate(Geometry=line_2, Angle=expr("-a", rad), Plane=pl_3pt_2)  # -> Geometry, Transform
extr = Extrude(Base=rotate.Geometry, Direction=amp)
offset_2 = Offset(Curve=pline, Distance=expr("-d", number_slider), Plane=pl_3pt, Corners=1)
move_2 = Move(Geometry=extr, Motion=amp_2)  # -> Geometry, Transform
number_slider_2 = Slider(0.3, range=0..1)
explode = Explode(Curve=offset_2, Recursive=True)  # -> Segments, Vertices
explode_2 = Explode(Curve=offset, Recursive=True)  # -> Segments, Vertices
item = ListItem(List=explode_2.Vertices, Index=0, Wrap=True)
item_2 = ListItem(List=explode_2.Vertices, Index=2, Wrap=True)
ln = Line(StartPoint=top_point, EndPoint=item_2)
item_3 = ListItem(List=explode_2.Vertices, Index=1, Wrap=True)
item_4 = ListItem(List=explode.Vertices, Index=2, Wrap=True)
item_5 = ListItem(List=explode.Vertices, Index=0, Wrap=True)
item_6 = ListItem(List=explode.Vertices, Index=4, Wrap=True)
eval = EvaluateLength(Curve=ln, Length=number_slider_2, Normalized=True)  # -> Point, Tangent, Parameter
number_slider_3 = Slider(0.6, range=0..1)
ln_2 = Line(StartPoint=bottom_point, EndPoint=item_5)
ln_3 = Line(StartPoint=top_point, EndPoint=item_6)
ln_4 = Line(StartPoint=move.Geometry, EndPoint=item_3)
ln_5 = Line(StartPoint=move.Geometry, EndPoint=item_4)
eval_2 = EvaluateLength(Curve=ln_4, Length=number_slider_3, Normalized=True)  # -> Point, Tangent, Parameter
eval_3 = EvaluateLength(Curve=ln_3, Length=number_slider_2, Normalized=True)  # -> Point, Tangent, Parameter
weave_2 = Weave(Pattern=[0, 1, 2], Stream0=eval.Point, Stream1=eval_2.Point, Stream2=item, NullGaps=False)
eval_4 = EvaluateLength(Curve=ln_2, Length=0.5, Normalized=True)  # -> Point, Tangent, Parameter
eval_5 = EvaluateLength(Curve=ln_5, Length=number_slider_3, Normalized=True)  # -> Point, Tangent, Parameter
pline_2 = PolyLine(Vertices=weave_2, Closed=False)
weave_3 = Weave(Pattern=[0, 1, 2], Stream0=eval_4.Point, Stream1=eval_5.Point, Stream2=eval_3.Point, NullGaps=False)
fillet = Fillet(Curve=pline_2, Radius=fillet_radius)
ln_6 = Line(StartPoint=eval_3.Point, EndPoint=eval.Point)
ln_7 = Line(StartPoint=eval_4.Point, EndPoint=item)
pline_3 = PolyLine(Vertices=weave_3, Closed=False)
fillet_2 = Fillet(Curve=pline_3, Radius=fillet_radius)
pl = PlaneNormal(Origin=pl_3pt, ZAxis=Vector(0, 0, 1))
join = JoinCurves(Curves=[fillet, fillet_2, ln_7, ln_6], Preserve=False)
amp_3 = Amplitude(Vector=pl_3pt, Amplitude=Slider(1000, range=0..1000))
extr_2 = Extrude(Base=join, Direction=amp_3)
split = SplitBrep(Brep=extr_2, Cutter=move_2.Geometry)
panel = Panel(split)
cull = CullPattern(List=split, CullPattern=[True, False])
