# Grasshopper definition delta error.gh (Grasshopper 0.9.72)

side_length = Slider(170, range=0..1000)
side_length_2 = Slider(170, range=0..1000)
twist_angle = Slider(0, range=0..10)
height = Slider(420, range=0..1000)
pt = ConstructPoint(XCoordinate=0, YCoordinate=0, ZCoordinate=0)
X = UnitX(Factor=side_length_2)
line = LineSDL(Start=pt, Direction=X, Length=side_length_2)
end = EndPoints(Curve=line)  # -> Start, End
cir = Circle(Plane=end.Start, Radius=side_length_2)
cir_2 = Circle(Plane=end.End, Radius=side_length_2)
ccx = CurveCurve(CurveA=cir_2, CurveB=cir)  # -> Points, ParamsA, ParamsB
number_slider = Slider(1, range=0..1)
cull = CullPattern(List=ccx.Points, CullPattern=invert([False, True]))
text_size = Slider(10, range=0..100)
weave = Weave(Pattern=[0, 1, 2], Stream0=end.Start, Stream1=cull, Stream2=end.End, NullGaps=False)
pline = PolyLine(Vertices=weave, Closed=True)
explode = Explode(Curve=pline, Recursive=True)  # -> Segments, Vertices
end_2 = EndPoints(Curve=explode.Segments)  # -> Start, End
linedim = LineDimension(Line=explode.Segments, Text="{0:0.00}", Size=text_size)
Z = UnitZ(Factor=height)
move = Move(Geometry=pline, Motion=Z)  # -> Geometry, Transform
pcen = PolygonCenter(Polyline=move.Geometry)  # -> CenterV, CenterE, CenterA
rad = Radians(Degrees=twist_angle)
rotate = Rotate(Geometry=move.Geometry, Angle=rad, Plane=pcen.CenterV)  # -> Geometry, Transform
explode_2 = Explode(Curve=rotate.Geometry, Recursive=True)  # -> Segments, Vertices
end_3 = EndPoints(Curve=explode_2.Segments)  # -> Start, End
ln = Line(StartPoint=end_2.Start, EndPoint=end_3.Start)
ln_2 = Line(StartPoint=end_2.Start, EndPoint=end_3.End)
item = ListItem(List=ln, Index=Slider(0, range=0..100), Wrap=True)
item_2 = ListItem(List=ln, Index=Slider(1, range=0..1), Wrap=True)
item_3 = ListItem(List=ln, Index=Slider(2, range=0..10), Wrap=True)
len = Length(Curve=ln_2)
ln_3 = Line(StartPoint=end_2.End, EndPoint=end_3.Start)
len_2 = Length(Curve=ln_3)
subtraction = Subtraction(A=len_2, B=len)
linedim_2 = LineDimension(Line=ln_2, Text="{0:0.00}", Size=text_size)
linedim_3 = LineDimension(Line=ln_3, Text="{0:0.00}", Size=text_size)
markdim = MarkerDimension(Line=ln, Text=subtraction, Size=text_size)
eval = EvaluateLength(Curve=item_2, Length=Slider(274, range=0..390), Normalized=False)  # -> Point, Tangent, Parameter
eval_2 = EvaluateLength(Curve=item, Length=Slider(238, range=0..390), Normalized=False)  # -> Point, Tangent, Parameter
eval_3 = EvaluateLength(Curve=item_3, Length=Slider(265, range=0..390), Normalized=False)  # -> Point, Tangent, Parameter
number_slider_2 = Slider(150, range=0..1000)
sph = Sphere(Base=eval_2.Point, Radius=number_slider_2)
sph_2 = Sphere(Base=eval.Point, Radius=number_slider_2)
sph_3 = Sphere(Base=eval_3.Point, Radius=number_slider_2)
bbx = BrepBrep(BrepA=sph, BrepB=sph_2)  # -> Curves, Points
bbx_2 = BrepBrep(BrepA=sph, BrepB=sph_3)  # -> Curves, Points
bbx_3 = BrepBrep(BrepA=sph_2, BrepB=sph_3)  # -> Curves, Points
mcx = MultipleCurves(Curves=[bbx.Curves, bbx_2.Curves, bbx_3.Curves])  # -> Points, IndexA, IndexB, ParamA, ParamB
item_4 = ListItem(List=mcx.Points, Index=0, Wrap=True)
ln_4 = Line(StartPoint=item_4, EndPoint=eval_3.Point)
ln_5 = Line(StartPoint=item_4, EndPoint=eval_2.Point)
ln_6 = Line(StartPoint=item_4, EndPoint=eval.Point)
