# Grasshopper definition delta inverse single line with forward error check.gh (Grasshopper 0.9.72)

series = Series(Start=0, Step=Slider(2, range=0..10), Count=Slider(20, range=0..100))
side_length = Slider(170, range=0..1000)
panel = Panel(series)
number_slider = Slider(98.14, range=0..100)
y = Slider(33, range=-50..50)
x = Slider(13, range=-49..50)
z = Slider(81, range=0..187)
rad = Radians(Degrees=Slider(90, range=0..100))
side_length_2 = Slider(170, range=0..1000)
twist_angle = Slider(0, range=0..10)
polygon = Polygon(Plane=PlaneXY(0, 0, 0), Radius=number_slider, Segments=Slider(3, range=0..10), FilletRadius=0)  # -> Polygon, Length
height = Slider(420, range=0..1000)
rotate = Rotate(Geometry=polygon.Polygon, Angle=rad, Plane=PlaneXY(0, 0, 0))  # -> Geometry, Transform
Y = Number(y)
L = Panel("150")
num = Number(number_slider)
Z = Number(z)
X = Number(x)
pt = ConstructPoint(XCoordinate=0, YCoordinate=0, ZCoordinate=0)
X_2 = UnitX(Factor=side_length_2)
num_2 = Number(L)
explode = Explode(Curve=rotate.Geometry, Recursive=True)  # -> Segments, Vertices
item = ListItem(List=explode.Vertices, Index=0, Wrap=True)
item_2 = ListItem(List=explode.Vertices, Index=1, Wrap=True)
item_3 = ListItem(List=explode.Vertices, Index=2, Wrap=True)
pdecon = Deconstruct(Point=item)  # -> XComponent, YComponent, ZComponent
pdecon_2 = Deconstruct(Point=item_2)  # -> XComponent, YComponent, ZComponent
pdecon_3 = Deconstruct(Point=item_3)  # -> XComponent, YComponent, ZComponent
acx = Number(pdecon.XComponent)
acy = Number(pdecon.YComponent)
bcx = Number(pdecon_2.XComponent)
bcy = Number(pdecon_2.YComponent)
ccx = Number(pdecon_3.XComponent)
ccy = Number(pdecon_3.YComponent)
line = LineSDL(Start=pt, Direction=X_2, Length=side_length_2)
hcz = Panel("0")
end = EndPoints(Curve=line)  # -> Start, End
pt_2 = ConstructPoint(XCoordinate=X, YCoordinate=y, ZCoordinate=z)
cir = Circle(Plane=end.Start, Radius=side_length_2)
cir_2 = Circle(Plane=end.End, Radius=side_length_2)
acz = Evaluate(F="sqrt(L^2 - (X - Avx)^2 - (Y - Avy)^2)", X=X, Y=Y, Avx=acx, L=num_2, Avy=acy)
bcz = Evaluate(F="sqrt(L^2 - (X - Bvx)^2 - (Y - Bvy)^2)", X=X, Y=Y, Bvx=bcx, L=num_2, Bvy=bcy)
ccz = Evaluate(F="sqrt(L^2 - (X - Cvx)^2 - (Y - Cvy)^2)", X=X, Y=Y, Cvx=ccx, L=num_2, Cvy=ccy)
ccx_2 = CurveCurve(CurveA=cir_2, CurveB=cir)  # -> Points, ParamsA, ParamsB
pcen = PolygonCenter(Polyline=rotate.Geometry)  # -> CenterV, CenterE, CenterA
explode_2 = Explode(Curve=rotate.Geometry, Recursive=True)  # -> Segments, Vertices
num_3 = Number(hcz)
number_slider_2 = Slider(1, range=0..1)
cull = CullPattern(List=ccx_2.Points, CullPattern=invert([False, True]))
text_size = Slider(10, range=0..100)
weave = Weave(Pattern=[0, 1, 2], Stream0=end.Start, Stream1=cull, Stream2=end.End, NullGaps=False)
pline = PolyLine(Vertices=weave, Closed=True)
end_2 = EndPoints(Curve=explode_2.Segments)  # -> Start, End
linedim = LineDimension(Line=explode_2.Segments, Text="{0:0.00}", Size=text_size)
eval = Evaluate(F="Z + Acz + Hcz", Acz=acz, Hcz=num_3, z=Z)
Z_2 = UnitZ(Factor=height)
eval_2 = Evaluate(F="Z + Bcz + Hcz", Bcz=bcz, Hcz=num_3, z=Z)
eval_3 = Evaluate(F="Z + Ccz + Hcz", Ccz=ccz, Hcz=num_3, z=Z)
dist = Distance(PointA=pcen.CenterV, PointB=end_2.End)
item_r = ListItem(List=dist, Index=0, Wrap=True)
move = Move(Geometry=rotate.Geometry, Motion=Z_2)  # -> Geometry, Transform
pcen_2 = PolygonCenter(Polyline=move.Geometry)  # -> CenterV, CenterE, CenterA
rad_2 = Radians(Degrees=twist_angle)
rotate_2 = Rotate(Geometry=move.Geometry, Angle=rad_2, Plane=pcen_2.CenterV)  # -> Geometry, Transform
explode_3 = Explode(Curve=rotate_2.Geometry, Recursive=True)  # -> Segments, Vertices
end_3 = EndPoints(Curve=explode_3.Segments)  # -> Start, End
ln = Line(StartPoint=end_2.Start, EndPoint=end_3.Start)
ln_2 = Line(StartPoint=end_2.Start, EndPoint=end_3.End)
len = Length(Curve=ln_2)
ln_3 = Line(StartPoint=end_2.End, EndPoint=end_3.Start)
len_2 = Length(Curve=ln_3)
subtraction = Subtraction(A=len_2, B=len)
linedim_2 = LineDimension(Line=ln_2, Text="{0:0.00}", Size=text_size)
linedim_3 = LineDimension(Line=ln_3, Text="{0:0.00}", Size=text_size)
markdim = MarkerDimension(Line=ln, Text=subtraction, Size=text_size)
item_4 = ListItem(List=ln, Index=Slider(0, range=0..100), Wrap=True)
item_5 = ListItem(List=ln, Index=Slider(1, range=0..1), Wrap=True)
item_6 = ListItem(List=ln, Index=Slider(2, range=0..10), Wrap=True)
number_slider_3 = Slider(274, range=0..390)
number_slider_4 = Slider(238, range=0..390)
number_slider_5 = Slider(265, range=0..390)
l_error = Panel("170")
number_slider_6 = Slider(166, range=0..1000)
num_4 = Number(l_error)
eval_4 = EvaluateLength(Curve=item_4, Length=eval, Normalized=False)  # -> Point, Tangent, Parameter
eval_5 = EvaluateLength(Curve=item_5, Length=eval_2, Normalized=False)  # -> Point, Tangent, Parameter
eval_6 = EvaluateLength(Curve=item_6, Length=eval_3, Normalized=False)  # -> Point, Tangent, Parameter
sph = Sphere(Base=eval_4.Point, Radius=num_4)
sph_2 = Sphere(Base=eval_5.Point, Radius=num_4)
sph_3 = Sphere(Base=eval_6.Point, Radius=num_4)
pt_3 = Point(pt_2)
bbx = BrepBrep(BrepA=sph, BrepB=sph_2)  # -> Curves, Points
bbx_2 = BrepBrep(BrepA=sph, BrepB=sph_3)  # -> Curves, Points
bbx_3 = BrepBrep(BrepA=sph_2, BrepB=sph_3)  # -> Curves, Points
mcx = MultipleCurves(Curves=[bbx.Curves, bbx_2.Curves, bbx_3.Curves])  # -> Points, IndexA, IndexB, ParamA, ParamB
number_slider_7 = Slider(0, range=0..100)
item_7 = ListItem(List=mcx.Points, Index=Slider(1, range=0..1), Wrap=True)
ln_4 = Line(StartPoint=pt_3, EndPoint=eval_6.Point)
ln_5 = Line(StartPoint=pt_3, EndPoint=eval_4.Point)
ln_6 = Line(StartPoint=pt_3, EndPoint=eval_5.Point)
ln_7 = Line(StartPoint=mcx.Points, EndPoint=eval_6.Point)
ln_8 = Line(StartPoint=mcx.Points, EndPoint=eval_4.Point)
ln_9 = Line(StartPoint=mcx.Points, EndPoint=eval_5.Point)
len_3 = Length(Curve=[ln_5, ln_6, ln_4])
panel_2 = Panel(len_3)
preview = CustomPreview(Geometry=[ln_8, ln_9, ln_7], Shader=ColourSwatch(SwatchColor=RGB(255, 255, 255)))
