# Grasshopper definition delta inverse solid model edit .gh (Grasshopper 0.9.75)

side_length = Slider(170, range=0..1000)
height = Slider(420, range=0..1000)
y = Slider(60, range=-60..60)
x = Slider(1, range=-60..60)
z = Slider(142, range=0..187)
rad = Radians(Degrees=Slider(90, range=0..100))
polygon = Polygon(Plane=PlaneXY(0, 0, 0), Radius=Slider(106.85, range=0..1000), Segments=Slider(3, range=0..10), FilletRadius=0)  # -> Polygon, Length
Y = Number(y)
L = Panel("150")
Z = Number(z)
X = Number(x)
explode = Explode(Curve=polygon.Polygon, Recursive=True)  # -> Segments, Vertices
rotate = Rotate(Geometry=polygon.Polygon, Angle=rad, Plane=PlaneXY(0, 0, 0))  # -> Geometry, Transform
offset = Offset(Curve=polygon.Polygon, Distance=expr("-x/2", Slider(40, range=0..100)), Plane=PlaneXY(0, 0, 0), Corners=1)
rotate_2 = Rotate(Geometry=offset, Angle=rad, Plane=PlaneXY(0, 0, 0))  # -> Geometry, Transform
len = Length(Curve=explode.Segments)
num = Number(L)
area = Area(Geometry=polygon.Polygon)  # -> Area, Centroid
polygon_2 = Polygon(Plane=area.Centroid, Radius=Slider(93.6, range=0..100), Segments=6, FilletRadius=0)  # -> Polygon, Length
explode_2 = Explode(Curve=rotate_2.Geometry, Recursive=True)  # -> Segments, Vertices
item = ListItem(List=explode_2.Vertices, Index=0, Wrap=True)
item_2 = ListItem(List=explode_2.Vertices, Index=1, Wrap=True)
item_3 = ListItem(List=explode_2.Vertices, Index=2, Wrap=True)
pdecon = Deconstruct(Point=item)  # -> XComponent, YComponent, ZComponent
pdecon_2 = Deconstruct(Point=item_2)  # -> XComponent, YComponent, ZComponent
pdecon_3 = Deconstruct(Point=item_3)  # -> XComponent, YComponent, ZComponent
acx = Number(pdecon.XComponent)
acy = Number(pdecon.YComponent)
bcx = Number(pdecon_2.XComponent)
bcy = Number(pdecon_2.YComponent)
ccx = Number(pdecon_3.XComponent)
ccy = Number(pdecon_3.YComponent)
panel = Panel(len)
cir = Circle(Plane=area.Centroid, Radius=expr("x/2", Slider(120, range=0..1000)))
hcz = Panel("0")
pt = ConstructPoint(XCoordinate=X, YCoordinate=y, ZCoordinate=z)
twist_angle = Slider(0, range=0..10)
acz = Evaluate(F="sqrt(L^2 - (X - Avx)^2 - (Y - Avy)^2)", X=X, Y=Y, Avx=acx, L=num, Avy=acy)
bcz = Evaluate(F="sqrt(L^2 - (X - Bvx)^2 - (Y - Bvy)^2)", X=X, Y=Y, Bvx=bcx, L=num, Bvy=bcy)
ccz = Evaluate(F="sqrt(L^2 - (X - Cvx)^2 - (Y - Cvy)^2)", X=X, Y=Y, Cvx=ccx, L=num, Cvy=ccy)
pcen = PolygonCenter(Polyline=rotate_2.Geometry)  # -> CenterV, CenterE, CenterA
explode_3 = Explode(Curve=rotate_2.Geometry, Recursive=True)  # -> Segments, Vertices
num_2 = Number(hcz)
explode_4 = Explode(Curve=rotate.Geometry, Recursive=True)  # -> Segments, Vertices
text_size = Slider(10, range=0..100)
end = EndPoints(Curve=explode_3.Segments)  # -> Start, End
end_2 = EndPoints(Curve=explode_4.Segments)  # -> Start, End
eval = Evaluate(F="Z + Acz + Hcz", Acz=acz, Hcz=num_2, z=Z)
Z_2 = UnitZ(Factor=height)
eval_2 = Evaluate(F="Z + Bcz + Hcz", Bcz=bcz, Hcz=num_2, z=Z)
eval_3 = Evaluate(F="Z + Ccz + Hcz", Ccz=ccz, Hcz=num_2, z=Z)
dist = Distance(PointA=pcen.CenterV, PointB=end.End)
item_r = ListItem(List=dist, Index=0, Wrap=True)
linedim = LineDimension(Line=explode_3.Segments, Text="{0:0.00}", Size=text_size)
move = Move(Geometry=rotate_2.Geometry, Motion=Z_2)  # -> Geometry, Transform
pcen_2 = PolygonCenter(Polyline=move.Geometry)  # -> CenterV, CenterE, CenterA
rad_2 = Radians(Degrees=twist_angle)
rotate_3 = Rotate(Geometry=move.Geometry, Angle=rad_2, Plane=pcen_2.CenterV)  # -> Geometry, Transform
explode_5 = Explode(Curve=rotate_3.Geometry, Recursive=True)  # -> Segments, Vertices
pt_2 = Point(end_2.Start)
end_3 = EndPoints(Curve=explode_5.Segments)  # -> Start, End
rotate_4 = Rotate(Geometry=pt_2, Angle=1.570796327, Plane=PlaneXY(0, 0, 0))  # -> Geometry, Transform
ln = Line(StartPoint=end.Start, EndPoint=end_3.Start)
ln_2 = Line(StartPoint=end.Start, EndPoint=end_3.End)
len_2 = Length(Curve=ln_2)
ln_3 = Line(StartPoint=end.End, EndPoint=end_3.Start)
pl_3pt = Plane3Pt(PointA=pt_2, PointB=area.Centroid, PointC=rotate_4.Geometry)
len_3 = Length(Curve=ln_3)
rod_distance = Slider(45, range=0..100)
subtraction = Subtraction(A=len_3, B=len_2)
linedim_2 = LineDimension(Line=ln_2, Text="{0:0.00}", Size=text_size)
linedim_3 = LineDimension(Line=ln_3, Text="{0:0.00}", Size=text_size)
markdim = MarkerDimension(Line=ln, Text=subtraction, Size=text_size)
rod_distance_2 = Circle(Plane=pl_3pt, Radius=expr("x/2", rod_distance))
item_4 = ListItem(List=ln, Index=Slider(0, range=0..100), Wrap=True)
item_5 = ListItem(List=ln, Index=Slider(1, range=0..1), Wrap=True)
item_6 = ListItem(List=ln, Index=Slider(2, range=0..10), Wrap=True)
divide = DivideCurve(Curve=rod_distance_2, Count=Slider(4, range=0..10), Kinks=False)  # -> Points, Tangents, Parameters
pt_3 = Point(pt)
num_3 = Number(height)
eval_4 = EvaluateLength(Curve=item_5, Length=eval_2, Normalized=False)  # -> Point, Tangent, Parameter
eval_5 = EvaluateLength(Curve=item_6, Length=eval_3, Normalized=False)  # -> Point, Tangent, Parameter
eval_6 = EvaluateLength(Curve=item_4, Length=eval, Normalized=False)  # -> Point, Tangent, Parameter
cull = CullPattern(List=divide.Points, CullPattern=[False, True])
Z_3 = UnitZ(Factor=1)
line = LineSDL(Start=pcen.CenterV, Direction=Z_3, Length=num_3)
merge = Merge(Data1=eval_6.Point, Data2=eval_4.Point, Data3=eval_5.Point)
ln_4 = Line(StartPoint=pt_3, EndPoint=eval_6.Point)
ln_5 = Line(StartPoint=pt_3, EndPoint=eval_5.Point)
ln_6 = Line(StartPoint=pt_3, EndPoint=eval_4.Point)
xy = XYPlane(Origin=merge)
line_2 = LineSDL(Start=cull, Direction=Z_3, Length=num_3)
len_4 = Length(Curve=[ln_4, ln_6, ln_5])
panel_2 = Panel(len_4)
flip = FlipMatrix(Data=xy)
number_slider = Slider(90, range=0..100)
pcx = CurvePlane(Curve=line_2, Plane=flip)  # -> Points, ParamsC, ParamsP
pcx_2 = CurvePlane(Curve=line, Plane=flip)  # -> Points, ParamsC, ParamsP
rad_3 = Radians(Degrees=Slider(30, range=0..100))
polygon_3 = Polygon(Plane=pt_3, Radius=Slider(46.48, range=0..100), Segments=Slider(3, range=0..10), FilletRadius=0)  # -> Polygon, Length
path_mapper = PathMapper(pcx.Points, source="{A;B;C;D}", target="{A;B;C}")
flip_2 = FlipMatrix(Data=merge)
rotate_5 = Rotate(Geometry=polygon_3.Polygon, Angle=rad_3, Plane=pt_3)  # -> Geometry, Transform
item_7 = ListItem(List=path_mapper, Index=0, Wrap=True)
item_8 = ListItem(List=path_mapper, Index=1, Wrap=True)
explode_6 = Explode(Curve=rotate_5.Geometry, Recursive=True)  # -> Segments, Vertices
pl_3pt_2 = Plane3Pt(PointA=flip_2, PointB=pcx_2.Points, PointC=item_7)
ln_7 = Line(StartPoint=item_7, EndPoint=item_8)
eval_7 = EvaluateLength(Curve=explode_6.Segments, Length=0.5, Normalized=True)  # -> Point, Tangent, Parameter
panel_3 = Panel(item_7)
number_slider_2 = Slider(32, range=0..100)
cir_2 = Circle(Plane=eval_7.Point, Radius=expr("x/2", number_slider_2))
offset_2 = Offset(Curve=ln_7, Distance=expr("-x", Slider(17, range=0..100)), Plane=pl_3pt_2, Corners=1)
number_slider_3 = Slider(32, range=0..100)
ccx_2 = CurveCurve(CurveA=cir_2, CurveB=explode_6.Segments)  # -> Points, ParamsA, ParamsB
eval_8 = EvaluateLength(Curve=offset_2, Length=0.5, Normalized=True)  # -> Point, Tangent, Parameter
item_9 = ListItem(List=ccx_2.Points, Index=0, Wrap=True)
cir_3 = Circle(Plane=eval_8.Point, Radius=expr("X/2", number_slider_2))
item_10 = ListItem(List=ccx_2.Points, Index=1, Wrap=True)
ccx_3 = CurveCurve(CurveA=cir_3, CurveB=offset_2)  # -> Points, ParamsA, ParamsB
item_11 = ListItem(List=ccx_3.Points, Index=0, Wrap=True)
item_12 = ListItem(List=ccx_3.Points, Index=1, Wrap=True)
panel_4 = Panel(ccx_3.Points)
ln_8 = Line(StartPoint=item_11, EndPoint=item_9)
ln_9 = Line(StartPoint=item_12, EndPoint=item_10)
smooth_rod = Pipe(Curve=line_2, Radius=Slider(3, range=0..10), Caps=0)
merge_2 = Merge(Data1=ln_8, Data2=ln_9)
preview = CustomPreview(Geometry=smooth_rod, Shader=ColourSwatch(SwatchColor=RGB(119, 119, 118)))
len_5 = Length(Curve=merge_2)
panel_5 = Panel(len_5)
pipe = Pipe(Curve=merge_2, Radius=expr("x/2", Slider(4, range=0..10)), Caps=0)
preview_2 = CustomPreview(Geometry=pipe, Shader=ColourSwatch(SwatchColor=RGB(0, 0, 0)))
