# Grasshopper definition delta inverse.gh (Grasshopper 0.9.72)

side_length = Slider(170, range=0..1000)
number_slider = Slider(98.14, range=0..100)
rad = Radians(Degrees=Slider(90, range=0..100))
side_length_2 = Slider(170, range=0..1000)
twist_angle = Slider(0, range=0..10)
polygon = Polygon(Plane=PlaneXY(0, 0, 0), Radius=number_slider, Segments=Slider(3, range=0..10), FilletRadius=0)  # -> Polygon, Length
height = Slider(420, range=0..1000)
x = Slider(0, range=-49..50)
y = Slider(3, range=-50..50)
z = Slider(187, range=0..187)
rotate = Rotate(Geometry=polygon.Polygon, Angle=rad, Plane=PlaneXY(0, 0, 0))  # -> Geometry, Transform
L = Panel("150")
num = Number(number_slider)
pt = ConstructPoint(XCoordinate=0, YCoordinate=0, ZCoordinate=0)
X = UnitX(Factor=side_length_2)
num_2 = Number(L)
line = LineSDL(Start=pt, Direction=X, Length=side_length_2)
hcz = Panel("0")
end = EndPoints(Curve=line)  # -> Start, End
pt_2 = ConstructPoint(XCoordinate=x, YCoordinate=y, ZCoordinate=z)
cir = Circle(Plane=end.Start, Radius=side_length_2)
cir_2 = Circle(Plane=end.End, Radius=side_length_2)
acz = Evaluate(F="sqrt(L^2-(X-0)^2-(Y - R)^2)", X=x, Y=y, R=num, L=num_2)
bcz = Evaluate(F="sqrt(L^2-(X - (R/2))^2-((Y + R*(sqrt(3)/2))^2))", X=x, Y=y, R=num, L=num_2)
ccz = Evaluate(F="sqrt(L^2-(X+(R/2))^2-((Y+R*(sqrt(3)/2))^2))", X=x, Y=y, R=num, L=num_2)
num_3 = Number(hcz)
ccx = CurveCurve(CurveA=cir_2, CurveB=cir)  # -> Points, ParamsA, ParamsB
pcen = PolygonCenter(Polyline=rotate.Geometry)  # -> CenterV, CenterE, CenterA
explode = Explode(Curve=rotate.Geometry, Recursive=True)  # -> Segments, Vertices
number_slider_2 = Slider(1, range=0..1)
cull = CullPattern(List=ccx.Points, CullPattern=invert([False, True]))
text_size = Slider(10, range=0..100)
weave = Weave(Pattern=[0, 1, 2], Stream0=end.Start, Stream1=cull, Stream2=end.End, NullGaps=False)
pline = PolyLine(Vertices=weave, Closed=True)
end_2 = EndPoints(Curve=explode.Segments)  # -> Start, End
linedim = LineDimension(Line=explode.Segments, Text="{0:0.00}", Size=text_size)
eval = Evaluate(F="Z + Acz + Hcz", Acz=acz, Hcz=num_3, z=z)
Z = UnitZ(Factor=height)
eval_2 = Evaluate(F="Z + Bcz + Hcz", Bcz=bcz, Hcz=num_3, z=z)
eval_3 = Evaluate(F="Z + Ccz + Hcz", Ccz=ccz, Hcz=num_3, z=z)
dist = Distance(PointA=pcen.CenterV, PointB=end_2.End)
item_r = ListItem(List=dist, Index=0, Wrap=True)
move = Move(Geometry=rotate.Geometry, Motion=Z)  # -> Geometry, Transform
pcen_2 = PolygonCenter(Polyline=move.Geometry)  # -> CenterV, CenterE, CenterA
rad_2 = Radians(Degrees=twist_angle)
rotate_2 = Rotate(Geometry=move.Geometry, Angle=rad_2, Plane=pcen_2.CenterV)  # -> Geometry, Transform
explode_2 = Explode(Curve=rotate_2.Geometry, Recursive=True)  # -> Segments, Vertices
end_3 = EndPoints(Curve=explode_2.Segments)  # -> Start, End
ln = Line(StartPoint=end_2.Start, EndPoint=end_3.Start)
ln_2 = Line(StartPoint=end_2.Start, EndPoint=end_3.End)
len = Length(Curve=ln_2)
ln_3 = Line(StartPoint=end_2.End, EndPoint=end_3.Start)
len_2 = Length(Curve=ln_3)
subtraction = Subtraction(A=len_2, B=len)
linedim_2 = LineDimension(Line=ln_2, Text="{0:0.00}", Size=text_size)
linedim_3 = LineDimension(Line=ln_3, Text="{0:0.00}", Size=text_size)
markdim = MarkerDimension(Line=ln, Text=subtraction, Size=text_size)
item = ListItem(List=ln, Index=Slider(0, range=0..100), Wrap=True)
item_2 = ListItem(List=ln, Index=Slider(2, range=0..10), Wrap=True)
item_3 = ListItem(List=ln, Index=Slider(1, range=0..1), Wrap=True)
number_slider_3 = Slider(274, range=0..390)
number_slider_4 = Slider(238, range=0..390)
number_slider_5 = Slider(265, range=0..390)
eval_4 = EvaluateLength(Curve=item, Length=eval, Normalized=False)  # -> Point, Tangent, Parameter
eval_5 = EvaluateLength(Curve=item_2, Length=eval_2, Normalized=False)  # -> Point, Tangent, Parameter
eval_6 = EvaluateLength(Curve=item_3, Length=eval_3, Normalized=False)  # -> Point, Tangent, Parameter
pt_3 = Point(pt_2)
ln_4 = Line(StartPoint=pt_3, EndPoint=eval_6.Point)
ln_5 = Line(StartPoint=pt_3, EndPoint=eval_4.Point)
ln_6 = Line(StartPoint=pt_3, EndPoint=eval_5.Point)
len_3 = Length(Curve=[ln_5, ln_6, ln_4])
panel = Panel(len_3)
