# Grasshopper definition esk gears herrigbone.gh (Grasshopper 0.9.72)

# copywrite: copywrite : ekaggrat singh kalsi
# 2013
# formulas: The Pitch Diameter (D) = N/P = 20/16 = 1.25"
# The Pitch Radius (R) = D/2 = .625"
# The Base Circle Diameter (DB) = D * COS (PA) = 1.25 * COS (14.5 deg) = 1.210"
# The Base Circle Radius (RB) = DB/2 = .605"
# The Addendum (a) = 1/P = 1/16 = .0625
# The Dedendum (d) = 1.157/P = 1.157/16 = .0723" (rounding off at .0001")
# Outside Diameter (DO) = D+2*a = 1.375"
# Outside Radius (RO) = .625" (R) + .0625" (a) = .6875"
# Root Diameter (DR) = D-2*d = 1.1054"                              (I had earlier used the letter "b" instead of "d", I think this was a typo, making a note here on 10/09/10 of the revision)
# Root Radius (RR) = .625" (R) - .0723" (d) = .5527"
pt = PointXYZ(XComponent=0, YComponent=0, ZComponent=0, System=PlaneXY(0, 0, 0))
center = Point(pt)
circular_pitch = Panel("150")
number_of_teeth = Slider(47, range=2..200)
pressure_angle = Slider(28, range=2..180)
cleareance = Panel("0.2")
hub_diameter = Slider(3, range=0..200)
gear_thickness = Slider(5.554, range=0..200)
num = Number(pressure_angle)
pitch_diameter = Evaluate(F="x*Y/180", x=number_of_teeth, y=circular_pitch)
pitch_diameter_2 = Number(pitch_diameter)
pitch_diameter_3 = Number(pitch_diameter_2)
pitch_radius = Evaluate(F="X/2", x=pitch_diameter)
circle = CircleCNR(Center=center, Normal=Vector(0, 0, 1), Radius=expr("x/2", pitch_diameter_3))
base_radius = Evaluate(F="p*COS(rad(pa))", p=pitch_radius, pa=num)
diametiral_pitch_new = Division(A=number_of_teeth, B=pitch_diameter)
addendum = Division(A="1", B=diametiral_pitch_new)
gear_tooth_spacing = Evaluate(F="360/x", x=number_of_teeth)
dedendum = Addition(A=addendum, B=cleareance)
root_radius = Evaluate(F="x-Y", x=pitch_radius, y=dedendum)
evaluate = Evaluate(F="x/4", x=gear_tooth_spacing)
outside_radius = Evaluate(F="x+y", x=pitch_radius, y=addendum)
series = Series(Start=0, Step=gear_tooth_spacing, Count=number_of_teeth)
pitch_circle = Circle(circle)
outsidecircle = CircleCNR(Center=center, Normal=Vector(0, 0, 1), Radius=outside_radius)
base_circle = CircleCNR(Center=center, Normal=Vector(0, 0, 1), Radius=base_radius)
rad = Radians(Degrees=evaluate)
rad_2 = Radians(Degrees=series)
rad_3 = Radians(Degrees=gear_tooth_spacing)
root_circle = CircleCNR(Center=center, Normal=Vector(0, 0, 1), Radius=root_radius)
min_radius = Maximum(A=base_radius, B=root_radius)
resolution = Slider(8, range=5..300)
center_2 = Point(center)
circle_2 = CircleCNR(Center=center, Normal=Vector(0, 0, 1), Radius=min_radius)
# function involute (base_radius, involute_angle) =
# [
# 	base_radius*(cos (involute_angle) + involute_angle*pi/180*sin (involute_angle)),
# 	base_radius*(sin (involute_angle) - involute_angle*pi/180*cos (involute_angle)),
# ];
# 
# function involute_intersect_angle (base_radius, radius) = sqrt (pow (radius/base_radius, 2) - 1) * 180 / pi;
base_radius_2 = Number(base_radius)
range = Range(Domain=Domain(0, 90), Steps=resolution)
involute_x = F2(Function="r*sin(rad(theta))+(r*(π/2-(rad(theta)))*(sin((rad(theta))+π/2)))", X=base_radius_2, Theta=range)
involute_x_2 = F2(Function="r*cos(rad(theta))+(r*(π/2-(rad(theta)))*(cos((rad(theta))+π/2)))", X=base_radius_2, Theta=range)
pt_2 = PointXYZ(XComponent=involute_x_2, YComponent=involute_x, ZComponent=0, System=PlaneXY(0, 0, 0))
intcrv = Interpolate(Vertices=pt_2, Degree=3, Periodic=False, KnotStyle=1)  # -> Curve, Length, Domain
evaluate_2 = Evaluate(F="x/2", x=rad_3)
trim = TrimWithRegion(Curve=intcrv.Curve, Region=outsidecircle)  # -> Inside, Outside
crv = Curve(trim.Inside)
end = EndPoints(Curve=crv)  # -> Start, End
ccx = CurveCurve(CurveA=crv, CurveB=pitch_circle)  # -> Points, ParamsA, ParamsB
ln = Line(StartPoint=ccx.Points, EndPoint=center_2)
rotate = Rotate(Geometry=ln, Angle=expr("-x", rad), Plane=PlaneXY(0, 0, 0))  # -> Geometry, Transform
rotate_2 = Rotate(Geometry=rotate.Geometry, Angle=expr("-x", evaluate_2), Plane=PlaneXY(0, 0, 0))  # -> Geometry, Transform
rotate_3 = Rotate(Geometry=rotate.Geometry, Angle=evaluate_2, Plane=PlaneXY(0, 0, 0))  # -> Geometry, Transform
mirror = MirrorCurve(Geometry=crv, Curve=rotate.Geometry, Tangent=True)
end_2 = EndPoints(Curve=mirror)  # -> Start, End
ln_2 = Line(StartPoint=end_2.End, EndPoint=center_2)
ccx_2 = CurveCurve(CurveA=root_circle, CurveB=rotate_3.Geometry)  # -> Points, ParamsA, ParamsB
ccx_3 = CurveCurve(CurveA=root_circle, CurveB=rotate_2.Geometry)  # -> Points, ParamsA, ParamsB
top_ln = Line(StartPoint=end.Start, EndPoint=end_2.Start)
ln_3 = Line(StartPoint=end.End, EndPoint=center_2)
trim_2 = TrimWithRegion(Curve=ln_3, Region=root_circle)  # -> Inside, Outside
trim_3 = TrimWithRegion(Curve=ln_2, Region=root_circle)  # -> Inside, Outside
crv_2 = Curve(trim_2.Outside)
crv_3 = Curve(trim_3.Outside)
height_half = Slider(3, range=0..10)
join = JoinCurves(Curves=flatten([crv_2, crv, mirror, crv_3, top_ln]), Preserve=False)
trim_4 = TrimWithRegion(Curve=join, Region=root_circle)  # -> Inside, Outside
end_3 = EndPoints(Curve=trim_4.Outside)  # -> Start, End
ln_4 = Line(StartPoint=end_3.Start, EndPoint=ccx_2.Points)
ln_5 = Line(StartPoint=end_3.End, EndPoint=ccx_3.Points)
flatten = FlattenTree(Data=ln_5, Path="{0}")
flatten_2 = FlattenTree(Data=ln_4, Path="{0}")
flatten_3 = FlattenTree(Data=trim_4.Outside, Path="{0}")
join_2 = JoinCurves(Curves=[flatten_3, flatten_2, flatten], Preserve=False)
rotate_4 = Rotate(Geometry=join_2, Angle=rad_2, Plane=PlaneXY(0, 0, 0))  # -> Geometry, Transform
join_3 = JoinCurves(Curves=rotate_4.Geometry, Preserve=False)
center_hole = CircleCNR(Center=center, Normal=Vector(0, 0, 1), Radius=expr("x/2", hub_diameter))
crv_4 = Curve(join_3)
Z = UnitZ(Factor=height_half)
number_slider = Slider(1, range=0..10)
boundary = BoundarySurfaces(Edges=crv_4)
move = Move(Geometry=crv_4, Motion=Z)  # -> Geometry, Transform
eval = Evaluate(F="(x*2)-y", x=height_half, y=number_slider)
Z_2 = UnitZ(Factor=number_slider)
rad_4 = Radians(Degrees=Slider(10, range=0..10))
move_2 = Move(Geometry=center_hole, Motion=Z_2)  # -> Geometry, Transform
Z_3 = UnitZ(Factor=eval)
multiplication = Multiplication(A=height_half, B=Slider(2, range=0..10))
rotate_5 = Rotate(Geometry=move.Geometry, Angle=rad_4, Plane=PlaneXY(0, 0, 0))  # -> Geometry, Transform
offset = Offset(Curve=move_2.Geometry, Distance=Slider(2, range=0..10), Plane=PlaneXY(0, 0, 0), Corners=1)
Z_4 = UnitZ(Factor=multiplication)
move_3 = Move(Geometry=root_circle, Motion=Z_4)  # -> Geometry, Transform
offset_2 = Offset(Curve=move_3.Geometry, Distance=expr("-x", Slider(1, range=0..10)), Plane=PlaneXY(0, 0, 0), Corners=1)
extr = Extrude(Base=offset_2, Direction=expr("-x", Z_3))
move_4 = Move(Geometry=crv_4, Motion=Z_4)  # -> Geometry, Transform
loft_opt = LoftOptions(Closed=False, Adjust=False, Rebuild=0, Refit=0, Type=Slider(0, range=0..10))
loft = Loft(Curves=[center_hole, move_2.Geometry], Options=loft_opt)
cap = CapHoles(Brep=loft)
Z_5 = UnitZ(Factor=Slider(5, range=0..10))
loft_2 = Loft(Curves=[rotate_5.Geometry, crv_4], Options=loft_opt)
boundary_2 = BoundarySurfaces(Edges=move_4.Geometry)
cap_2 = CapHoles(Brep=extr)
extr_2 = Extrude(Base=offset, Direction=Z_5)
cap_3 = CapHoles(Brep=extr_2)
extr_3 = Extrude(Base=move_2.Geometry, Direction=Z_5)
loft_3 = Loft(Curves=[move_4.Geometry, rotate_5.Geometry], Options=loft_opt)
cap_4 = CapHoles(Brep=extr_3)
join_4 = BrepJoin(Breps=[boundary_2, boundary, loft_3, loft_2])  # -> Breps, Closed
sdiff = SolidDifference(BrepsA=join_4.Breps, BrepsB=cap)
sdiff_2 = SolidDifference(BrepsA=sdiff, BrepsB=cap_2)
sdiff_3 = SolidDifference(BrepsA=cap_3, BrepsB=cap_4)
preview = CustomPreview(
    Geometry=[sdiff_2, sdiff_3],
    Shader={ambient=RGB(0, 0, 0), diffuse=RGB(255, 105, 180), emission=RGB(76, 32, 54), shine=0.5, specular=RGB(255, 255, 255), transparency=0})
