# Grasshopper definition cycloid.gh (Grasshopper 0.9.72)

number_slider = Slider(93, range=0..100)
circle_x = Panel("a+r*cos(t)")
circle_y = Panel("b+r*sin(t)")
series = Series(Start=0, Step=Slider(0.1, range=0..1), Count=Slider(65, range=0..100))
eval = Evaluate(F=circle_x, a=Slider(0, range=0..100), r=number_slider, t=series)
eval_2 = Evaluate(F=circle_y, b=Slider(0, range=0..100), r=number_slider, t=series)
pt = ConstructPoint(XCoordinate=eval, YCoordinate=eval_2, ZCoordinate=0)
intcrv = Interpolate(Vertices=pt, Degree=Slider(1, range=0..1), Periodic=False, KnotStyle=1)  # -> Curve, Length, Domain; disabled
number_slider_2 = Slider(0.009, range=0..1)
number_slider_3 = Slider(1000, range=0..1000)
rad = Radians(Degrees=Slider(360, range=0..1000))
division = Division(A=rad, B=number_slider_2)
epicycloid_x = Panel("(B+r)*cos(t)-r*(cos(((B+r)/r)*t))")
number_slider_4 = Slider(8, range=0..10)
epicycloid_y = Panel("(B+r)*sin(t)-r*(sin(((B+r)/r)*t))")
number_slider_5 = Slider(0.009, range=0..1)
cycloid_x = Panel("r*(t-sin(t))")
cycloid_y = Panel("r*(t-cos(t))")
r = Slider(7, range=0..10)
rad_2 = Radians(Degrees=Slider(360, range=0..1000))
int = Integer(division)
series_2 = Series(Start=0, Step=Slider(0.2, range=0..1), Count=Slider(44, range=0..100))
r_2 = Slider(7, range=0..10)
series_3 = Series(Start=0, Step=number_slider_2, Count=division)
multiplication = Multiplication(A=r, B=Slider(15, range=0..100))
hypocycloid_y = Panel("(B-r)*sin(t)-r*(sin(((B-r)/r)*t))")
hypocycloid_x = Panel("(B-r)*cos(t)+r*(cos(((B-r)/r)*t))")
division_2 = Division(A=rad_2, B=number_slider_5)
int_2 = Integer(division_2)
eval_3 = Evaluate(F=cycloid_x, r=number_slider_4, t=series_2)
eval_4 = Evaluate(F=cycloid_y, r=number_slider_4, t=series_2)
multiplication_2 = Multiplication(A=r_2, B=Slider(15, range=0..100))
series_4 = Series(Start=0, Step=number_slider_5, Count=int_2)
eval_5 = Evaluate(F=epicycloid_x, B=multiplication, r=r, t=series_3)
eval_6 = Evaluate(F=epicycloid_y, B=multiplication, r=r, t=series_3)
cir = Circle(Plane=PlaneXY(0, 0, 0), Radius=multiplication_2)
eval_7 = Evaluate(F=hypocycloid_y, B=multiplication_2, r=r_2, t=series_4)
eval_8 = Evaluate(F=hypocycloid_x, B=multiplication_2, r=r_2, t=series_4)
subtraction = Subtraction(A=multiplication_2, B=r_2)
pt_2 = ConstructPoint(XCoordinate=eval_5, YCoordinate=eval_6, ZCoordinate=0)
pt_3 = ConstructPoint(XCoordinate=eval_3, YCoordinate=eval_4, ZCoordinate=0)
cir_2 = Circle(Plane=PlaneXY(0, 0, 0), Radius=subtraction)
pt_4 = ConstructPoint(XCoordinate=eval_8, YCoordinate=eval_7, ZCoordinate=0)
intcrv_2 = Interpolate(Vertices=pt_3, Degree=Slider(1, range=0..1), Periodic=False, KnotStyle=1)  # -> Curve, Length, Domain; disabled
eval_9 = EvaluateLength(Curve=cir_2, Length=Slider(0.3, range=0..1), Normalized=True)  # -> Point, Tangent, Parameter
cir_3 = Circle(Plane=eval_9.Point, Radius=r_2)
intcrv_3 = Interpolate(Vertices=pt_2, Degree=Slider(1, range=0..1), Periodic=False, KnotStyle=1)  # -> Curve, Length, Domain
intcrv_4 = Interpolate(Vertices=pt_4, Degree=Slider(1, range=0..1), Periodic=False, KnotStyle=1)  # -> Curve, Length, Domain
