# Grasshopper definition involute.gh (Grasshopper 0.9.72)

number_slider = Slider(7, range=0..10)
series = Series(Start=0, Step=Slider(0.2, range=0..1), Count=Slider(100, range=0..100))
eval = Evaluate(F="r*(t-sin(t))", r=number_slider, t=series)
eval_2 = Evaluate(F="r*(t-cos(t))", r=number_slider, t=series)
pt = ConstructPoint(XCoordinate=eval, YCoordinate=eval_2, ZCoordinate=0)
intcrv = Interpolate(Vertices=pt, Degree=Slider(1, range=0..1), Periodic=False, KnotStyle=1)  # -> Curve, Length, Domain
