# Grasshopper definition MagneticDisplace jali another fail.ghx (Grasshopper 0.8.3)

# Magnetic Displacement
# 
# An improved model of interacting singularities based on real physics.
# 
# Feel free to use and alter as you like, so long as you give attribution and label derivative works as such
# 
# by Dan Piker
# www.spacesymmetrystructure.wordpress.com
u = Slider(75, range=0..200)
v = Slider(15, range=0..200)
# This example just shows 4 points, but obviously you can add more by just copying and summing.
num = Number(0.7)
recgrid = GridRectangularOBSOLETE(BasePlane=PlaneXY(0, 0, 0), XCount=u, YCount=v, GridSize=num)  # -> Grid, Cells, Centers
pt = Point(<point referenced from the Rhino model>)
pt_2 = Point(<point referenced from the Rhino model>)
pt_3 = Point(<point referenced from the Rhino model>)
pt_4 = Point(<point referenced from the Rhino model>)
slider = Slider(0.0875, range=0..1)
slider_2 = Slider(1, range=0..4)
vec2pt = Vector2Pt(PointA=pt, PointB=recgrid.Centers, Unitize=False)  # -> Vector, Length
vec2pt_2 = Vector2Pt(PointA=pt_3, PointB=recgrid.Centers, Unitize=False)  # -> Vector, Length
vec2pt_3 = Vector2Pt(PointA=pt_2, PointB=recgrid.Centers, Unitize=False)  # -> Vector, Length
vec2pt_4 = Vector2Pt(PointA=pt_4, PointB=recgrid.Centers, Unitize=False)  # -> Vector, Length
vlen = VectorLength(Vector=vec2pt_2.Vector)
vlen_2 = VectorLength(Vector=vec2pt.Vector)
vlen_3 = VectorLength(Vector=vec2pt_3.Vector)
vlen_4 = VectorLength(Vector=vec2pt_4.Vector)
pow = Power(BaseNumber=vlen, Exponent=-2)
pow_2 = Power(BaseNumber=vlen_2, Exponent=-2)
pow_3 = Power(BaseNumber=vlen_3, Exponent=-2)
pow_4 = Power(BaseNumber=vlen_4, Exponent=-2)
mul = Multiply(Vector=vec2pt_2.Vector, Factor=pow)  # -> Vector, Length
mul_2 = Multiply(Vector=vec2pt_4.Vector, Factor=pow_4)  # -> Vector, Length
mul_3 = Multiply(Vector=vec2pt.Vector, Factor=pow_2)  # -> Vector, Length
mul_4 = Multiply(Vector=vec2pt_3.Vector, Factor=pow_3)  # -> Vector, Length
line = LineSDL(Start=recgrid.Centers, Direction=mul_2.Vector, Length=mul_2.Length)
line_2 = LineSDL(Start=recgrid.Centers, Direction=mul_3.Vector, Length=mul_3.Length)
line_3 = LineSDL(Start=recgrid.Centers, Direction=mul_4.Vector, Length=mul_4.Length)
line_4 = LineSDL(Start=recgrid.Centers, Direction=mul.Vector, Length=mul.Length)
# There doesnt seem to be a vector rotate method (?) so I had to turn it into a line first
rotate = Rotate(Geometry=line_3, Angle=Slider(0.5, range=-3.141592654..3.141592654), Plane=recgrid.Grid)
rotate_2 = Rotate(Geometry=line_4, Angle=Slider(-0.8771302145, range=-3.141592654..3.141592654), Plane=recgrid.Grid)
rotate_3 = Rotate(Geometry=line, Angle=Slider(0.4680942374, range=-3.141592654..3.141592654), Plane=recgrid.Grid)
rotate_4 = Rotate(Geometry=line_2, Angle=Slider(-3.141592654, range=-3.141592654..3.141592654), Plane=recgrid.Grid)
sum = Addition(VectorA=rotate_2, VectorB=rotate_4, Unitize=False)  # -> Vector, Length
sum_2 = Addition(VectorA=rotate, VectorB=rotate_3, Unitize=False)  # -> Vector, Length
# This controls the limit of the displacement - high values mean points hardly move, low values let them move all over the place. It is a factor of the grid size, and if it is greater than 2 then grid cells will not overlap.
limit = Slider(0.9133157169, range=0..2)
slider_3 = Slider(0.5, range=0..1)
sum_3 = Addition(VectorA=sum_2.Vector, VectorB=sum.Vector, Unitize=False)  # -> Vector, Length
div = Division(FirstNumber=num, SecondNumber=limit)
min = Minimum(FirstNumber=sum_3.Length, SecondNumber=div)
polygon = Polygon(Plane=recgrid.Centers, Radius=min, Segments=4, FilletRadius=0)  # -> Polygon, Length; disabled
Y = UnitY(Factor=1)
angle = Angle(VectorA=Y, VectorB=sum_3.Vector)  # -> Angle, Reflex
line_5 = LineSDL(Start=recgrid.Centers, Direction=sum_3.Vector, Length=min)
f_x = F1(Function="x-(1*(π/180))", X=angle.Angle)
rotate_5 = Rotate(Geometry=polygon.Polygon, Angle=f_x, Plane=recgrid.Centers)

explode = BrepComponents(Brep=recgrid.Cells)  # -> Faces, Edges, Vertices
explode_2 = BrepComponents(Brep=rotate_5)  # -> Faces, Edges, Vertices
item = ListItem(List=explode_2.Vertices, Index=Slider(0, range=0..4), Wrap=False)
item_2 = ListItem(List=explode_2.Vertices, Index=Slider(1, range=0..4), Wrap=False)
item_3 = ListItem(List=explode_2.Vertices, Index=Slider(2, range=0..4), Wrap=False)
item_4 = ListItem(List=explode_2.Vertices, Index=Slider(3, range=0..4), Wrap=False)
item_5 = ListItem(List=explode.Edges, Index=Slider(0, range=0..4), Wrap=False)
item_6 = ListItem(List=explode.Edges, Index=Slider(1, range=0..4), Wrap=False)
item_7 = ListItem(List=explode.Edges, Index=Slider(2, range=0..4), Wrap=False)
item_8 = ListItem(List=explode.Edges, Index=Slider(3, range=0..4), Wrap=False)
slider_4 = Slider(0.5, range=0..1)
eval = EvaluateLength(Curve=item_5, Length=slider_4, Normalized=True)  # -> Point, Tangent, Parameter
eval_2 = EvaluateLength(Curve=item_6, Length=slider_4, Normalized=True)  # -> Point, Tangent, Parameter
eval_3 = EvaluateLength(Curve=item_7, Length=slider_4, Normalized=True)  # -> Point, Tangent, Parameter
eval_4 = EvaluateLength(Curve=item_8, Length=slider_4, Normalized=True)  # -> Point, Tangent, Parameter
ln = Line(PointA=item_2, PointB=eval_4.Point)
ln_2 = Line(PointA=item, PointB=eval_3.Point)
ln_3 = Line(PointA=item_4, PointB=eval_2.Point)
ln_4 = Line(PointA=item_3, PointB=eval.Point)
line_6 = Line([ln_4, ln, ln_2, ln_3])

circle = CircleCNR(Normal=Vector(0, 0, 1), Radius=1)
eval_5 = EvaluateLength(Curve=line_5, Length=0.5, Normalized=True)  # -> Point, Tangent, Parameter
end = EndPoints(Curve=line_5)  # -> Start, End
rotate_6 = Rotate(Geometry=line_5, Angle=Slider(1.57, range=0..1.57), Plane=eval_5.Point)
end_2 = EndPoints(Curve=rotate_6)  # -> Start, End
pt_5 = Point(end.Start)
pt_6 = Point(end.End)
pt_7 = Point(end_2.Start)
pt_8 = Point(end_2.End)
ln_5 = Line(PointA=pt_6, PointB=pt_7)
ln_6 = Line(PointA=pt_6, PointB=pt_8)
ln_7 = Line(PointA=pt_5, PointB=pt_8)
ln_8 = Line(PointA=pt_5, PointB=pt_7)
