# Grasshopper definition cross jali image.ghx (Grasshopper 0.8.3)

slider = Slider(50, range=0..100)
sqgrid = Square(Plane=PlaneXY(0, 0, 0), Size=slider, ExtentX=Slider(20, range=0..100), ExtentY=Slider(20, range=0..100))  # -> Cells, Points
area = BrepArea(Brep=sqgrid.Cells)  # -> Area, Centroid

flip = FlipMatrix(Data=area.Centroid)
viewer = ParamViewer(flip)
cull = CullPattern(List=viewer, CullPattern=[False, True])
cull_2 = CullPattern(List=viewer, CullPattern=[True, False])
branch = TreeBranch(Tree=flip, Path=cull)
branch_2 = TreeBranch(Tree=flip, Path=cull_2)
cull_3 = CullPattern(List=branch, CullPattern=[True, False])
cull_4 = CullPattern(List=branch_2, CullPattern=[False, True])
cull_5 = CullPattern(List=branch, CullPattern=[False, True])
cull_6 = CullPattern(List=branch_2, CullPattern=[True, False])
merge = Merge(StreamA=cull_5, StreamB=cull_6)
merge_2 = Merge(StreamA=cull_3, StreamB=cull_4)

multipliyer = Slider(5, range=0..1000)
image = ImageSampler(
    merge,
    FilePath="D:\grasshopper work\my_gh\reboot\handa jali\handa jali.jpg",
    Interpolate=False,
    Wrap=0,
    Umin=0,
    Umax=1000,
    Vmin=0,
    Vmax=1000,
    Filter="Value")
f_x = F1(Function="x/1.4142", X=slider)
f_x_2 = F1(Function="x/1.4142", X=slider)
circle = CircleCNR(Center=merge, Normal=Vector(0, 0, 1), Radius=f_x)
circle_2 = CircleCNR(Center=merge_2, Normal=Vector(0, 0, 1), Radius=f_x_2)
f_x_y = F2(Function="x*y+5", X=image, Y=multipliyer)
divide = DivideCurve(Curve=circle, Number=8, Kinks=False)  # -> Points, Tangents, Parameters
divide_2 = DivideCurve(Curve=circle_2, Number=8, Kinks=False)  # -> Points, Tangents, Parameters
panel = Panel(f_x_y)
cull_7 = CullPattern(List=divide_2.Points, CullPattern=[False, True])
cull_8 = CullPattern(List=divide.Points, CullPattern=[False, True])
slider_2 = Slider(17.41056896, range=0..50)
crv = Curve(Vertices=cull_7, Degree=1, Periodic=True)  # -> Curve, Length, Domain
crv_2 = Curve(Vertices=cull_8, Degree=1, Periodic=True)  # -> Curve, Length, Domain
explode = Explode(Curve=crv_2.Curve, Recursive=True)  # -> Segments, Vertices
explode_2 = Explode(Curve=crv.Curve, Recursive=True)  # -> Segments, Vertices
disc = Discontinuity(Curve=crv_2.Curve, Level=1)  # -> Points, Parameters
disc_2 = Discontinuity(Curve=crv.Curve, Level=1)  # -> Points, Parameters
num = Number(f_x_y)
item = ListItem(List=disc.Points, Index=Slider(3, range=0..4), Wrap=False)
item_2 = ListItem(List=disc.Points, Index=Slider(2, range=0..4), Wrap=False)
item_3 = ListItem(List=disc.Points, Index=Slider(1, range=0..4), Wrap=False)
item_4 = ListItem(List=disc.Points, Index=Slider(0, range=0..4), Wrap=False)
item_5 = ListItem(List=explode.Segments, Index=Slider(0, range=0..4), Wrap=False)
item_6 = ListItem(List=disc_2.Points, Index=Slider(3, range=0..4), Wrap=False)
item_7 = ListItem(List=explode_2.Segments, Index=Slider(1, range=0..4), Wrap=False)
item_8 = ListItem(List=explode_2.Segments, Index=Slider(3, range=0..4), Wrap=False)
item_9 = ListItem(List=disc_2.Points, Index=Slider(2, range=0..4), Wrap=False)
item_10 = ListItem(List=disc_2.Points, Index=Slider(1, range=0..4), Wrap=False)
item_11 = ListItem(List=explode.Segments, Index=Slider(2, range=0..4), Wrap=False)
item_12 = ListItem(List=disc_2.Points, Index=Slider(0, range=0..4), Wrap=False)
dist = Distance(PointA=item_4, PointB=item_3)
f_x_y_2 = F2(Function="x-y", X=dist, Y=num)
eval = EvaluateCurve(Curve=item_5, Parameter=num)  # -> Point, Tangent, Length
eval_2 = EvaluateCurve(Curve=item_5, Parameter=f_x_y_2)  # -> Point, Tangent, Length
eval_3 = EvaluateCurve(Curve=item_11, Parameter=f_x_y_2)  # -> Point, Tangent, Length
eval_4 = EvaluateCurve(Curve=item_11, Parameter=num)  # -> Point, Tangent, Length
panel_2 = Panel(num)
eval_5 = EvaluateCurve(Curve=item_7, Parameter=num)  # -> Point, Tangent, Length
eval_6 = EvaluateCurve(Curve=item_7, Parameter=f_x_y_2)  # -> Point, Tangent, Length
eval_7 = EvaluateCurve(Curve=item_8, Parameter=f_x_y_2)  # -> Point, Tangent, Length
eval_8 = EvaluateCurve(Curve=item_8, Parameter=num)  # -> Point, Tangent, Length
weave = Weave(Pattern=[0, 1], Stream0=item_12, Stream1=[eval_7.Point, eval_6.Point, item_9], NullGaps=False)
weave_2 = Weave(Pattern=[0, 1], Stream0=item_10, Stream1=[eval_5.Point, eval_8.Point, item_6], NullGaps=False)
weave_3 = Weave(Pattern=[0, 1], Stream0=item_4, Stream1=[eval.Point, eval_4.Point, item_2], NullGaps=False)
weave_4 = Weave(Pattern=[0, 1], Stream0=item_3, Stream1=[eval_2.Point, eval_3.Point, item], NullGaps=False)
crv_3 = Curve(Vertices=weave, Degree=1, Periodic=False)  # -> Curve, Length, Domain
crv_4 = Curve(Vertices=weave_2, Degree=1, Periodic=False)  # -> Curve, Length, Domain
crv_5 = Curve(Vertices=weave_3, Degree=1, Periodic=False)  # -> Curve, Length, Domain
crv_6 = Curve(Vertices=weave_4, Degree=1, Periodic=False)  # -> Curve, Length, Domain
