# Grasshopper definition diagonal jali 4.ghx (Grasshopper 0.8.10)

srf = Surface(<surface referenced from the Rhino model>)
divide = DivideDomain²(Domain=srf, UCount=Slider(20, range=0..500), VCount=Slider(20, range=0..50))
subsrf = Isotrim(Surface=srf, Domain=divide)
area = BrepArea(Brep=subsrf)  # -> Area, Centroid
slider = Slider(6, range=0..6)
slider_2 = Slider(6, range=0..6)
slider_3 = Slider(48, range=0..100)
slider_4 = Slider(59, range=0..300)
pl = Plane(Origin=area.Centroid, XAxis=Vector(1, 0, 0), YAxis=Vector(0, 1, 0))
image = ImageSampler(
    area.Centroid,
    FilePath="F:\grasshopper work\my_gh\reboot\handa jali\stage 1\base 5.jpg",
    RelativeFilePath="..\handa jali\stage 1\base 5.jpg",
    Interpolate=False,
    Wrap=0,
    Umin=0,
    Umax=1000,
    Vmin=0,
    Vmax=1000,
    Filter="Value")
multipliyer = Slider(28.2, range=0..1000)

explode = BrepComponents(Brep=subsrf)  # -> Faces, Edges, Vertices
item = ListItem(List=explode.Vertices, Index=Slider(1, range=0..4), Wrap=False)
item_2 = ListItem(List=explode.Vertices, Index=Slider(3, range=0..4), Wrap=False)

f_x_y = F2(Function="x*y+5", X=image, Y=multipliyer)
rectangle = Rectangle(Plane=area.Centroid, XSize=f_x_y, YSize=f_x_y, Radius=0)  # -> Rec, Length
rotate = Rotate(Geometry=rectangle.Rec, Angle=Slider(0.78, range=0..1), Plane=pl)

explode_2 = BrepComponents(Brep=rotate)  # -> Faces, Edges, Vertices
item_3 = ListItem(List=explode_2.Vertices, Index=Slider(0, range=0..4), Wrap=False)
item_4 = ListItem(List=explode_2.Vertices, Index=Slider(2, range=0..4), Wrap=False)

item_5 = ListItem(List=explode.Vertices, Index=Slider(0, range=0..4), Wrap=False)
item_6 = ListItem(List=explode.Vertices, Index=Slider(2, range=0..4), Wrap=False)
item_7 = ListItem(List=explode_2.Vertices, Index=Slider(3, range=0..4), Wrap=False)
item_8 = ListItem(List=explode_2.Vertices, Index=Slider(1, range=0..4), Wrap=False)
ln = Line(PointA=item_6, PointB=item_4)
ln_2 = Line(PointA=item_8, PointB=item_2)
ln_3 = Line(PointA=item_3, PointB=item)
ln_4 = Line(PointA=item_4, PointB=item_2)
ln_5 = Line(PointA=item_7, PointB=item)
ln_6 = Line(PointA=item_3, PointB=item_5)
ln_7 = Line(PointA=item_7, PointB=item_6)
ln_8 = Line(PointA=item_8, PointB=item_5)
line = Line([ln_5, ln_7, ln_6, ln_8])
line_2 = Line([ln_2, ln, ln_3, ln_4])
