# Grasshopper definition diagonal jali.ghx (Grasshopper 0.8.3)

srf = Surface()
divide = DivideDomain²(Domain=srf, UCount=Slider(99, range=0..200), VCount=Slider(33, range=0..200))
subsrf = Isotrim(Surface=srf, Domain=divide)
area = BrepArea(Brep=subsrf)  # -> Area, Centroid
multipliyer = Slider(350, range=0..1000)
image = ImageSampler(
    area.Centroid,
    FilePath="D:\grasshopper work\my_gh\base 4.jpg",
    Interpolate=False,
    Wrap=0,
    Umin=0,
    Umax=39600,
    Vmin=0,
    Vmax=13200,
    Filter="Value")
f_x_y = F2(Function="x*y+5", X=image, Y=multipliyer)
rectangle = Rectangle(Plane=area.Centroid, XSize=f_x_y, YSize=f_x_y, Radius=0)  # -> Rec, Length

explode = BrepComponents(Brep=subsrf)  # -> Faces, Edges, Vertices
item = ListItem(List=explode.Vertices, Index=Slider(1, range=0..4), Wrap=False)
item_2 = ListItem(List=explode.Vertices, Index=Slider(3, range=0..4), Wrap=False)

explode_2 = BrepComponents(Brep=rectangle.Rec)  # -> Faces, Edges, Vertices
item_3 = ListItem(List=explode_2.Vertices, Index=Slider(0, range=0..4), Wrap=False)
item_4 = ListItem(List=explode_2.Vertices, Index=Slider(2, range=0..4), Wrap=False)

item_5 = ListItem(List=explode.Vertices, Index=Slider(0, range=0..4), Wrap=False)
item_6 = ListItem(List=explode.Vertices, Index=Slider(2, range=0..4), Wrap=False)
item_7 = ListItem(List=explode_2.Vertices, Index=Slider(3, range=0..4), Wrap=False)
item_8 = ListItem(List=explode_2.Vertices, Index=Slider(1, range=0..4), Wrap=False)
ln = Line(PointA=item, PointB=item_4)
ln_2 = Line(PointA=item_3, PointB=item_2)
ln_3 = Line(PointA=item_3, PointB=item)
ln_4 = Line(PointA=item_4, PointB=item_2)
ln_5 = Line(PointA=item_8, PointB=item_6)
ln_6 = Line(PointA=item_7, PointB=item_5)
ln_7 = Line(PointA=item_7, PointB=item_6)
ln_8 = Line(PointA=item_8, PointB=item_5)
line = Line(flatten([ln_2, ln, ln_3, ln_4]))
line_2 = Line([ln_5, ln_7, ln_6, ln_8])
