# Grasshopper definition diagonal morph jali_center.ghx (Grasshopper 0.8.3)

srf = Surface()
divide = DivideDomain²(Domain=srf, UCount=Slider(99, range=0..99), VCount=Slider(33, range=0..50))
subsrf = Isotrim(Surface=srf, Domain=divide)
area = BrepArea(Brep=subsrf)  # -> Area, Centroid
slider = Slider(59, range=0..300)
pl = Plane(Origin=area.Centroid, XAxis=Vector(1, 0, 0), YAxis=Vector(0, 1, 0))
image = ImageSampler(
    area.Centroid,
    FilePath="D:\grasshopper work\my_gh\base 5.jpg",
    Interpolate=False,
    Wrap=0,
    Umin=0,
    Umax=39600,
    Vmin=0,
    Vmax=13200,
    Filter="Value")
f_x_y = F2(Function="(x*y)-0.785", X=Slider(2.349979401, range=0..5), Y=image)
multipliyer = Slider(350, range=0..350)
explode = BrepComponents(Brep=subsrf)  # -> Faces, Edges, Vertices

item = ListItem(List=explode.Edges, Index=Slider(0, range=0..4), Wrap=False)
item_2 = ListItem(List=explode.Edges, Index=Slider(1, range=0..4), Wrap=False)
item_3 = ListItem(List=explode.Edges, Index=Slider(2, range=0..4), Wrap=False)
item_4 = ListItem(List=explode.Edges, Index=Slider(3, range=0..4), Wrap=False)

f_x_y_2 = F2(Function="x*y", X=image, Y=multipliyer)
rectangle = Rectangle(Plane=area.Centroid, XSize=f_x_y_2, YSize=f_x_y_2, Radius=0)  # -> Rec, Length
rotate = Rotate(Geometry=rectangle.Rec, Angle=f_x_y, Plane=pl)

explode_2 = BrepComponents(Brep=rotate)  # -> Faces, Edges, Vertices
item_5 = ListItem(List=explode_2.Vertices, Index=Slider(0, range=0..4), Wrap=False)
item_6 = ListItem(List=explode_2.Vertices, Index=Slider(1, range=0..4), Wrap=False)
item_7 = ListItem(List=explode_2.Vertices, Index=Slider(2, range=0..4), Wrap=False)
item_8 = ListItem(List=explode_2.Vertices, Index=Slider(3, range=0..4), Wrap=False)

slider_2 = Slider(0.5, range=0..1)
eval = EvaluateLength(Curve=item, Length=slider_2, Normalized=True)  # -> Point, Tangent, Parameter
eval_2 = EvaluateLength(Curve=item_2, Length=slider_2, Normalized=True)  # -> Point, Tangent, Parameter
eval_3 = EvaluateLength(Curve=item_3, Length=slider_2, Normalized=True)  # -> Point, Tangent, Parameter
eval_4 = EvaluateLength(Curve=item_4, Length=slider_2, Normalized=True)  # -> Point, Tangent, Parameter

ln = Line(PointA=item_6, PointB=eval_4.Point)
ln_2 = Line(PointA=item_7, PointB=eval_3.Point)
ln_3 = Line(PointA=item_8, PointB=eval_2.Point)
ln_4 = Line(PointA=item_5, PointB=eval.Point)
line = Line([ln_4, ln, ln_2, ln_3])
