# Grasshopper definition square diagonal doto graphy.ghx (Grasshopper 0.8.3)

srf = Surface()
recgrid = GridRectangularOBSOLETE(
    BasePlane=PlaneXY(0, 0, 0),
    XCount=Slider(50, range=0..500),
    YCount=Slider(17, range=0..50),
    GridSize=Slider(400, range=0..1000))  # -> Grid, Cells, Centers
divide = DivideDomain²(Domain=srf, UCount=Slider(99, range=0..500), VCount=Slider(33, range=0..50))
subsrf = Isotrim(Surface=srf, Domain=divide)
area = BrepArea(Brep=subsrf)  # -> Area, Centroid
multipliyer = Slider(400, range=0..1000)
rectangle = Rectangle(Plane=area.Centroid, XSize=multipliyer, YSize=multipliyer, Radius=0)  # -> Rec, Length
image = ImageSampler(
    recgrid.Centers,
    FilePath="D:\grasshopper work\my_gh\base 5.jpg",
    Interpolate=False,
    Wrap=0,
    Umin=-19800,
    Umax=19800,
    Vmin=-6600,
    Vmax=6600,
    Filter="Value")
image_2 = ImageSampler(
    recgrid.Grid,
    FilePath="D:\grasshopper work\my_gh\base 5.jpg",
    Interpolate=False,
    Wrap=0,
    Umin=-19800,
    Umax=19800,
    Vmin=-6600,
    Vmax=6600,
    Filter="Value")
explode = BrepComponents()  # -> Faces, Edges, Vertices
multipliyer_2 = Slider(210, range=0..1000)
item = ListItem(List=explode.Vertices, Index=Slider(0, range=0..4), Wrap=False)
f_x_y = F2(Function="x*y+5", X=image_2, Y=multipliyer_2)
flatten = FlattenTree(Data=item, Path="{0}")
f_x_y_2 = F2(Function="x*y+5", X=image, Y=multipliyer_2)
polygon = Polygon(Plane=recgrid.Centers, Radius=f_x_y_2, Segments=4, FilletRadius=0)  # -> Polygon, Length
polygon_2 = Polygon(Plane=recgrid.Grid, Radius=f_x_y, Segments=4, FilletRadius=0)  # -> Polygon, Length
