# Grasshopper definition square diagonal.ghx (Grasshopper 0.8.3)

multipliyer = Slider(210, range=0..1000)
recgrid = GridRectangularOBSOLETE(
    BasePlane=PlaneXY(0, 0, 0),
    XCount=Slider(50, range=0..500),
    YCount=Slider(17, range=0..50),
    GridSize=Slider(400, range=0..1000))  # -> Grid, Cells, Centers
pt = Point(recgrid.Centers)
image = ImageSampler(
    pt,
    FilePath="D:\grasshopper work\my_gh\base 5.jpg",
    Interpolate=False,
    Wrap=0,
    Umin=-19800,
    Umax=19800,
    Vmin=-6600,
    Vmax=6600,
    Filter="Value")
image_2 = ImageSampler(
    recgrid.Grid,
    FilePath="D:\grasshopper work\my_gh\base 5.jpg",
    Interpolate=False,
    Wrap=0,
    Umin=-19800,
    Umax=19800,
    Vmin=-6600,
    Vmax=6600,
    Filter="Value")
pl = Plane(Origin=recgrid.Centers, XAxis=Vector(1, 0, 0), YAxis=Vector(0, 1, 0))
f_x_y = F2(Function="x*y+5", X=image, Y=multipliyer)
f_x_y_2 = F2(Function="x*y+5", X=image_2, Y=multipliyer)
polygon = Polygon(Plane=recgrid.Centers, Radius=f_x_y, Segments=4, FilletRadius=0)  # -> Polygon, Length
polygon_2 = Polygon(Plane=recgrid.Grid, Radius=f_x_y_2, Segments=4, FilletRadius=0)  # -> Polygon, Length
rotate = Rotate(Geometry=polygon.Polygon, Angle=Slider(0.785, range=0..1), Plane=pl)
