# Grasshopper definition square jali 1.ghx (Grasshopper 0.8.3)

srf = Surface()
divide = DivideDomain²(Domain=srf, UCount=Slider(99, range=0..500), VCount=Slider(33, range=0..50))
subsrf = Isotrim(Surface=srf, Domain=divide)
area = BrepArea(Brep=subsrf)  # -> Area, Centroid
explode = BrepComponents(Brep=subsrf)  # -> Faces, Edges, Vertices
item = ListItem(List=explode.Edges, Index=Slider(2, range=0..4), Wrap=False)
item_2 = ListItem(List=explode.Edges, Index=Slider(0, range=0..4), Wrap=False)
image = ImageSampler(
    area.Centroid,
    FilePath="D:\grasshopper work\my_gh\base 5.jpg",
    Interpolate=False,
    Wrap=0,
    Umin=0,
    Umax=39600,
    Vmin=0,
    Vmax=13200,
    Filter="Value")
multipliyer = Slider(400, range=0..1000)
f_x_y = F2(Function="x*y+5", X=image, Y=multipliyer)
rectangle = Rectangle(Plane=area.Centroid, XSize=f_x_y, YSize=Slider(401, range=0..1000), Radius=0)  # -> Rec, Length
