# Grasshopper definition diagonal jali 5.ghx (Grasshopper 0.8.10)

srf = Surface(<surface referenced from the Rhino model>)
divide = DivideDomain²(Domain=srf, UCount=Slider(99, range=0..500), VCount=Slider(33, range=0..50))
subsrf = Isotrim(Surface=srf, Domain=divide)
area = BrepArea(Brep=subsrf)  # -> Area, Centroid
slider = Slider(6, range=0..6)
slider_2 = Slider(6, range=0..6)
slider_3 = Slider(48, range=0..100)
slider_4 = Slider(59, range=0..300)
pl = Plane(Origin=area.Centroid, XAxis=Vector(1, 0, 0), YAxis=Vector(0, 1, 0))
slider_5 = Slider(0.78, range=0..1)
f_x = F1(Function="(x/2)*1.4142", X=Slider(333, range=0..500))
circle = CircleCNR(Center=area.Centroid, Normal=Vector(0, 0, 1), Radius=f_x)
divide_2 = DivideCurve(Curve=circle, Number=8, Kinks=False)  # -> Points, Tangents, Parameters
image = ImageSampler(
    area.Centroid,
    FilePath="F:\grasshopper work\my_gh\reboot\handa jali\stage 1\base 5.jpg",
    RelativeFilePath="..\..\handa jali\stage 1\base 5.jpg",
    Interpolate=False,
    Wrap=0,
    Umin=0,
    Umax=39000,
    Vmin=0,
    Vmax=12000,
    Filter="Value")
multipliyer = Slider(100, range=0..1000)
f_x_y = F2(Function="x*y+5", X=image, Y=multipliyer)
item = ListItem(List=divide_2.Points, Index=1, Wrap=False)
item_2 = ListItem(List=divide_2.Points, Index=5, Wrap=False)
item_3 = ListItem(List=divide_2.Points, Index=7, Wrap=False)
item_4 = ListItem(List=divide_2.Points, Index=3, Wrap=False)
polygon = Polygon(Plane=area.Centroid, Radius=f_x_y, Segments=4, FilletRadius=0)  # -> Polygon, Length

explode = BrepComponents(Brep=polygon.Polygon)  # -> Faces, Edges, Vertices
item_5 = ListItem(List=explode.Vertices, Index=Slider(2, range=0..4), Wrap=False)
item_6 = ListItem(List=explode.Vertices, Index=Slider(0, range=0..4), Wrap=False)

item_7 = ListItem(List=explode.Vertices, Index=Slider(1, range=0..4), Wrap=False)
item_8 = ListItem(List=explode.Vertices, Index=Slider(3, range=0..4), Wrap=False)
ln = Line(PointA=item_6, PointB=item_3)
ln_2 = Line(PointA=item_8, PointB=item_4)
ln_3 = Line(PointA=item_7, PointB=item_3)
ln_4 = Line(PointA=item_7, PointB=item_2)
ln_5 = Line(PointA=item_5, PointB=item_4)
ln_6 = Line(PointA=item_7, PointB=item)
ln_7 = Line(PointA=item_8, PointB=item_2)
ln_8 = Line(PointA=item_5, PointB=item)
slider_6 = Slider(25, range=-100..101)
join = JoinCurves(Curves=[ln_3, ln, ln_2, ln_4, ln_5, ln_7, ln_6, ln_8], Preserve=False)
f_x_2 = F1(Function="-x", X=slider_6)
offset = Offset(Curve=join, Distance=slider_6, Plane=PlaneXY(0, 0, 0), Corners=1)
offset_2 = Offset(Curve=polygon.Polygon, Distance=f_x_2, Plane=PlaneXY(0, 0, 0), Corners=1)
