# Grasshopper definition surface subsurface.ghx (Grasshopper 0.8.10)

srf = Surface()
divide = DivideDomain²(Domain=srf, UCount=Slider(10, range=0..1000), VCount=Slider(5, range=0..1000))
subsrf = Isotrim(Surface=srf, Domain=divide)
area = BrepArea(Brep=subsrf)  # -> Area, Centroid
graft = GraftTree(Data=area.Centroid, Strip=False)
explode = BrepComponents(Brep=subsrf)  # -> Faces, Edges, Vertices
divide_2 = DivideDomain²(Domain=subsrf, UCount=Slider(3, range=0..1000), VCount=Slider(6, range=0..1000))
subsrf_2 = Isotrim(Surface=explode.Faces, Domain=divide_2)
item = ListItem(List=explode.Edges, Index=0, Wrap=False)
item_2 = ListItem(List=explode.Edges, Index=1, Wrap=False)
line = Line([item, item_2])
area_2 = BrepArea(Brep=subsrf_2)  # -> Area, Centroid
image = ImageSampler(
    area_2.Centroid,
    FilePath="F:\grasshopper work\my_gh\base.jpg",
    RelativeFilePath="..\..\base.jpg",
    Interpolate=False,
    Wrap=0,
    Umin=0,
    Umax=1000,
    Vmin=0,
    Vmax=1000,
    Filter="Value")
f_x_y = F2(Function="x*y", X=image, Y=Slider(14.55, range=0..100))
int = Integer(f_x_y)
circle = CircleCNR(Center=area_2.Centroid, Normal=Vector(0, 0, 1), Radius=int)
viewer = ParamViewer(area_2.Centroid)
viewer_2 = ParamViewer(graft)
