# Grasshopper definition testing weaving.ghx (Grasshopper 0.8.3)

hexgrid = Hexagonal(
    Plane=PlaneXY(0, 0, 0),
    Size=Slider(29.12500381, range=0..50),
    ExtentX=Slider(20, range=0..200),
    ExtentY=Slider(20, range=0..200))  # -> Cells, Points
multipliyer = Slider(35, range=0..1000)
image = ImageSampler(
    hexgrid.Points,
    FilePath="D:\grasshopper work\my_gh\base 4.jpg",
    Interpolate=False,
    Wrap=0,
    Umin=0,
    Umax=1000,
    Vmin=0,
    Vmax=1000,
    Filter="Value")
multipliyer_2 = Slider(50, range=0..1000)
f_x_y = F2(Function="x*y+5", X=image, Y=multipliyer)
rectangle = Rectangle(Plane=hexgrid.Points, XSize=f_x_y, YSize=multipliyer_2, Radius=0)  # -> Rec, Length

explode = BrepComponents()  # -> Faces, Edges, Vertices
item = ListItem(List=explode.Edges, Index=Slider(0, range=0..4), Wrap=False)
item_2 = ListItem(List=explode.Edges, Index=Slider(1, range=0..4), Wrap=False)

explode_2 = BrepComponents(Brep=rectangle.Rec)  # -> Faces, Edges, Vertices
item_3 = ListItem(List=explode_2.Vertices, Index=Slider(0, range=0..4), Wrap=False)
item_4 = ListItem(List=explode_2.Vertices, Index=Slider(2, range=0..4), Wrap=False)

item_5 = ListItem(List=explode.Edges, Index=Slider(2, range=0..4), Wrap=False)
item_6 = ListItem(List=explode.Edges, Index=Slider(3, range=0..4), Wrap=False)
item_7 = ListItem(List=explode_2.Vertices, Index=Slider(3, range=0..4), Wrap=False)
item_8 = ListItem(List=explode_2.Vertices, Index=Slider(1, range=0..4), Wrap=False)
eval = EvaluateLength(Curve=item_6, Length=Slider(0.5, range=0..1), Normalized=True)  # -> Point, Tangent, Parameter
ln = Line(PointA=item_3, PointB=eval.Point)
ln_2 = Line(PointA=item_8, PointB=eval.Point)
eval_2 = EvaluateLength(Curve=item_2, Length=Slider(0.5, range=0..1), Normalized=True)  # -> Point, Tangent, Parameter
ln_3 = Line(PointA=item_4, PointB=eval_2.Point)
ln_4 = Line(PointA=item_7, PointB=eval_2.Point)
line = Line(flatten([ln_3, ln, ln_4, ln_2]))
