# Grasshopper definition light painting try 2.gh (Grasshopper 0.9.72)

contour_height = Slider(3, range=0..51)
divisions = Slider(30, range=0..81)
printer_center = Panel("""0
0
10""")
prefix_gcode = Panel(""";code generated for light painting
;by grass hopper

G28
G90
G21""")
brep = Brep(<brep referenced from the Rhino model>)
postfix_gcode = Panel("G28")
item = ListItem(List=printer_center, Index=0, Wrap=True)
item_2 = ListItem(List=printer_center, Index=0, Wrap=True)
item_3 = ListItem(List=printer_center, Index=2, Wrap=True)
feed_rate = Panel("3500")
gcode_to_switch = Panel("M42")
led_pin = Panel("11")
led_pin_value = Panel("255")
led_pin_value_2 = Panel("0")
cir = Circle(Plane=PlaneXY(0, 0, 0), Radius=Slider(121, range=0..1203))
Z = UnitZ(Factor=Slider(97, range=0..1203))
bbox = BoundingBox(Content=brep, Plane=PlaneXY(0, 0, 0))  # -> Box, Box_2
xy = XYPlane(Origin=Point(0, 0, 0))
extr = Extrude(Base=cir, Direction=Z)
pt = ConstructPoint(XCoordinate=item, YCoordinate=item_2, ZCoordinate=item_3)
debrep = DeconstructBrep(Brep=bbox.Box)  # -> Faces, Edges, Vertices
num = Number(led_pin_value_2)
num_2 = Number(led_pin)
num_3 = Number(feed_rate)
num_4 = Number(led_pin_value)
panel = Panel(pt)
item_4 = ListItem(List=debrep.Faces, Index=Slider(4, range=0..10), Wrap=True)
led_off = Evaluate(F="Format(\"{0:X } {1:P0 }{2:S0 }\",x,y,z)", x=gcode_to_switch, y=num_2, z=num)
led_on = Evaluate(F="Format(\"{0:X } {1:P0 }{2:S0 }\",x,y,z)", x=gcode_to_switch, y=num_2, z=num_4)
area = Area(Geometry=item_4)  # -> Area, Centroid
xy_2 = XYPlane(Origin=area.Centroid)
xy_3 = XYPlane(Origin=pt)
orient = Orient(Geometry=brep, Source=xy_2, Target=xy_3)  # -> Geometry, Transform
contour = Contour(Shape=orient.Geometry, Point=xy, Direction=Vector(0, 0, 1), Distance=contour_height)
explode = Explode(Curve=contour, Recursive=True)  # -> Segments, Vertices
divide = DivideCurve(Curve=explode.Segments, Count=divisions, Kinks=True)  # -> Points, Tangents, Parameters
pdecon = Deconstruct(Point=divide.Points)  # -> XComponent, YComponent, ZComponent
eval = Evaluate(
    F="Format(\"{0:G1 X0.00 }{1:Y0.00 }{2:Z0.00}{3: F0 }\",x,y,z,f)",
    x=pdecon.XComponent,
    y=pdecon.YComponent,
    z=pdecon.ZComponent,
    F_2=num_3)
rep = ReplaceString(String=eval, Find="-G1 X", Replace="G1 X-", RecursiveReplace=False)
rep_2 = ReplaceString(String=rep, Find="-Y", Replace="Y-", RecursiveReplace=False)
simplify = SimplifyTree(Tree=flatten(rep_2), Front=False)
lng = ListLength(List=simplify)
dup = DuplicateData(Data=led_off, Number=expr("x/2", lng), Order=True)
dup_2 = DuplicateData(Data=led_on, Number=expr("x/2", lng), Order=True)
weave = Weave(Pattern=[0, 1, 0, 2], Stream0=simplify, Stream1=dup_2, Stream2=dup, NullGaps=False)
merge = Merge(Data1=prefix_gcode, Data2=weave)
merge_2 = Merge(Data1=flatten(merge), Data2=postfix_gcode)
output = Panel(merge_2)
