# Grasshopper definition waterbom color.gh (Grasshopper 0.8.66)

# ----
# circle in series
pt = PointXYZ(XComponent=0, YComponent=0, ZComponent=0, System=PlaneXY(0, 0, 0))
offset = Slider(0.1, range=0..1)
diameter = Slider(20, range=4..20)
number_of_parts = Slider(16, range=0..20)
toggle_bake = BooleanToggle(False)
side = Slider(2, range=0..20)
pt_2 = Point(pt)
polygon = Polygon(Plane=pt_2, Radius=expr("R/2", diameter), Segments=number_of_parts, FilletRadius=0)  # -> Polygon, Length
side_2 = Number(side)
explode = BrepComponents(Brep=polygon.Polygon)  # -> Faces, Edges, Vertices
eval = EvaluateLength(Curve=explode.Edges, Length=0.5, Normalized=True)  # -> Point, Tangent, Parameter
pl_3pt = Plane3Pt(PointA=explode.Vertices, PointB=eval.Point, PointC=pt_2)
vec2pt = Vector2Pt(PointA=pt_2, PointB=eval.Point, Unitize=False)  # -> Vector, Length
hypo = F1(Function="((x^2)+(x^2))^.5", X=side_2)
pt_1 = Point(explode.Vertices)
vec2pt_2 = Vector2Pt(PointA=pt_2, PointB=pt_1, Unitize=False)  # -> Vector, Length
sph = Sphere(Base=pt_1, Radius=hypo)
line = LineSDL(Start=explode.Vertices, Direction=pl_3pt, Length=side_2)
rot_angle = Angle(VectorA=vec2pt_2.Vector, VectorB=vec2pt.Vector)  # -> Angle, Reflex
item = ListItem(List=rot_angle.Angle, Index=0, Wrap=False)
rad = Radians(Degrees="0")
rad_2 = Radians(Degrees="125")
end = EndPoints(Curve=line)  # -> Start, End
line_2 = LineSDL(Start=pt_2, Direction=Vector(0, 0, 1), Length=1)
rad_3 = Radians(Degrees="0")
rad_4 = Radians(Degrees="125")
rotax = RotateAxis(Geometry=polygon.Polygon, Angle=item, Axis=line_2)  # -> Geometry, Transform
dom = Domain(DomainStart=rad, DomainEnd=rad_2)
pt_3 = Point(end.End)
explode_2 = BrepComponents(Brep=rotax.Geometry)  # -> Faces, Edges, Vertices
dom_2 = Domain(DomainStart=rad_3, DomainEnd=rad_4)
pt_4 = Point(explode_2.Vertices)
line_3 = LineSDL(Start=pt_4, Direction=pl_3pt, Length=side_2)
end_2 = EndPoints(Curve=line_3)  # -> Start, End
pl_3pt_2 = Plane3Pt(PointA=end.Start, PointB=pt_4, PointC=end.End)
arc = Arc(Plane=pl_3pt_2, Radius=side_2, Angle=dom)  # -> Arc, Length
clx = CurveLine(Curve=arc.Arc, Line=line_3, First=False)  # -> Points, Params, Count
flatten = FlattenTree(Data=clx.Points, Path="{0}")
dist = Distance(PointA=eval.Point, PointB=flatten)
pl_3pt_main = Plane3Pt(PointA=flatten, PointB=end_2.End, PointC=pt_2)
arc_2 = Arc(Plane=pl_3pt_main, Radius=side_2, Angle=dom_2)  # -> Arc, Length
bcx = BrepCurve(Brep=sph, Curve=arc_2.Arc)  # -> Curves, Points
item_2 = ListItem(List=dist, Index=0, Wrap=False)
flatten_2 = FlattenTree(Data=bcx.Points, Path="{0}")
pl_3pt_3 = Plane3Pt(PointA=flatten_2, PointB=flatten, PointC=pt_4)
rad_5 = Radians(Degrees="270")
rad_6 = Radians(Degrees="360")
rad_7 = Radians(Degrees="0")
rad_8 = Radians(Degrees="80")
dom_3 = Domain(DomainStart=rad_5, DomainEnd=rad_6)
pl_3pt_4 = Plane3Pt(PointA=pt_1, PointB=pt_3, PointC=pt_2)
mirror = Mirror(Geometry=flatten_2, Plane=pl_3pt_4)  # -> Geometry, Transform
arc_3 = Arc(Plane=pl_3pt_3, Radius=side_2, Angle=dom_3)  # -> Arc, Length
dom_4 = Domain(DomainStart=rad_7, DomainEnd=rad_8)
num = Number(offset)
sph_2 = Sphere(Base=flatten_2, Radius=side_2)
arc_4 = Arc(Plane=pl_3pt_4, Radius=side_2, Angle=dom_4)  # -> Arc, Length
bcx_2 = BrepCurve(Brep=sph_2, Curve=arc_4.Arc)  # -> Curves, Points
xy = XYPlane(Origin=Point(0, 0, 0))
flatten_3 = FlattenTree(Data=bcx_2.Points, Path="{0}")
pl_3pt_5 = Plane3Pt(PointA=flatten_2, PointB=flatten_3, PointC=mirror.Geometry)
mirror_2 = Mirror(Geometry=pt_1, Plane=pl_3pt_5)  # -> Geometry, Transform
sph_3 = Sphere(Base=mirror_2.Geometry, Radius=side_2)
bcx_3 = BrepCurve(Brep=sph_3, Curve=arc_3.Arc)  # -> Curves, Points
cull = CullPattern(List=bcx_3.Points, CullPattern=[True, False])
flatten_4 = FlattenTree(Data=cull, Path="{0}")
sur_new_sm_top = Cluster(
    Point=mirror_2.Geometry,
    Point_2=flatten_4,
    Point_3=flatten_2,
    Number=num,
    Point_4=mirror_2.Geometry,
    Point_5=flatten_4,
    Point_6=flatten_2,
    Number_2=num,
    Point_7=sur_new_sm_top.ClusterInput,
    Point_8=sur_new_sm_top.ClusterInput,
    Point_9=sur_new_sm_top.ClusterInput,
    PointA=sur_new_sm_top.Data,
    PointB=sur_new_sm_top.Data,
    PointC=sur_new_sm_top.Data,
    Curve=sur_new_sm_top.Data,
    Distance=expr("-D", sur_new_sm_top.Number),
    Plane=sur_new_sm_top.Data,
    Stream0=sur_new_sm_top.Data,
    Stream1=sur_new_sm_top.Data,
    Stream2=sur_new_sm_top.Data,
    Vertices=sur_new_sm_top.Weave,
    Data=sur_new_sm_top.Curve,
    Data_2=sur_new_sm_top.Plane,
    Edges=sur_new_sm_top.Curve,
    Number_3=sur_new_sm_top.ClusterInput,
    Data_3=sur_new_sm_top.Point,
    Data_4=sur_new_sm_top.Point,
    Data_5=sur_new_sm_top.Point,
    InnerSurf=sur_new_sm_top.List,
    ClusterOutput=sur_new_sm_top.Breps,
    ClusterOutput_2=sur_new_sm_top.Surface,
    Surface=sur_new_sm_top.Surfaces,
    Curves=sur_new_sm_top.Curve,
    List=sur_new_sm_top.Fragments,
    List_2=sur_new_sm_top.Fragments,
    Brep=sur_new_sm_top.Curve,
    StartPoint=sur_new_sm_top.Data,
    EndPoint=sur_new_sm_top.Data,
    StartPoint_2=sur_new_sm_top.Data,
    EndPoint_2=sur_new_sm_top.Data,
    StartPoint_3=sur_new_sm_top.Data,
    EndPoint_3=sur_new_sm_top.Data,
    List_3=sur_new_sm_top.Edges,
    List_4=sur_new_sm_top.Edges,
    List_5=sur_new_sm_top.Edges,
    CurveA=sur_new_sm_top.Line,
    CurveB=sur_new_sm_top.Element,
    CurveA_2=sur_new_sm_top.Line,
    CurveB_2=sur_new_sm_top.Element,
    CurveA_3=sur_new_sm_top.Line,
    CurveB_3=sur_new_sm_top.Element,
    Breps=[sur_new_sm_top.Surface, sur_new_sm_top.Surface, sur_new_sm_top.Surface],
    InternalDocument_plugin_version=(0, 8, 66),
    InternalDocument_DocumentHeader_PreviewNormal=RGB(178, 220, 0),
    InternalDocument_DocumentHeader_PreviewSelected=RGBA(0, 150, 0, 100),
    InternalDocument_DefinitionProperties_Projection_Zoom=0.3276800215,
    InternalDocument_DefinitionObjects_Object5_Container_NullGaps=False)  # -> OuterSurface, InnerSurf, OuterSurface_2, InnerSurf_2
sur_new_1_bottom = Cluster(
    Point=flatten,
    Point_2=flatten_2,
    Point_3=pt_1,
    Number=num,
    Point_4=flatten,
    Point_5=flatten_2,
    Point_6=pt_1,
    Number_2=num,
    Point_7=sur_new_sm_top.ClusterInput,
    Point_8=sur_new_sm_top.ClusterInput,
    Point_9=sur_new_sm_top.ClusterInput,
    PointA=sur_new_sm_top.Data,
    PointB=sur_new_sm_top.Data,
    PointC=sur_new_sm_top.Data,
    Curve=sur_new_sm_top.Data,
    Distance=expr("-D", sur_new_sm_top.Number),
    Plane=sur_new_sm_top.Data,
    Stream0=sur_new_sm_top.Data,
    Stream1=sur_new_sm_top.Data,
    Stream2=sur_new_sm_top.Data,
    Vertices=sur_new_sm_top.Weave,
    Data=sur_new_sm_top.Curve,
    Data_2=sur_new_sm_top.Plane,
    Edges=sur_new_sm_top.Curve,
    Number_3=sur_new_sm_top.ClusterInput,
    Data_3=sur_new_sm_top.Point,
    Data_4=sur_new_sm_top.Point,
    Data_5=sur_new_sm_top.Point,
    InnerSurf=sur_new_sm_top.List,
    ClusterOutput=sur_new_sm_top.Breps,
    ClusterOutput_2=sur_new_sm_top.Surface,
    Surface=sur_new_sm_top.Surfaces,
    Curves=sur_new_sm_top.Curve,
    List=sur_new_sm_top.Fragments,
    List_2=sur_new_sm_top.Fragments,
    Brep=sur_new_sm_top.Curve,
    StartPoint=sur_new_sm_top.Data,
    EndPoint=sur_new_sm_top.Data,
    StartPoint_2=sur_new_sm_top.Data,
    EndPoint_2=sur_new_sm_top.Data,
    StartPoint_3=sur_new_sm_top.Data,
    EndPoint_3=sur_new_sm_top.Data,
    List_3=sur_new_sm_top.Edges,
    List_4=sur_new_sm_top.Edges,
    List_5=sur_new_sm_top.Edges,
    CurveA=sur_new_sm_top.Line,
    CurveB=sur_new_sm_top.Element,
    CurveA_2=sur_new_sm_top.Line,
    CurveB_2=sur_new_sm_top.Element,
    CurveA_3=sur_new_sm_top.Line,
    CurveB_3=sur_new_sm_top.Element,
    Breps=[sur_new_sm_top.Surface, sur_new_sm_top.Surface, sur_new_sm_top.Surface],
    ClusterInput=[sur_new_sm_top, sur_new_sm_top, sur_new_sm_top, sur_new_sm_top],
    InternalDocument_plugin_version=(0, 8, 66),
    InternalDocument_DocumentHeader_PreviewNormal=RGB(178, 220, 0),
    InternalDocument_DocumentHeader_PreviewSelected=RGBA(0, 150, 0, 100),
    InternalDocument_DefinitionProperties_Projection_Zoom=0.3276800215,
    InternalDocument_DefinitionObjects_Object5_Container_NullGaps=False)  # -> OuterSurface, InnerSurf, OuterSurface_2, InnerSurf_2
sur_new_1_large = Cluster(
    Point=pt_1,
    Point_2=mirror_2.Geometry,
    Point_3=flatten_2,
    Number=num,
    Point_4=pt_1,
    Point_5=mirror_2.Geometry,
    Point_6=flatten_2,
    Number_2=num,
    Point_7=sur_new_sm_top.ClusterInput,
    Point_8=sur_new_sm_top.ClusterInput,
    Point_9=sur_new_sm_top.ClusterInput,
    PointA=sur_new_sm_top.Data,
    PointB=sur_new_sm_top.Data,
    PointC=sur_new_sm_top.Data,
    Curve=sur_new_sm_top.Data,
    Distance=expr("-D", sur_new_sm_top.Number),
    Plane=sur_new_sm_top.Data,
    Stream0=sur_new_sm_top.Data,
    Stream1=sur_new_sm_top.Data,
    Stream2=sur_new_sm_top.Data,
    Vertices=sur_new_sm_top.Weave,
    Data=sur_new_sm_top.Curve,
    Data_2=sur_new_sm_top.Plane,
    Edges=sur_new_sm_top.Curve,
    Number_3=sur_new_sm_top.ClusterInput,
    Data_3=sur_new_sm_top.Point,
    Data_4=sur_new_sm_top.Point,
    Data_5=sur_new_sm_top.Point,
    InnerSurf=sur_new_sm_top.List,
    ClusterOutput=sur_new_sm_top.Breps,
    ClusterOutput_2=sur_new_sm_top.Surface,
    Surface=sur_new_sm_top.Surfaces,
    Curves=sur_new_sm_top.Curve,
    List=sur_new_sm_top.Fragments,
    List_2=sur_new_sm_top.Fragments,
    Brep=sur_new_sm_top.Curve,
    StartPoint=sur_new_sm_top.Data,
    EndPoint=sur_new_sm_top.Data,
    StartPoint_2=sur_new_sm_top.Data,
    EndPoint_2=sur_new_sm_top.Data,
    StartPoint_3=sur_new_sm_top.Data,
    EndPoint_3=sur_new_sm_top.Data,
    List_3=sur_new_sm_top.Edges,
    List_4=sur_new_sm_top.Edges,
    List_5=sur_new_sm_top.Edges,
    CurveA=sur_new_sm_top.Line,
    CurveB=sur_new_sm_top.Element,
    CurveA_2=sur_new_sm_top.Line,
    CurveB_2=sur_new_sm_top.Element,
    CurveA_3=sur_new_sm_top.Line,
    CurveB_3=sur_new_sm_top.Element,
    Breps=[sur_new_sm_top.Surface, sur_new_sm_top.Surface, sur_new_sm_top.Surface],
    ClusterInput=[sur_new_sm_top, sur_new_sm_top, sur_new_sm_top, sur_new_sm_top],
    InternalDocument_plugin_version=(0, 8, 66),
    InternalDocument_DocumentHeader_PreviewNormal=RGB(178, 220, 0),
    InternalDocument_DocumentHeader_PreviewSelected=RGBA(0, 150, 0, 100),
    InternalDocument_DefinitionProperties_Projection_Zoom=0.3276800215,
    InternalDocument_DefinitionObjects_Object5_Container_NullGaps=False)  # -> OuterSurface, InnerSurf, OuterSurface_2, InnerSurf_2
Z = UnitZ(Factor=item_2)
flip = FlipMatrix(Data=pl_3pt_main)
join = BrepJoin(Breps=[sur_new_sm_top.OuterSurface_2, sur_new_1_bottom.OuterSurface_2])  # -> Breps, Closed
join_2 = BrepJoin(Breps=[sur_new_sm_top.InnerSurf_2, sur_new_1_bottom.InnerSurf_2])  # -> Breps, Closed
mirror_3 = Mirror(Geometry=sur_new_1_large.OuterSurface_2, Plane=flip)  # -> Geometry, Transform
mirror_4 = Mirror(Geometry=join.Breps, Plane=flip)  # -> Geometry, Transform
mirror_5 = Mirror(Geometry=join_2.Breps, Plane=flip)  # -> Geometry, Transform
mirror_6 = Mirror(Geometry=sur_new_1_large.InnerSurf_2, Plane=flip)  # -> Geometry, Transform
join_outer = BrepJoin(Breps=[join.Breps, mirror_4.Geometry])  # -> Breps, Closed
mirror_7 = Mirror(Geometry=join_outer.Breps, Plane=xy)  # -> Geometry, Transform
rotax_2 = RotateAxis(Geometry=mirror_7.Geometry, Angle=item, Axis=line_2)  # -> Geometry, Transform
join_inner = BrepJoin(Breps=[join_2.Breps, mirror_5.Geometry])  # -> Breps, Closed
mirror_8 = Mirror(Geometry=join_inner.Breps, Plane=xy)  # -> Geometry, Transform
rotax_3 = RotateAxis(Geometry=mirror_8.Geometry, Angle=item, Axis=line_2)  # -> Geometry, Transform
join_l_outer = BrepJoin(Breps=[sur_new_1_large.OuterSurface_2, mirror_3.Geometry])  # -> Breps, Closed
mirror_9 = Mirror(Geometry=join_l_outer.Breps, Plane=xy)  # -> Geometry, Transform
rotax_4 = RotateAxis(Geometry=mirror_9.Geometry, Angle=item, Axis=line_2)  # -> Geometry, Transform
join_l_inner = BrepJoin(Breps=[mirror_6.Geometry, sur_new_1_large.InnerSurf_2])  # -> Breps, Closed
mirror_10 = Mirror(Geometry=join_l_inner.Breps, Plane=xy)  # -> Geometry, Transform
rotax_5 = RotateAxis(Geometry=mirror_10.Geometry, Angle=item, Axis=line_2)  # -> Geometry, Transform
move_outer = Move(Geometry=rotax_2.Geometry, Motion=Z)  # -> Geometry, Transform
move_inner = Move(Geometry=rotax_3.Geometry, Motion=Z)  # -> Geometry, Transform
move_outer_l = Move(Geometry=rotax_4.Geometry, Motion=Z)  # -> Geometry, Transform
move_inner_l = Move(Geometry=rotax_5.Geometry, Motion=Z)  # -> Geometry, Transform
swatch = ColourSwatch(SwatchColor=RGB(0, 0, 0))
swatch_2 = ColourSwatch(SwatchColor=RGBA(202, 108, 0, 151))
swatch_3 = ColourSwatch(SwatchColor=RGBA(0, 0, 0, 162))
preview = CustomPreview(Geometry=[join_inner.Breps, move_inner.Geometry], Shader=swatch_2)
preview_2 = CustomPreview(Geometry=[move_inner_l.Geometry, join_l_inner.Breps], Shader=swatch_3)
preview_3 = CustomPreview(Geometry=[join_outer.Breps, join_l_outer.Breps, move_outer.Geometry, move_outer_l.Geometry], Shader=swatch)
move_distance = Number(item_2)
rotate_angle = Number(item)
col_large_inner = Colour(swatch_3)
col_small_inner = Colour(swatch_2)
col_border = Colour(swatch)
pt_1_2 = Point(flatten_3)
pt_2_2 = Point(mirror_2.Geometry)
pt_3_2 = Point(flatten_4)
side_3 = Number(side_2)
center = Point(pt_2)
offset_2 = Number(offset)

bake_large_inner = CSharpScript(obj=[move_inner_l.Geometry, join_l_inner.Breps], layer="large inner", color=swatch_3, activate=toggle_bake)  # -> out; inputs obj: GeometryBase, name: String, layer: String, color: Color, pWidth: Double, wires: Int32, activate: Boolean
# ---------- bake_large_inner: C# ----------
    //Inserts geometry into the Rhino document, with custom attributes
    //Written by Giulio Piacentino
    //Version written 2010 11 21 - for Grasshopper 0.8.002

    if (activate)
    {
      if(obj == null)
      {
        Print("No object to bake");
        return;
      }

      //Make new attribute to set name
      Rhino.DocObjects.ObjectAttributes att = new Rhino.DocObjects.ObjectAttributes();

      //Set object name
      if(!string.IsNullOrEmpty(name))
      {
        att.Name = name;
      }

      //Set color
      if(!color.IsEmpty)
      {
        att.ColorSource = Rhino.DocObjects.ObjectColorSource.ColorFromObject; //Make the color type "by object"
        att.ObjectColor = color;

        att.PlotColorSource = Rhino.DocObjects.ObjectPlotColorSource.PlotColorFromObject; //Make the plot color type "by object"
        att.PlotColor = color;
      }

      //Set layer
      if(!string.IsNullOrEmpty(layer) && Rhino.DocObjects.Layer.IsValidName(layer))
      {
        //Get the current layer index
        Rhino.DocObjects.Tables.LayerTable layerTable = doc.Layers;
        int layerIndex = layerTable.Find(layer, true);

        if(layerIndex < 0) //This layer does not exist, we add it
        {
          Rhino.DocObjects.Layer onlayer = new Rhino.DocObjects.Layer(); //Make a new layer
          onlayer.Name = layer;

          layerIndex = layerTable.Add(onlayer); //Add the layer to the layer table
          if (layerIndex > -1) //We manged to add layer!
          {
            att.LayerIndex = layerIndex;
            Print("Added new layer to the document at position " + layerIndex + " named " + layer + ". ");
          } else
            Print("Layer did not add. Try cleaning up your layers."); //This never happened to me.
        }
        else
          att.LayerIndex = layerIndex; //We simply add to the existing layer
      }


      //Set plotweight
      if(pWidth > 0)
      {
        att.PlotWeightSource = Rhino.DocObjects.ObjectPlotWeightSource.PlotWeightFromObject;
        att.PlotWeight = pWidth;
      }


      //Set material
      bool materialByName = !string.IsNullOrEmpty(material as string);
      Rhino.Display.DisplayMaterial inMaterial = material as Rhino.Display.DisplayMaterial;
      if(material is Color)
      {
        inMaterial = new Rhino.Display.DisplayMaterial((Color) material);
      }
      if(material != null && inMaterial == null && !materialByName)
      {
        if(!(material is string))
        {
          try //We also resort to try with IConvertible
          {
            inMaterial = (Rhino.Display.DisplayMaterial) Convert.ChangeType(material, typeof(Rhino.Display.DisplayMaterial));
          }
          catch(InvalidCastException)
          {
          }
        }
      }
      if(inMaterial != null || materialByName)
      {
        string matName;

        if(!materialByName)
        {
          matName = string.Format("A:{0}-D:{1}-E:{2}-S:{3},{4}-T:{5}",
            Format(inMaterial.Ambient),
            Format(inMaterial.Diffuse),
            Format(inMaterial.Emission),
            Format(inMaterial.Specular),
            inMaterial.Shine.ToString(),
            inMaterial.Transparency.ToString()
            );
        }
        else
        {
          matName = (string) material;
        }

        int materialIndex = doc.Materials.Find(matName, true);
        if(materialIndex < 0 && !materialByName) //Material does not exist and we have its specs
        {
          materialIndex = doc.Materials.Add(); //Let's add it
          if(materialIndex > -1)
          {
            Print("Added new material at position " + materialIndex + " named \"" + matName + "\". ");
            Rhino.DocObjects.Material m = doc.Materials[materialIndex];
            m.Name = matName;
            m.AmbientColor = inMaterial.Ambient;
            m.DiffuseColor = inMaterial.Diffuse;
            m.EmissionColor = inMaterial.Emission;
            //m.ReflectionColor = no equivalent
            m.SpecularColor = inMaterial.Specular;
            m.Shine = inMaterial.Shine;
            m.Transparency = inMaterial.Transparency;
            //m.TransparentColor = no equivalent
            m.CommitChanges();

            att.MaterialSource = Rhino.DocObjects.ObjectMaterialSource.MaterialFromObject;
            att.MaterialIndex = materialIndex;
          }
          else
            Print("Material did not add. Try cleaning up your materials."); //This never happened to me.
        }
        else if(materialIndex < 0 && materialByName) //Material does not exist and we do not have its specs. We do nothing
        {
          Print("Warning: material name not found. I cannot set the source to this material name. Add a material with name: " + matName);
        }
        else
        {
          //If this material exists, we do not replace it!
          att.MaterialSource = Rhino.DocObjects.ObjectMaterialSource.MaterialFromObject;
          att.MaterialIndex = materialIndex;
        }
      }


      //Set wire density
      if(wires == -1 || wires > 0)
      {
        att.WireDensity = wires;
      }


      //Bake to the right type of object
      switch(obj.ObjectType)
      {
        case Rhino.DocObjects.ObjectType.Brep:
          doc.Objects.AddBrep(obj as Brep, att);
          break;
        case Rhino.DocObjects.ObjectType.Curve:
          doc.Objects.AddCurve(obj as Curve, att);
          break;
        case Rhino.DocObjects.ObjectType.Point:
          doc.Objects.AddPoint((obj as Rhino.Geometry.Point).Location, att);
          break;
        case Rhino.DocObjects.ObjectType.Surface:
          doc.Objects.AddSurface(obj as Surface, att);
          break;
        case Rhino.DocObjects.ObjectType.Mesh:
          doc.Objects.AddMesh(obj as Mesh, att);
          break;
        case Rhino.DocObjects.ObjectType.Extrusion:
          typeof(Rhino.DocObjects.Tables.ObjectTable).InvokeMember("AddExtrusion", BindingFlags.Instance | BindingFlags.InvokeMethod, null, doc.Objects, new object[]{obj, att});
          break;
        case Rhino.DocObjects.ObjectType.PointSet:
          doc.Objects.AddPointCloud(obj as Rhino.Geometry.PointCloud, att); //This is a speculative entry
          break;
        default:
          Print("The script does not know how to handle this type of geometry: " + obj.GetType().FullName);
          break;
      }
      Print("Added " + obj.GetType().Name);

    }
    else
    {
      Print("Inactive");
    }
# ---------- bake_large_inner: C# additional code ----------
  static string Format(Color c)
  {
    return (new System.Text.StringBuilder("A")).Append(c.A.ToString()).Append("R").Append(c.R.ToString()).Append("G")
      .Append(c.G.ToString()).Append("B").Append(c.B.ToString()).ToString();
  }
# ---------- end bake_large_inner ----------
bake_outer_frame = CSharpScript(
    obj=[join_outer.Breps, join_l_outer.Breps, move_outer_l.Geometry, move_outer.Geometry],
    layer="outer frame",
    color=swatch,
    activate=toggle_bake)  # -> out; inputs obj: GeometryBase, name: String, layer: String, color: Color, pWidth: Double, wires: Int32, activate: Boolean; same code as bake_large_inner
bakesmall_inner = CSharpScript(obj=[join_inner.Breps, move_inner.Geometry], layer="small inner", color=swatch_2, activate=toggle_bake)  # -> out; inputs obj: GeometryBase, name: String, layer: String, color: Color, pWidth: Double, wires: Int32, activate: Boolean; same code as bake_large_inner

pt_2_3 = Point(pt_2_2)
pt_3_3 = Point(pt_3_2)
rotate_angle_2 = Number(rotate_angle)
move_distance_2 = Number(move_distance)
pt_1_3 = Point(pt_1_2)
center_2 = Point(center)
side_4 = Number(side_3)
col_large_inner_2 = Colour(col_large_inner)
col_small_inner_2 = Colour(col_small_inner)
col_border_2 = Colour(col_border)
offset_3 = Number(offset_2)
pl_3pt_6 = Plane3Pt(PointA=pt_2_3, PointB=pt_1_3, PointC=center_2)
rad_9 = Radians(Degrees="0")
rad_10 = Radians(Degrees="180")
rad_11 = Radians(Degrees="0")
rad_12 = Radians(Degrees="150")
f_x = F1(Function="((x^2)+(x^2))^.5", X=side_4)
line_4 = LineSDL(Start=center_2, Direction=Vector(0, 0, 1), Length=1)
dom_5 = Domain(DomainStart=rad_9, DomainEnd=rad_10)
arc_5 = Arc(Plane=pl_3pt_6, Radius=side_4, Angle=dom_5)  # -> Arc, Length
dom_6 = Domain(DomainStart=rad_11, DomainEnd=rad_12)
line_5 = LineSDL(Start=pt_3_3, Direction=Vector(0, 0, 1), Length=1)
sph_4 = Sphere(Base=pt_3_3, Radius=f_x)
end_3 = EndPoints(Curve=line_5)  # -> Start, End
bcx_4 = BrepCurve(Brep=sph_4, Curve=arc_5.Arc)  # -> Curves, Points
pl_3pt_7 = Plane3Pt(PointA=end_3.Start, PointB=end_3.End, PointC=center_2)
arc_6 = Arc(Plane=pl_3pt_7, Radius=side_4, Angle=dom_6)  # -> Arc, Length
flatten_5 = FlattenTree(Data=bcx_4.Points, Path="{0}")
sph_5 = Sphere(Base=flatten_5, Radius=side_4)
bcx_5 = BrepCurve(Brep=sph_5, Curve=arc_6.Arc)  # -> Curves, Points
cull_2 = CullPattern(List=bcx_5.Points, CullPattern=[True, False])
flatten_6 = FlattenTree(Data=cull_2, Path="{0}")
pt_5 = Point(flatten_5)
mirror_11 = Mirror(Geometry=pt_5, Plane=pl_3pt_7)  # -> Geometry, Transform
rad_13 = Radians(Degrees="270")
rad_14 = Radians(Degrees="360")
pl_3pt_8 = Plane3Pt(PointA=flatten_6, PointB=mirror_11.Geometry, PointC=pt_5)
pl_3pt_9 = Plane3Pt(PointA=flatten_5, PointB=pt_2_3, PointC=pt_1_3)
dom_7 = Domain(DomainStart=rad_13, DomainEnd=rad_14)
mirror_12 = Mirror(Geometry=pt_3_3, Plane=pl_3pt_8)  # -> Geometry, Transform
arc_7 = Arc(Plane=pl_3pt_9, Radius=side_4, Angle=dom_7)  # -> Arc, Length
mirror_13 = Mirror(Plane=pl_3pt_8)  # -> Geometry, Transform
sph_6 = Sphere(Base=mirror_12.Geometry, Radius=side_4)
bcx_6 = BrepCurve(Brep=sph_6, Curve=arc_7.Arc)  # -> Curves, Points
cull_3 = CullPattern(List=bcx_6.Points, CullPattern=[True, False])
xy_2 = XYPlane(Origin=Point(0, 0, 0))
join_3 = BrepJoin(Breps=mirror_13.Geometry)  # -> Breps, Closed
flatten_7 = FlattenTree(Data=cull_3, Path="{0}")
sur_new_1_large_2 = Cluster(
    Point=mirror_12.Geometry,
    Point_2=flatten_5,
    Point_3=pt_3_3,
    Number=offset_3,
    Point_4=mirror_12.Geometry,
    Point_5=flatten_5,
    Point_6=pt_3_3,
    Number_2=offset_3,
    Point_7=sur_new_sm_top.ClusterInput,
    Point_8=sur_new_sm_top.ClusterInput,
    Point_9=sur_new_sm_top.ClusterInput,
    PointA=sur_new_sm_top.Data,
    PointB=sur_new_sm_top.Data,
    PointC=sur_new_sm_top.Data,
    Curve=sur_new_sm_top.Data,
    Distance=expr("-D", sur_new_sm_top.Number),
    Plane=sur_new_sm_top.Data,
    Stream0=sur_new_sm_top.Data,
    Stream1=sur_new_sm_top.Data,
    Stream2=sur_new_sm_top.Data,
    Vertices=sur_new_sm_top.Weave,
    Data=sur_new_sm_top.Curve,
    Data_2=sur_new_sm_top.Plane,
    Edges=sur_new_sm_top.Curve,
    Number_3=sur_new_sm_top.ClusterInput,
    Data_3=sur_new_sm_top.Point,
    Data_4=sur_new_sm_top.Point,
    Data_5=sur_new_sm_top.Point,
    InnerSurf=sur_new_sm_top.List,
    ClusterOutput=sur_new_sm_top.Breps,
    ClusterOutput_2=sur_new_sm_top.Surface,
    Surface=sur_new_sm_top.Surfaces,
    Curves=sur_new_sm_top.Curve,
    List=sur_new_sm_top.Fragments,
    List_2=sur_new_sm_top.Fragments,
    Brep=sur_new_sm_top.Curve,
    StartPoint=sur_new_sm_top.Data,
    EndPoint=sur_new_sm_top.Data,
    StartPoint_2=sur_new_sm_top.Data,
    EndPoint_2=sur_new_sm_top.Data,
    StartPoint_3=sur_new_sm_top.Data,
    EndPoint_3=sur_new_sm_top.Data,
    List_3=sur_new_sm_top.Edges,
    List_4=sur_new_sm_top.Edges,
    List_5=sur_new_sm_top.Edges,
    CurveA=sur_new_sm_top.Line,
    CurveB=sur_new_sm_top.Element,
    CurveA_2=sur_new_sm_top.Line,
    CurveB_2=sur_new_sm_top.Element,
    CurveA_3=sur_new_sm_top.Line,
    CurveB_3=sur_new_sm_top.Element,
    Breps=[sur_new_sm_top.Surface, sur_new_sm_top.Surface, sur_new_sm_top.Surface],
    ClusterInput=[sur_new_sm_top, sur_new_sm_top, sur_new_sm_top, sur_new_sm_top],
    InternalDocument_plugin_version=(0, 8, 66),
    InternalDocument_DocumentHeader_PreviewNormal=RGB(178, 220, 0),
    InternalDocument_DocumentHeader_PreviewSelected=RGBA(0, 150, 0, 100),
    InternalDocument_DefinitionProperties_Projection_Zoom=0.3276800215,
    InternalDocument_DefinitionObjects_Object5_Container_NullGaps=False)  # -> OuterSurface, InnerSurf, OuterSurface_2, InnerSurf_2
sur_new_1_bottom_2 = Cluster(
    Point=flatten_5,
    Point_2=pt_2_3,
    Point_3=pt_3_3,
    Number=offset_3,
    Point_4=flatten_5,
    Point_5=pt_2_3,
    Point_6=pt_3_3,
    Number_2=offset_3,
    Point_7=sur_new_sm_top.ClusterInput,
    Point_8=sur_new_sm_top.ClusterInput,
    Point_9=sur_new_sm_top.ClusterInput,
    PointA=sur_new_sm_top.Data,
    PointB=sur_new_sm_top.Data,
    PointC=sur_new_sm_top.Data,
    Curve=sur_new_sm_top.Data,
    Distance=expr("-D", sur_new_sm_top.Number),
    Plane=sur_new_sm_top.Data,
    Stream0=sur_new_sm_top.Data,
    Stream1=sur_new_sm_top.Data,
    Stream2=sur_new_sm_top.Data,
    Vertices=sur_new_sm_top.Weave,
    Data=sur_new_sm_top.Curve,
    Data_2=sur_new_sm_top.Plane,
    Edges=sur_new_sm_top.Curve,
    Number_3=sur_new_sm_top.ClusterInput,
    Data_3=sur_new_sm_top.Point,
    Data_4=sur_new_sm_top.Point,
    Data_5=sur_new_sm_top.Point,
    InnerSurf=sur_new_sm_top.List,
    ClusterOutput=sur_new_sm_top.Breps,
    ClusterOutput_2=sur_new_sm_top.Surface,
    Surface=sur_new_sm_top.Surfaces,
    Curves=sur_new_sm_top.Curve,
    List=sur_new_sm_top.Fragments,
    List_2=sur_new_sm_top.Fragments,
    Brep=sur_new_sm_top.Curve,
    StartPoint=sur_new_sm_top.Data,
    EndPoint=sur_new_sm_top.Data,
    StartPoint_2=sur_new_sm_top.Data,
    EndPoint_2=sur_new_sm_top.Data,
    StartPoint_3=sur_new_sm_top.Data,
    EndPoint_3=sur_new_sm_top.Data,
    List_3=sur_new_sm_top.Edges,
    List_4=sur_new_sm_top.Edges,
    List_5=sur_new_sm_top.Edges,
    CurveA=sur_new_sm_top.Line,
    CurveB=sur_new_sm_top.Element,
    CurveA_2=sur_new_sm_top.Line,
    CurveB_2=sur_new_sm_top.Element,
    CurveA_3=sur_new_sm_top.Line,
    CurveB_3=sur_new_sm_top.Element,
    Breps=[sur_new_sm_top.Surface, sur_new_sm_top.Surface, sur_new_sm_top.Surface],
    ClusterInput=[sur_new_sm_top, sur_new_sm_top, sur_new_sm_top, sur_new_sm_top],
    InternalDocument_plugin_version=(0, 8, 66),
    InternalDocument_DocumentHeader_PreviewNormal=RGB(178, 220, 0),
    InternalDocument_DocumentHeader_PreviewSelected=RGBA(0, 150, 0, 100),
    InternalDocument_DefinitionProperties_Projection_Zoom=0.3276800215,
    InternalDocument_DefinitionObjects_Object5_Container_NullGaps=False)  # -> OuterSurface, InnerSurf, OuterSurface_2, InnerSurf_2
sur_new_sm_top_2 = Cluster(
    Point=mirror_12.Geometry,
    Point_2=flatten_5,
    Point_3=flatten_7,
    Number=offset_3,
    Point_4=mirror_12.Geometry,
    Point_5=flatten_5,
    Point_6=flatten_7,
    Number_2=offset_3,
    Point_7=sur_new_sm_top.ClusterInput,
    Point_8=sur_new_sm_top.ClusterInput,
    Point_9=sur_new_sm_top.ClusterInput,
    PointA=sur_new_sm_top.Data,
    PointB=sur_new_sm_top.Data,
    PointC=sur_new_sm_top.Data,
    Curve=sur_new_sm_top.Data,
    Distance=expr("-D", sur_new_sm_top.Number),
    Plane=sur_new_sm_top.Data,
    Stream0=sur_new_sm_top.Data,
    Stream1=sur_new_sm_top.Data,
    Stream2=sur_new_sm_top.Data,
    Vertices=sur_new_sm_top.Weave,
    Data=sur_new_sm_top.Curve,
    Data_2=sur_new_sm_top.Plane,
    Edges=sur_new_sm_top.Curve,
    Number_3=sur_new_sm_top.ClusterInput,
    Data_3=sur_new_sm_top.Point,
    Data_4=sur_new_sm_top.Point,
    Data_5=sur_new_sm_top.Point,
    InnerSurf=sur_new_sm_top.List,
    ClusterOutput=sur_new_sm_top.Breps,
    ClusterOutput_2=sur_new_sm_top.Surface,
    Surface=sur_new_sm_top.Surfaces,
    Curves=sur_new_sm_top.Curve,
    List=sur_new_sm_top.Fragments,
    List_2=sur_new_sm_top.Fragments,
    Brep=sur_new_sm_top.Curve,
    StartPoint=sur_new_sm_top.Data,
    EndPoint=sur_new_sm_top.Data,
    StartPoint_2=sur_new_sm_top.Data,
    EndPoint_2=sur_new_sm_top.Data,
    StartPoint_3=sur_new_sm_top.Data,
    EndPoint_3=sur_new_sm_top.Data,
    List_3=sur_new_sm_top.Edges,
    List_4=sur_new_sm_top.Edges,
    List_5=sur_new_sm_top.Edges,
    CurveA=sur_new_sm_top.Line,
    CurveB=sur_new_sm_top.Element,
    CurveA_2=sur_new_sm_top.Line,
    CurveB_2=sur_new_sm_top.Element,
    CurveA_3=sur_new_sm_top.Line,
    CurveB_3=sur_new_sm_top.Element,
    Breps=[sur_new_sm_top.Surface, sur_new_sm_top.Surface, sur_new_sm_top.Surface],
    ClusterInput=[sur_new_sm_top, sur_new_sm_top, sur_new_sm_top, sur_new_sm_top],
    InternalDocument_plugin_version=(0, 8, 66),
    InternalDocument_DocumentHeader_PreviewNormal=RGB(178, 220, 0),
    InternalDocument_DocumentHeader_PreviewSelected=RGBA(0, 150, 0, 100),
    InternalDocument_DefinitionProperties_Projection_Zoom=0.3276800215,
    InternalDocument_DefinitionObjects_Object5_Container_NullGaps=False)  # -> OuterSurface, InnerSurf, OuterSurface_2, InnerSurf_2
Z_2 = UnitZ(Factor=move_distance_2)
join_4 = BrepJoin(Breps=[sur_new_sm_top_2.InnerSurf_2, sur_new_1_bottom_2.InnerSurf_2])  # -> Breps, Closed
flip_2 = FlipMatrix(Data=pl_3pt_7)
join_5 = BrepJoin(Breps=[sur_new_sm_top_2.OuterSurface_2, sur_new_1_bottom_2.OuterSurface_2])  # -> Breps, Closed
mirror_14 = Mirror(Geometry=join_5.Breps, Plane=flip_2)  # -> Geometry, Transform
mirror_15 = Mirror(Geometry=[join_5.Breps, mirror_14.Geometry], Plane=xy_2)  # -> Geometry, Transform
rotax_6 = RotateAxis(Geometry=mirror_15.Geometry, Angle=rotate_angle_2, Axis=line_4)  # -> Geometry, Transform
mirror_16 = Mirror(Geometry=join_4.Breps, Plane=flip_2)  # -> Geometry, Transform
mirror_17 = Mirror(Geometry=[join_4.Breps, mirror_16.Geometry], Plane=xy_2)  # -> Geometry, Transform
rotax_7 = RotateAxis(Geometry=mirror_17.Geometry, Angle=rotate_angle_2, Axis=line_4)  # -> Geometry, Transform
mirror_18 = Mirror(Geometry=sur_new_1_large_2.OuterSurface_2, Plane=flip_2)  # -> Geometry, Transform
mirror_19 = Mirror(Geometry=[mirror_18.Geometry, sur_new_1_large_2.OuterSurface_2], Plane=xy_2)  # -> Geometry, Transform
rotax_8 = RotateAxis(Geometry=mirror_19.Geometry, Angle=rotate_angle_2, Axis=line_4)  # -> Geometry, Transform
mirror_20 = Mirror(Geometry=sur_new_1_large_2.InnerSurf_2, Plane=flip_2)  # -> Geometry, Transform
mirror_21 = Mirror(Geometry=[mirror_20.Geometry, sur_new_1_large_2.InnerSurf_2], Plane=xy_2)  # -> Geometry, Transform
rotax_9 = RotateAxis(Geometry=mirror_21.Geometry, Angle=rotate_angle_2, Axis=line_4)  # -> Geometry, Transform
join_outer_2 = BrepJoin(Breps=[join_5.Breps, mirror_14.Geometry])  # -> Breps, Closed
join_inner_2 = BrepJoin(Breps=[join_4.Breps, mirror_16.Geometry])  # -> Breps, Closed
join_l_outer_2 = BrepJoin(Breps=[mirror_18.Geometry, sur_new_1_large_2.OuterSurface_2])  # -> Breps, Closed
join_l_inner_2 = BrepJoin(Breps=[mirror_20.Geometry, sur_new_1_large_2.InnerSurf_2])  # -> Breps, Closed
move_outer_2 = Move(Geometry=rotax_6.Geometry, Motion=Z_2)  # -> Geometry, Transform
move_inner_2 = Move(Geometry=rotax_7.Geometry, Motion=Z_2)  # -> Geometry, Transform
move_outer_l_2 = Move(Geometry=rotax_8.Geometry, Motion=Z_2)  # -> Geometry, Transform
move_inner_l_2 = Move(Geometry=rotax_9.Geometry, Motion=Z_2)  # -> Geometry, Transform
preview_4 = CustomPreview(Geometry=[move_inner_l_2.Geometry, join_l_inner_2.Breps], Shader=col_large_inner_2)
preview_5 = CustomPreview(Geometry=[join_outer_2.Breps, join_l_outer_2.Breps, move_outer_2.Geometry, move_outer_l_2.Geometry], Shader=col_border_2)
preview_6 = CustomPreview(Geometry=[join_inner_2.Breps, move_inner_2.Geometry], Shader=col_small_inner_2)
col_small_inner_3 = Colour(col_small_inner_2)
col_large_inner_3 = Colour(col_large_inner_2)
move_distance_3 = Number(move_distance_2)
rotate_angle_3 = Number(rotate_angle_2)
col_border_3 = Colour(col_border_2)
pt_1_4 = Point(flatten_6)
pt_2_4 = Point(mirror_12.Geometry)
pt_3_4 = Point(flatten_7)
center_3 = Point(center_2)
side_5 = Number(side_4)
offset_4 = Number(offset_3)

bake_outer_frame_2 = CSharpScript(
    obj=[join_outer_2.Breps, move_outer_l_2.Geometry, move_outer_2.Geometry, join_l_outer_2.Breps],
    layer="outer frame",
    color=col_border_2,
    activate=toggle_bake)  # -> out; inputs obj: GeometryBase, name: String, layer: String, color: Color, pWidth: Double, wires: Int32, activate: Boolean; same code as bake_large_inner
bake_large_inner_2 = CSharpScript(obj=[join_l_inner_2.Breps, move_inner_l_2.Geometry], layer="large inner", color=col_large_inner_2, activate=toggle_bake)  # -> out; inputs obj: GeometryBase, name: String, layer: String, color: Color, pWidth: Double, wires: Int32, activate: Boolean; same code as bake_large_inner
bake_small_inner = CSharpScript(obj=[move_inner_2.Geometry, join_inner_2.Breps], layer="small inner", color=col_small_inner_2, activate=toggle_bake)  # -> out; inputs obj: GeometryBase, name: String, layer: String, color: Color, pWidth: Double, wires: Int32, activate: Boolean; same code as bake_large_inner

pt_2_5 = Point(pt_2_4)
pt_3_5 = Point(pt_3_4)
center_4 = Point(center_3)
side_6 = Number(side_5)
rotate_angle_4 = Number(rotate_angle_3)
move_distance_4 = Number(move_distance_3)
pt_1_5 = Point(pt_1_4)
col_large_inner_4 = Colour(col_large_inner_3)
col_small_inner_4 = Colour(col_small_inner_3)
col_border_4 = Colour(col_border_3)
offset_5 = Number(offset_4)
pl_3pt_10 = Plane3Pt(PointA=pt_2_5, PointB=pt_1_5, PointC=center_4)
rad_15 = Radians(Degrees="0")
rad_16 = Radians(Degrees="180")
rad_17 = Radians(Degrees="0")
rad_18 = Radians(Degrees="150")
f_x_2 = F1(Function="((x^2)+(x^2))^.5", X=side_6)
line_6 = LineSDL(Start=center_4, Direction=Vector(0, 0, 1), Length=1)
dom_8 = Domain(DomainStart=rad_15, DomainEnd=rad_16)
arc_8 = Arc(Plane=pl_3pt_10, Radius=side_6, Angle=dom_8)  # -> Arc, Length
dom_9 = Domain(DomainStart=rad_17, DomainEnd=rad_18)
line_7 = LineSDL(Start=pt_3_5, Direction=Vector(0, 0, 1), Length=1)
sph_7 = Sphere(Base=pt_3_5, Radius=f_x_2)
end_4 = EndPoints(Curve=line_7)  # -> Start, End
bcx_7 = BrepCurve(Brep=sph_7, Curve=arc_8.Arc)  # -> Curves, Points
pl_3pt_11 = Plane3Pt(PointA=end_4.Start, PointB=end_4.End, PointC=center_4)
arc_9 = Arc(Plane=pl_3pt_11, Radius=side_6, Angle=dom_9)  # -> Arc, Length
flatten_8 = FlattenTree(Data=bcx_7.Points, Path="{0}")
sph_8 = Sphere(Base=flatten_8, Radius=side_6)
bcx_8 = BrepCurve(Brep=sph_8, Curve=arc_9.Arc)  # -> Curves, Points
cull_4 = CullPattern(List=bcx_8.Points, CullPattern=[True, False])
flatten_9 = FlattenTree(Data=cull_4, Path="{0}")
pt_6 = Point(flatten_8)
mirror_22 = Mirror(Geometry=pt_6, Plane=pl_3pt_11)  # -> Geometry, Transform
rad_19 = Radians(Degrees="270")
rad_20 = Radians(Degrees="360")
pl_3pt_12 = Plane3Pt(PointA=flatten_9, PointB=mirror_22.Geometry, PointC=pt_6)
pl_3pt_13 = Plane3Pt(PointA=flatten_8, PointB=pt_2_5, PointC=pt_1_5)
dom_10 = Domain(DomainStart=rad_19, DomainEnd=rad_20)
mirror_23 = Mirror(Geometry=pt_3_5, Plane=pl_3pt_12)  # -> Geometry, Transform
arc_10 = Arc(Plane=pl_3pt_13, Radius=side_6, Angle=dom_10)  # -> Arc, Length
mirror_24 = Mirror(Plane=pl_3pt_12)  # -> Geometry, Transform
sph_9 = Sphere(Base=mirror_23.Geometry, Radius=side_6)
bcx_9 = BrepCurve(Brep=sph_9, Curve=arc_10.Arc)  # -> Curves, Points
cull_5 = CullPattern(List=bcx_9.Points, CullPattern=[True, False])
xy_3 = XYPlane(Origin=Point(0, 0, 0))
join_6 = BrepJoin(Breps=mirror_24.Geometry)  # -> Breps, Closed
flatten_10 = FlattenTree(Data=cull_5, Path="{0}")
sur_new_1_large_3 = Cluster(
    Point=mirror_23.Geometry,
    Point_2=flatten_8,
    Point_3=pt_3_5,
    Number=offset_5,
    Point_4=mirror_23.Geometry,
    Point_5=flatten_8,
    Point_6=pt_3_5,
    Number_2=offset_5,
    Point_7=sur_new_sm_top.ClusterInput,
    Point_8=sur_new_sm_top.ClusterInput,
    Point_9=sur_new_sm_top.ClusterInput,
    PointA=sur_new_sm_top.Data,
    PointB=sur_new_sm_top.Data,
    PointC=sur_new_sm_top.Data,
    Curve=sur_new_sm_top.Data,
    Distance=expr("-D", sur_new_sm_top.Number),
    Plane=sur_new_sm_top.Data,
    Stream0=sur_new_sm_top.Data,
    Stream1=sur_new_sm_top.Data,
    Stream2=sur_new_sm_top.Data,
    Vertices=sur_new_sm_top.Weave,
    Data=sur_new_sm_top.Curve,
    Data_2=sur_new_sm_top.Plane,
    Edges=sur_new_sm_top.Curve,
    Number_3=sur_new_sm_top.ClusterInput,
    Data_3=sur_new_sm_top.Point,
    Data_4=sur_new_sm_top.Point,
    Data_5=sur_new_sm_top.Point,
    InnerSurf=sur_new_sm_top.List,
    ClusterOutput=sur_new_sm_top.Breps,
    ClusterOutput_2=sur_new_sm_top.Surface,
    Surface=sur_new_sm_top.Surfaces,
    Curves=sur_new_sm_top.Curve,
    List=sur_new_sm_top.Fragments,
    List_2=sur_new_sm_top.Fragments,
    Brep=sur_new_sm_top.Curve,
    StartPoint=sur_new_sm_top.Data,
    EndPoint=sur_new_sm_top.Data,
    StartPoint_2=sur_new_sm_top.Data,
    EndPoint_2=sur_new_sm_top.Data,
    StartPoint_3=sur_new_sm_top.Data,
    EndPoint_3=sur_new_sm_top.Data,
    List_3=sur_new_sm_top.Edges,
    List_4=sur_new_sm_top.Edges,
    List_5=sur_new_sm_top.Edges,
    CurveA=sur_new_sm_top.Line,
    CurveB=sur_new_sm_top.Element,
    CurveA_2=sur_new_sm_top.Line,
    CurveB_2=sur_new_sm_top.Element,
    CurveA_3=sur_new_sm_top.Line,
    CurveB_3=sur_new_sm_top.Element,
    Breps=[sur_new_sm_top.Surface, sur_new_sm_top.Surface, sur_new_sm_top.Surface],
    ClusterInput=[sur_new_sm_top, sur_new_sm_top, sur_new_sm_top, sur_new_sm_top],
    InternalDocument_plugin_version=(0, 8, 66),
    InternalDocument_DocumentHeader_PreviewNormal=RGB(178, 220, 0),
    InternalDocument_DocumentHeader_PreviewSelected=RGBA(0, 150, 0, 100),
    InternalDocument_DefinitionProperties_Projection_Zoom=0.3276800215,
    InternalDocument_DefinitionObjects_Object5_Container_NullGaps=False)  # -> OuterSurface, InnerSurf, OuterSurface_2, InnerSurf_2
sur_new_1_bottom_3 = Cluster(
    Point=flatten_8,
    Point_2=pt_2_5,
    Point_3=pt_3_5,
    Number=offset_5,
    Point_4=flatten_8,
    Point_5=pt_2_5,
    Point_6=pt_3_5,
    Number_2=offset_5,
    Point_7=sur_new_sm_top.ClusterInput,
    Point_8=sur_new_sm_top.ClusterInput,
    Point_9=sur_new_sm_top.ClusterInput,
    PointA=sur_new_sm_top.Data,
    PointB=sur_new_sm_top.Data,
    PointC=sur_new_sm_top.Data,
    Curve=sur_new_sm_top.Data,
    Distance=expr("-D", sur_new_sm_top.Number),
    Plane=sur_new_sm_top.Data,
    Stream0=sur_new_sm_top.Data,
    Stream1=sur_new_sm_top.Data,
    Stream2=sur_new_sm_top.Data,
    Vertices=sur_new_sm_top.Weave,
    Data=sur_new_sm_top.Curve,
    Data_2=sur_new_sm_top.Plane,
    Edges=sur_new_sm_top.Curve,
    Number_3=sur_new_sm_top.ClusterInput,
    Data_3=sur_new_sm_top.Point,
    Data_4=sur_new_sm_top.Point,
    Data_5=sur_new_sm_top.Point,
    InnerSurf=sur_new_sm_top.List,
    ClusterOutput=sur_new_sm_top.Breps,
    ClusterOutput_2=sur_new_sm_top.Surface,
    Surface=sur_new_sm_top.Surfaces,
    Curves=sur_new_sm_top.Curve,
    List=sur_new_sm_top.Fragments,
    List_2=sur_new_sm_top.Fragments,
    Brep=sur_new_sm_top.Curve,
    StartPoint=sur_new_sm_top.Data,
    EndPoint=sur_new_sm_top.Data,
    StartPoint_2=sur_new_sm_top.Data,
    EndPoint_2=sur_new_sm_top.Data,
    StartPoint_3=sur_new_sm_top.Data,
    EndPoint_3=sur_new_sm_top.Data,
    List_3=sur_new_sm_top.Edges,
    List_4=sur_new_sm_top.Edges,
    List_5=sur_new_sm_top.Edges,
    CurveA=sur_new_sm_top.Line,
    CurveB=sur_new_sm_top.Element,
    CurveA_2=sur_new_sm_top.Line,
    CurveB_2=sur_new_sm_top.Element,
    CurveA_3=sur_new_sm_top.Line,
    CurveB_3=sur_new_sm_top.Element,
    Breps=[sur_new_sm_top.Surface, sur_new_sm_top.Surface, sur_new_sm_top.Surface],
    ClusterInput=[sur_new_sm_top, sur_new_sm_top, sur_new_sm_top, sur_new_sm_top],
    InternalDocument_plugin_version=(0, 8, 66),
    InternalDocument_DocumentHeader_PreviewNormal=RGB(178, 220, 0),
    InternalDocument_DocumentHeader_PreviewSelected=RGBA(0, 150, 0, 100),
    InternalDocument_DefinitionProperties_Projection_Zoom=0.3276800215,
    InternalDocument_DefinitionObjects_Object5_Container_NullGaps=False)  # -> OuterSurface, InnerSurf, OuterSurface_2, InnerSurf_2
sur_new_sm_top_3 = Cluster(
    Point=mirror_23.Geometry,
    Point_2=flatten_8,
    Point_3=flatten_10,
    Number=offset_5,
    Point_4=mirror_23.Geometry,
    Point_5=flatten_8,
    Point_6=flatten_10,
    Number_2=offset_5,
    Point_7=sur_new_sm_top.ClusterInput,
    Point_8=sur_new_sm_top.ClusterInput,
    Point_9=sur_new_sm_top.ClusterInput,
    PointA=sur_new_sm_top.Data,
    PointB=sur_new_sm_top.Data,
    PointC=sur_new_sm_top.Data,
    Curve=sur_new_sm_top.Data,
    Distance=expr("-D", sur_new_sm_top.Number),
    Plane=sur_new_sm_top.Data,
    Stream0=sur_new_sm_top.Data,
    Stream1=sur_new_sm_top.Data,
    Stream2=sur_new_sm_top.Data,
    Vertices=sur_new_sm_top.Weave,
    Data=sur_new_sm_top.Curve,
    Data_2=sur_new_sm_top.Plane,
    Edges=sur_new_sm_top.Curve,
    Number_3=sur_new_sm_top.ClusterInput,
    Data_3=sur_new_sm_top.Point,
    Data_4=sur_new_sm_top.Point,
    Data_5=sur_new_sm_top.Point,
    InnerSurf=sur_new_sm_top.List,
    ClusterOutput=sur_new_sm_top.Breps,
    ClusterOutput_2=sur_new_sm_top.Surface,
    Surface=sur_new_sm_top.Surfaces,
    Curves=sur_new_sm_top.Curve,
    List=sur_new_sm_top.Fragments,
    List_2=sur_new_sm_top.Fragments,
    Brep=sur_new_sm_top.Curve,
    StartPoint=sur_new_sm_top.Data,
    EndPoint=sur_new_sm_top.Data,
    StartPoint_2=sur_new_sm_top.Data,
    EndPoint_2=sur_new_sm_top.Data,
    StartPoint_3=sur_new_sm_top.Data,
    EndPoint_3=sur_new_sm_top.Data,
    List_3=sur_new_sm_top.Edges,
    List_4=sur_new_sm_top.Edges,
    List_5=sur_new_sm_top.Edges,
    CurveA=sur_new_sm_top.Line,
    CurveB=sur_new_sm_top.Element,
    CurveA_2=sur_new_sm_top.Line,
    CurveB_2=sur_new_sm_top.Element,
    CurveA_3=sur_new_sm_top.Line,
    CurveB_3=sur_new_sm_top.Element,
    Breps=[sur_new_sm_top.Surface, sur_new_sm_top.Surface, sur_new_sm_top.Surface],
    ClusterInput=[sur_new_sm_top, sur_new_sm_top, sur_new_sm_top, sur_new_sm_top],
    InternalDocument_plugin_version=(0, 8, 66),
    InternalDocument_DocumentHeader_PreviewNormal=RGB(178, 220, 0),
    InternalDocument_DocumentHeader_PreviewSelected=RGBA(0, 150, 0, 100),
    InternalDocument_DefinitionProperties_Projection_Zoom=0.3276800215,
    InternalDocument_DefinitionObjects_Object5_Container_NullGaps=False)  # -> OuterSurface, InnerSurf, OuterSurface_2, InnerSurf_2
Z_3 = UnitZ(Factor=move_distance_4)
join_7 = BrepJoin(Breps=[sur_new_sm_top_3.InnerSurf_2, sur_new_1_bottom_3.InnerSurf_2])  # -> Breps, Closed
flip_3 = FlipMatrix(Data=pl_3pt_11)
join_8 = BrepJoin(Breps=[sur_new_sm_top_3.OuterSurface_2, sur_new_1_bottom_3.OuterSurface_2])  # -> Breps, Closed
mirror_25 = Mirror(Geometry=join_8.Breps, Plane=flip_3)  # -> Geometry, Transform
mirror_26 = Mirror(Geometry=[join_8.Breps, mirror_25.Geometry], Plane=xy_3)  # -> Geometry, Transform
rotax_10 = RotateAxis(Geometry=mirror_26.Geometry, Angle=rotate_angle_4, Axis=line_6)  # -> Geometry, Transform
mirror_27 = Mirror(Geometry=join_7.Breps, Plane=flip_3)  # -> Geometry, Transform
mirror_28 = Mirror(Geometry=[join_7.Breps, mirror_27.Geometry], Plane=xy_3)  # -> Geometry, Transform
rotax_11 = RotateAxis(Geometry=mirror_28.Geometry, Angle=rotate_angle_4, Axis=line_6)  # -> Geometry, Transform
mirror_29 = Mirror(Geometry=sur_new_1_large_3.OuterSurface_2, Plane=flip_3)  # -> Geometry, Transform
mirror_30 = Mirror(Geometry=[mirror_29.Geometry, sur_new_1_large_3.OuterSurface_2], Plane=xy_3)  # -> Geometry, Transform
rotax_12 = RotateAxis(Geometry=mirror_30.Geometry, Angle=rotate_angle_4, Axis=line_6)  # -> Geometry, Transform
mirror_31 = Mirror(Geometry=sur_new_1_large_3.InnerSurf_2, Plane=flip_3)  # -> Geometry, Transform
mirror_32 = Mirror(Geometry=[mirror_31.Geometry, sur_new_1_large_3.InnerSurf_2], Plane=xy_3)  # -> Geometry, Transform
rotax_13 = RotateAxis(Geometry=mirror_32.Geometry, Angle=rotate_angle_4, Axis=line_6)  # -> Geometry, Transform
join_outer_3 = BrepJoin(Breps=[join_8.Breps, mirror_25.Geometry])  # -> Breps, Closed
join_inner_3 = BrepJoin(Breps=[join_7.Breps, mirror_27.Geometry])  # -> Breps, Closed
join_l_outer_3 = BrepJoin(Breps=[mirror_29.Geometry, sur_new_1_large_3.OuterSurface_2])  # -> Breps, Closed
join_l_inner_3 = BrepJoin(Breps=[mirror_31.Geometry, sur_new_1_large_3.InnerSurf_2])  # -> Breps, Closed
move_outer_3 = Move(Geometry=rotax_10.Geometry, Motion=Z_3)  # -> Geometry, Transform
move_inner_3 = Move(Geometry=rotax_11.Geometry, Motion=Z_3)  # -> Geometry, Transform
move_outer_l_3 = Move(Geometry=rotax_12.Geometry, Motion=Z_3)  # -> Geometry, Transform
move_inner_l_3 = Move(Geometry=rotax_13.Geometry, Motion=Z_3)  # -> Geometry, Transform
preview_7 = CustomPreview(Geometry=[move_inner_l_3.Geometry, join_l_inner_3.Breps], Shader=col_large_inner_4)
preview_8 = CustomPreview(Geometry=[join_outer_3.Breps, join_l_outer_3.Breps, move_outer_3.Geometry, move_outer_l_3.Geometry], Shader=col_border_4)
preview_9 = CustomPreview(Geometry=[join_inner_3.Breps, move_inner_3.Geometry], Shader=col_small_inner_4)
col_small_inner_5 = Colour(col_small_inner_4)
col_large_inner_5 = Colour(col_large_inner_4)
move_distance_5 = Number(move_distance_4)
rotate_angle_5 = Number(rotate_angle_4)
col_border_5 = Colour(col_border_4)
offset_6 = Number(offset_5)
pt_1_6 = Point(flatten_9)
center_5 = Point(center_4)
side_7 = Number(side_6)
pt_2_6 = Point(mirror_23.Geometry)
pt_3_6 = Point(flatten_10)

bake_outer_frame_3 = CSharpScript(
    obj=[join_outer_3.Breps, move_outer_l_3.Geometry, move_outer_3.Geometry, join_l_outer_3.Breps],
    layer="outer frame",
    color=col_border_4,
    activate=toggle_bake)  # -> out; inputs obj: GeometryBase, name: String, layer: String, color: Color, pWidth: Double, wires: Int32, activate: Boolean; same code as bake_large_inner
bake_large_inner_3 = CSharpScript(obj=[join_l_inner_3.Breps, move_inner_l_3.Geometry], layer="large inner", color=col_large_inner_4, activate=toggle_bake)  # -> out; inputs obj: GeometryBase, name: String, layer: String, color: Color, pWidth: Double, wires: Int32, activate: Boolean; same code as bake_large_inner
bake_small_inner_2 = CSharpScript(obj=[move_inner_3.Geometry, join_inner_3.Breps], layer="small inner", color=col_small_inner_4, activate=toggle_bake)  # -> out; inputs obj: GeometryBase, name: String, layer: String, color: Color, pWidth: Double, wires: Int32, activate: Boolean; same code as bake_large_inner
pt_4_2 = Point(flatten_8)

col_small_inner_6 = Colour(col_small_inner_5)
col_large_inner_6 = Colour(col_large_inner_5)
pt_3_7 = Point(pt_3_6)
rotate_angle_6 = Number(rotate_angle_5)
move_distance_6 = Number(move_distance_5)
pt_1_7 = Point(pt_1_6)
pt_2_7 = Point(pt_2_6)
center_6 = Point(center_5)
side_8 = Number(side_7)
pt4 = Point(pt_4_2)
col_border_6 = Colour(col_border_5)
offset_7 = Number(offset_6)
pl_3pt_14 = Plane3Pt(PointA=pt_2_7, PointB=pt_1_7, PointC=center_6)
rad_21 = Radians(Degrees="0")
rad_22 = Radians(Degrees="180")
rad_23 = Radians(Degrees="0")
rad_24 = Radians(Degrees="150")
f_x_3 = F1(Function="((x^2)+(x^2))^.5", X=side_8)
line_8 = LineSDL(Start=center_6, Direction=Vector(0, 0, 1), Length=1)
dom_11 = Domain(DomainStart=rad_21, DomainEnd=rad_22)
dom_12 = Domain(DomainStart=rad_23, DomainEnd=rad_24)
arc_11 = Arc(Plane=pl_3pt_14, Radius=side_8, Angle=dom_11)  # -> Arc, Length
sph_10 = Sphere(Base=pt_3_7, Radius=f_x_3)
line_9 = LineSDL(Start=pt_3_7, Direction=Vector(0, 0, 1), Length=1)
end_5 = EndPoints(Curve=line_9)  # -> Start, End
bcx_10 = BrepCurve(Brep=sph_10, Curve=arc_11.Arc)  # -> Curves, Points
flatten_11 = FlattenTree(Data=bcx_10.Points, Path="{0}")
sph_11 = Sphere(Base=flatten_11, Radius=side_8)
pl_3pt_15 = Plane3Pt(PointA=end_5.Start, PointB=end_5.End, PointC=center_6)
arc_12 = Arc(Plane=pl_3pt_15, Radius=side_8, Angle=dom_12)  # -> Arc, Length
bcx_11 = BrepCurve(Brep=sph_11, Curve=arc_12.Arc)  # -> Curves, Points
cull_6 = CullPattern(List=bcx_11.Points, CullPattern=[True, False])
flatten_12 = FlattenTree(Data=cull_6, Path="{0}")
pt_7 = Point(flatten_11)
mirror_33 = Mirror(Geometry=pt_7, Plane=pl_3pt_15)  # -> Geometry, Transform
rad_25 = Radians(Degrees="250")
rad_26 = Radians(Degrees="320")
pl_3pt_16 = Plane3Pt(PointA=flatten_12, PointB=mirror_33.Geometry, PointC=pt_7)
pl_3pt_17 = Plane3Pt(PointA=flatten_11, PointB=pt_2_7, PointC=pt_1_7)
dom_13 = Domain(DomainStart=rad_25, DomainEnd=rad_26)
rad_27 = Radians(Degrees="0")
rad_28 = Radians(Degrees="90")
pl_3pt_18 = Plane3Pt(PointA=flatten_12, PointB=pt_3_7, PointC=pt4)
mirror_34 = Mirror(Geometry=pt_3_7, Plane=pl_3pt_16)  # -> Geometry, Transform
arc_13 = Arc(Plane=pl_3pt_17, Radius=side_8, Angle=dom_13)  # -> Arc, Length
dom_14 = Domain(DomainStart=rad_27, DomainEnd=rad_28)
sph_12 = Sphere(Base=mirror_34.Geometry, Radius=side_8)
bcx_12 = BrepCurve(Brep=sph_12, Curve=arc_13.Arc)  # -> Curves, Points
arc_14 = Arc(Plane=pl_3pt_18, Radius=side_8, Angle=dom_14)  # -> Arc, Length
cull_7 = CullPattern(List=bcx_12.Points, CullPattern=[True, False])
flatten_13 = FlattenTree(Data=cull_7, Path="{0}")
sph_13 = Sphere(Base=flatten_13, Radius=side_8)
bcx_13 = BrepCurve(Brep=sph_13, Curve=arc_14.Arc)  # -> Curves, Points
flatten_14 = FlattenTree(Data=bcx_13.Points, Path="{0}")
sur_new_sm_bottom = Cluster(
    Point=pt_3_7,
    Point_2=flatten_11,
    Point_3=pt_2_7,
    Number=offset_7,
    Point_4=pt_3_7,
    Point_5=flatten_11,
    Point_6=pt_2_7,
    Number_2=offset_7,
    Point_7=sur_new_sm_top.ClusterInput,
    Point_8=sur_new_sm_top.ClusterInput,
    Point_9=sur_new_sm_top.ClusterInput,
    PointA=sur_new_sm_top.Data,
    PointB=sur_new_sm_top.Data,
    PointC=sur_new_sm_top.Data,
    Curve=sur_new_sm_top.Data,
    Distance=expr("-D", sur_new_sm_top.Number),
    Plane=sur_new_sm_top.Data,
    Stream0=sur_new_sm_top.Data,
    Stream1=sur_new_sm_top.Data,
    Stream2=sur_new_sm_top.Data,
    Vertices=sur_new_sm_top.Weave,
    Data=sur_new_sm_top.Curve,
    Data_2=sur_new_sm_top.Plane,
    Edges=sur_new_sm_top.Curve,
    Number_3=sur_new_sm_top.ClusterInput,
    Data_3=sur_new_sm_top.Point,
    Data_4=sur_new_sm_top.Point,
    Data_5=sur_new_sm_top.Point,
    InnerSurf=sur_new_sm_top.List,
    ClusterOutput=sur_new_sm_top.Breps,
    ClusterOutput_2=sur_new_sm_top.Surface,
    Surface=sur_new_sm_top.Surfaces,
    Curves=sur_new_sm_top.Curve,
    List=sur_new_sm_top.Fragments,
    List_2=sur_new_sm_top.Fragments,
    Brep=sur_new_sm_top.Curve,
    StartPoint=sur_new_sm_top.Data,
    EndPoint=sur_new_sm_top.Data,
    StartPoint_2=sur_new_sm_top.Data,
    EndPoint_2=sur_new_sm_top.Data,
    StartPoint_3=sur_new_sm_top.Data,
    EndPoint_3=sur_new_sm_top.Data,
    List_3=sur_new_sm_top.Edges,
    List_4=sur_new_sm_top.Edges,
    List_5=sur_new_sm_top.Edges,
    CurveA=sur_new_sm_top.Line,
    CurveB=sur_new_sm_top.Element,
    CurveA_2=sur_new_sm_top.Line,
    CurveB_2=sur_new_sm_top.Element,
    CurveA_3=sur_new_sm_top.Line,
    CurveB_3=sur_new_sm_top.Element,
    Breps=[sur_new_sm_top.Surface, sur_new_sm_top.Surface, sur_new_sm_top.Surface],
    ClusterInput=[sur_new_sm_top, sur_new_sm_top, sur_new_sm_top, sur_new_sm_top],
    InternalDocument_plugin_version=(0, 8, 66),
    InternalDocument_DocumentHeader_PreviewNormal=RGB(178, 220, 0),
    InternalDocument_DocumentHeader_PreviewSelected=RGBA(0, 150, 0, 100),
    InternalDocument_DefinitionProperties_Projection_Zoom=0.3276800215,
    InternalDocument_DefinitionObjects_Object5_Container_NullGaps=False)  # -> OuterSurface, InnerSurf, OuterSurface_2, InnerSurf_2
sur_new_sm_top_4 = Cluster(
    Point=flatten_13,
    Point_2=flatten_14,
    Point_3=flatten_12,
    Number=offset_7,
    Point_4=flatten_13,
    Point_5=flatten_14,
    Point_6=flatten_12,
    Number_2=offset_7,
    Point_7=sur_new_sm_top.ClusterInput,
    Point_8=sur_new_sm_top.ClusterInput,
    Point_9=sur_new_sm_top.ClusterInput,
    PointA=sur_new_sm_top.Data,
    PointB=sur_new_sm_top.Data,
    PointC=sur_new_sm_top.Data,
    Curve=sur_new_sm_top.Data,
    Distance=expr("-D", sur_new_sm_top.Number),
    Plane=sur_new_sm_top.Data,
    Stream0=sur_new_sm_top.Data,
    Stream1=sur_new_sm_top.Data,
    Stream2=sur_new_sm_top.Data,
    Vertices=sur_new_sm_top.Weave,
    Data=sur_new_sm_top.Curve,
    Data_2=sur_new_sm_top.Plane,
    Edges=sur_new_sm_top.Curve,
    Number_3=sur_new_sm_top.ClusterInput,
    Data_3=sur_new_sm_top.Point,
    Data_4=sur_new_sm_top.Point,
    Data_5=sur_new_sm_top.Point,
    InnerSurf=sur_new_sm_top.List,
    ClusterOutput=sur_new_sm_top.Breps,
    ClusterOutput_2=sur_new_sm_top.Surface,
    Surface=sur_new_sm_top.Surfaces,
    Curves=sur_new_sm_top.Curve,
    List=sur_new_sm_top.Fragments,
    List_2=sur_new_sm_top.Fragments,
    Brep=sur_new_sm_top.Curve,
    StartPoint=sur_new_sm_top.Data,
    EndPoint=sur_new_sm_top.Data,
    StartPoint_2=sur_new_sm_top.Data,
    EndPoint_2=sur_new_sm_top.Data,
    StartPoint_3=sur_new_sm_top.Data,
    EndPoint_3=sur_new_sm_top.Data,
    List_3=sur_new_sm_top.Edges,
    List_4=sur_new_sm_top.Edges,
    List_5=sur_new_sm_top.Edges,
    CurveA=sur_new_sm_top.Line,
    CurveB=sur_new_sm_top.Element,
    CurveA_2=sur_new_sm_top.Line,
    CurveB_2=sur_new_sm_top.Element,
    CurveA_3=sur_new_sm_top.Line,
    CurveB_3=sur_new_sm_top.Element,
    Breps=[sur_new_sm_top.Surface, sur_new_sm_top.Surface, sur_new_sm_top.Surface],
    ClusterInput=[sur_new_sm_top, sur_new_sm_top, sur_new_sm_top, sur_new_sm_top],
    InternalDocument_plugin_version=(0, 8, 66),
    InternalDocument_DocumentHeader_PreviewNormal=RGB(178, 220, 0),
    InternalDocument_DocumentHeader_PreviewSelected=RGBA(0, 150, 0, 100),
    InternalDocument_DefinitionProperties_Projection_Zoom=0.3276800215,
    InternalDocument_DefinitionObjects_Object5_Container_NullGaps=False)  # -> OuterSurface, InnerSurf, OuterSurface_2, InnerSurf_2
sur_new_cen_bot = Cluster(
    Point=flatten_12,
    Point_2=flatten_11,
    Point_3=pt_3_7,
    Number=offset_7,
    Point_4=flatten_12,
    Point_5=flatten_11,
    Point_6=pt_3_7,
    Number_2=offset_7,
    Point_7=sur_new_sm_top.ClusterInput,
    Point_8=sur_new_sm_top.ClusterInput,
    Point_9=sur_new_sm_top.ClusterInput,
    PointA=sur_new_sm_top.Data,
    PointB=sur_new_sm_top.Data,
    PointC=sur_new_sm_top.Data,
    Curve=sur_new_sm_top.Data,
    Distance=expr("-D", sur_new_sm_top.Number),
    Plane=sur_new_sm_top.Data,
    Stream0=sur_new_sm_top.Data,
    Stream1=sur_new_sm_top.Data,
    Stream2=sur_new_sm_top.Data,
    Vertices=sur_new_sm_top.Weave,
    Data=sur_new_sm_top.Curve,
    Data_2=sur_new_sm_top.Plane,
    Edges=sur_new_sm_top.Curve,
    Number_3=sur_new_sm_top.ClusterInput,
    Data_3=sur_new_sm_top.Point,
    Data_4=sur_new_sm_top.Point,
    Data_5=sur_new_sm_top.Point,
    InnerSurf=sur_new_sm_top.List,
    ClusterOutput=sur_new_sm_top.Breps,
    ClusterOutput_2=sur_new_sm_top.Surface,
    Surface=sur_new_sm_top.Surfaces,
    Curves=sur_new_sm_top.Curve,
    List=sur_new_sm_top.Fragments,
    List_2=sur_new_sm_top.Fragments,
    Brep=sur_new_sm_top.Curve,
    StartPoint=sur_new_sm_top.Data,
    EndPoint=sur_new_sm_top.Data,
    StartPoint_2=sur_new_sm_top.Data,
    EndPoint_2=sur_new_sm_top.Data,
    StartPoint_3=sur_new_sm_top.Data,
    EndPoint_3=sur_new_sm_top.Data,
    List_3=sur_new_sm_top.Edges,
    List_4=sur_new_sm_top.Edges,
    List_5=sur_new_sm_top.Edges,
    CurveA=sur_new_sm_top.Line,
    CurveB=sur_new_sm_top.Element,
    CurveA_2=sur_new_sm_top.Line,
    CurveB_2=sur_new_sm_top.Element,
    CurveA_3=sur_new_sm_top.Line,
    CurveB_3=sur_new_sm_top.Element,
    Breps=[sur_new_sm_top.Surface, sur_new_sm_top.Surface, sur_new_sm_top.Surface],
    ClusterInput=[sur_new_sm_top, sur_new_sm_top, sur_new_sm_top, sur_new_sm_top],
    InternalDocument_plugin_version=(0, 8, 66),
    InternalDocument_DocumentHeader_PreviewNormal=RGB(178, 220, 0),
    InternalDocument_DocumentHeader_PreviewSelected=RGBA(0, 150, 0, 100),
    InternalDocument_DefinitionProperties_Projection_Zoom=0.3276800215,
    InternalDocument_DefinitionObjects_Object5_Container_NullGaps=False)  # -> OuterSurface, InnerSurf, OuterSurface_2, InnerSurf_2
sur_new_cen_top = Cluster(
    Point=flatten_11,
    Point_2=flatten_12,
    Point_3=flatten_13,
    Number=offset_7,
    Point_4=flatten_11,
    Point_5=flatten_12,
    Point_6=flatten_13,
    Number_2=offset_7,
    Point_7=sur_new_sm_top.ClusterInput,
    Point_8=sur_new_sm_top.ClusterInput,
    Point_9=sur_new_sm_top.ClusterInput,
    PointA=sur_new_sm_top.Data,
    PointB=sur_new_sm_top.Data,
    PointC=sur_new_sm_top.Data,
    Curve=sur_new_sm_top.Data,
    Distance=expr("-D", sur_new_sm_top.Number),
    Plane=sur_new_sm_top.Data,
    Stream0=sur_new_sm_top.Data,
    Stream1=sur_new_sm_top.Data,
    Stream2=sur_new_sm_top.Data,
    Vertices=sur_new_sm_top.Weave,
    Data=sur_new_sm_top.Curve,
    Data_2=sur_new_sm_top.Plane,
    Edges=sur_new_sm_top.Curve,
    Number_3=sur_new_sm_top.ClusterInput,
    Data_3=sur_new_sm_top.Point,
    Data_4=sur_new_sm_top.Point,
    Data_5=sur_new_sm_top.Point,
    InnerSurf=sur_new_sm_top.List,
    ClusterOutput=sur_new_sm_top.Breps,
    ClusterOutput_2=sur_new_sm_top.Surface,
    Surface=sur_new_sm_top.Surfaces,
    Curves=sur_new_sm_top.Curve,
    List=sur_new_sm_top.Fragments,
    List_2=sur_new_sm_top.Fragments,
    Brep=sur_new_sm_top.Curve,
    StartPoint=sur_new_sm_top.Data,
    EndPoint=sur_new_sm_top.Data,
    StartPoint_2=sur_new_sm_top.Data,
    EndPoint_2=sur_new_sm_top.Data,
    StartPoint_3=sur_new_sm_top.Data,
    EndPoint_3=sur_new_sm_top.Data,
    List_3=sur_new_sm_top.Edges,
    List_4=sur_new_sm_top.Edges,
    List_5=sur_new_sm_top.Edges,
    CurveA=sur_new_sm_top.Line,
    CurveB=sur_new_sm_top.Element,
    CurveA_2=sur_new_sm_top.Line,
    CurveB_2=sur_new_sm_top.Element,
    CurveA_3=sur_new_sm_top.Line,
    CurveB_3=sur_new_sm_top.Element,
    Breps=[sur_new_sm_top.Surface, sur_new_sm_top.Surface, sur_new_sm_top.Surface],
    ClusterInput=[sur_new_sm_top, sur_new_sm_top, sur_new_sm_top, sur_new_sm_top],
    InternalDocument_plugin_version=(0, 8, 66),
    InternalDocument_DocumentHeader_PreviewNormal=RGB(178, 220, 0),
    InternalDocument_DocumentHeader_PreviewSelected=RGBA(0, 150, 0, 100),
    InternalDocument_DefinitionProperties_Projection_Zoom=0.3276800215,
    InternalDocument_DefinitionObjects_Object5_Container_NullGaps=False)  # -> OuterSurface, InnerSurf, OuterSurface_2, InnerSurf_2
xy_4 = XYPlane(Origin=Point(0, 0, 0))
join_9 = BrepJoin(Breps=[sur_new_sm_bottom.OuterSurface_2, sur_new_sm_top_4.OuterSurface_2, sur_new_cen_bot.OuterSurface_2, sur_new_cen_top.OuterSurface_2])  # -> Breps, Closed
join_10 = BrepJoin(Breps=[sur_new_sm_bottom.InnerSurf_2, sur_new_sm_top_4.InnerSurf_2])  # -> Breps, Closed
join_11 = BrepJoin(Breps=[sur_new_cen_bot.InnerSurf_2, sur_new_cen_top.InnerSurf_2])  # -> Breps, Closed
flip_4 = FlipMatrix(Data=pl_3pt_15)
mirror_35 = Mirror(Geometry=join_10.Breps, Plane=flip_4)  # -> Geometry, Transform
Z_4 = UnitZ(Factor=move_distance_6)
mirror_36 = Mirror(Geometry=join_9.Breps, Plane=flip_4)  # -> Geometry, Transform
mirror_37 = Mirror(Geometry=join_11.Breps, Plane=flip_4)  # -> Geometry, Transform
join_all_outter = BrepJoin(Breps=[join_9.Breps, mirror_36.Geometry])  # -> Breps, Closed
mirror_38 = Mirror(Geometry=join_all_outter.Breps, Plane=xy_4)  # -> Geometry, Transform
rotax_14 = RotateAxis(Geometry=mirror_38.Geometry, Angle=rotate_angle_6, Axis=line_8)  # -> Geometry, Transform
join_sm_inner = BrepJoin(Breps=[join_10.Breps, mirror_35.Geometry])  # -> Breps, Closed
mirror_39 = Mirror(Geometry=join_sm_inner.Breps, Plane=xy_4)  # -> Geometry, Transform
rotax_15 = RotateAxis(Geometry=mirror_39.Geometry, Angle=rotate_angle_6, Axis=line_8)  # -> Geometry, Transform
join_center_inner = BrepJoin(Breps=[join_11.Breps, mirror_37.Geometry])  # -> Breps, Closed
mirror_40 = Mirror(Geometry=join_center_inner.Breps, Plane=xy_4)  # -> Geometry, Transform
rotax_16 = RotateAxis(Geometry=mirror_40.Geometry, Angle=rotate_angle_6, Axis=line_8)  # -> Geometry, Transform
move_outer_4 = Move(Geometry=rotax_14.Geometry, Motion=Z_4)  # -> Geometry, Transform
move_sm_inner = Move(Geometry=rotax_15.Geometry, Motion=Z_4)  # -> Geometry, Transform
move_cen_inner = Move(Geometry=rotax_16.Geometry, Motion=Z_4)  # -> Geometry, Transform
preview_10 = CustomPreview(Geometry=[move_outer_4.Geometry, join_all_outter.Breps], Shader=col_border_6)
preview_11 = CustomPreview(Geometry=[join_sm_inner.Breps, move_sm_inner.Geometry], Shader=col_small_inner_6)
preview_12 = CustomPreview(Geometry=[join_center_inner.Breps, move_cen_inner.Geometry], Shader=col_large_inner_6)

bake_outer_frame_4 = CSharpScript(obj=[join_all_outter.Breps, move_outer_4.Geometry], layer="outer frame", color=col_border_6, activate=toggle_bake)  # -> out; inputs obj: GeometryBase, name: String, layer: String, color: Color, pWidth: Double, wires: Int32, activate: Boolean; same code as bake_large_inner
bake_large_inner_4 = CSharpScript(
    obj=[join_center_inner.Breps, move_cen_inner.Geometry],
    layer="large inner",
    color=col_large_inner_6,
    activate=toggle_bake)  # -> out; inputs obj: GeometryBase, name: String, layer: String, color: Color, pWidth: Double, wires: Int32, activate: Boolean; same code as bake_large_inner
bake_small_inner_3 = CSharpScript(obj=[move_sm_inner.Geometry, join_sm_inner.Breps], layer="small inner", color=col_small_inner_6, activate=toggle_bake)  # -> out; inputs obj: GeometryBase, name: String, layer: String, color: Color, pWidth: Double, wires: Int32, activate: Boolean; same code as bake_large_inner
