# Grasshopper definition waterbom mono.gh (Grasshopper 0.8.66)

pt = PointXYZ(XComponent=0, YComponent=0, ZComponent=0, System=PlaneXY(0, 0, 0))

# ----
# circle in series
pt_2 = PointXYZ(XComponent=0, YComponent=0, ZComponent=0, System=PlaneXY(0, 0, 0))
diameter = Slider(18, range=0..50)
number_of_parts = Slider(15, range=0..20)
side = Slider(2, range=0..20)
pt_3 = Point(pt_2)
polygon = Polygon(Plane=pt_3, Radius=expr("R/2", diameter), Segments=number_of_parts, FilletRadius=0)  # -> Polygon, Length
side_2 = Number(side)
explode = BrepComponents(Brep=polygon.Polygon)  # -> Faces, Edges, Vertices
eval = EvaluateLength(Curve=explode.Edges, Length=0.5, Normalized=True)  # -> Point, Tangent, Parameter
pl_3pt = Plane3Pt(PointA=explode.Vertices, PointB=eval.Point, PointC=pt_3)
vec2pt = Vector2Pt(PointA=pt_3, PointB=eval.Point, Unitize=False)  # -> Vector, Length
hypo = F1(Function="((x^2)+(x^2))^.5", X=side_2)
pt_1 = Point(explode.Vertices)
vec2pt_2 = Vector2Pt(PointA=pt_3, PointB=pt_1, Unitize=False)  # -> Vector, Length
sph = Sphere(Base=pt_1, Radius=hypo)
line = LineSDL(Start=explode.Vertices, Direction=pl_3pt, Length=side_2)
rot_angle = Angle(VectorA=vec2pt_2.Vector, VectorB=vec2pt.Vector)  # -> Angle, Reflex
item = ListItem(List=rot_angle.Angle, Index=0, Wrap=False)
rad = Radians(Degrees="0")
rad_2 = Radians(Degrees="125")
end = EndPoints(Curve=line)  # -> Start, End
line_2 = LineSDL(Start=pt_3, Direction=Vector(0, 0, 1), Length=1)
rad_3 = Radians(Degrees="0")
rad_4 = Radians(Degrees="125")
rotax = RotateAxis(Geometry=polygon.Polygon, Angle=item, Axis=line_2)  # -> Geometry, Transform
dom = Domain(DomainStart=rad, DomainEnd=rad_2)
pt_4 = Point(end.End)
explode_2 = BrepComponents(Brep=rotax.Geometry)  # -> Faces, Edges, Vertices
dom_2 = Domain(DomainStart=rad_3, DomainEnd=rad_4)
pt_5 = Point(explode_2.Vertices)
line_3 = LineSDL(Start=pt_5, Direction=pl_3pt, Length=side_2)
end_2 = EndPoints(Curve=line_3)  # -> Start, End
pl_3pt_2 = Plane3Pt(PointA=end.Start, PointB=pt_5, PointC=end.End)
arc = Arc(Plane=pl_3pt_2, Radius=side_2, Angle=dom)  # -> Arc, Length
clx = CurveLine(Curve=arc.Arc, Line=line_3, First=False)  # -> Points, Params, Count
flatten = FlattenTree(Data=clx.Points, Path="{0}")
dist = Distance(PointA=eval.Point, PointB=flatten)
pl_3pt_3 = Plane3Pt(PointA=flatten, PointB=end_2.End, PointC=pt_3)
arc_2 = Arc(Plane=pl_3pt_3, Radius=side_2, Angle=dom_2)  # -> Arc, Length
bcx = BrepCurve(Brep=sph, Curve=arc_2.Arc)  # -> Curves, Points
item_2 = ListItem(List=dist, Index=0, Wrap=False)
flatten_2 = FlattenTree(Data=bcx.Points, Path="{0}")
pl_3pt_4 = Plane3Pt(PointA=flatten_2, PointB=flatten, PointC=pt_5)
rad_5 = Radians(Degrees="270")
rad_6 = Radians(Degrees="360")
rad_7 = Radians(Degrees="0")
rad_8 = Radians(Degrees="80")
dom_3 = Domain(DomainStart=rad_5, DomainEnd=rad_6)
pl_3pt_5 = Plane3Pt(PointA=pt_1, PointB=pt_4, PointC=pt_3)
mirror = Mirror(Geometry=flatten_2, Plane=pl_3pt_5)  # -> Geometry, Transform
dom_4 = Domain(DomainStart=rad_7, DomainEnd=rad_8)
arc_3 = Arc(Plane=pl_3pt_4, Radius=side_2, Angle=dom_3)  # -> Arc, Length
sph_2 = Sphere(Base=flatten_2, Radius=side_2)
arc_4 = Arc(Plane=pl_3pt_5, Radius=side_2, Angle=dom_4)  # -> Arc, Length
xy = XYPlane(Origin=Point(0, 0, 0))
bcx_2 = BrepCurve(Brep=sph_2, Curve=arc_4.Arc)  # -> Curves, Points
flatten_3 = FlattenTree(Data=bcx_2.Points, Path="{0}")
pl_3pt_6 = Plane3Pt(PointA=flatten_2, PointB=flatten_3, PointC=mirror.Geometry)
mirror_2 = Mirror(Geometry=pt_1, Plane=pl_3pt_6)  # -> Geometry, Transform
sph_3 = Sphere(Base=mirror_2.Geometry, Radius=side_2)
bcx_3 = BrepCurve(Brep=sph_3, Curve=arc_3.Arc)  # -> Curves, Points
cull = CullPattern(List=bcx_3.Points, CullPattern=[True, False])
flatten_4 = FlattenTree(Data=cull, Path="{0}")
srf4pt = _4PointSurface(CornerA=mirror_2.Geometry, CornerB=flatten_4, CornerC=flatten_2)
srf4pt_2 = _4PointSurface(CornerA=flatten_2, CornerB=flatten, CornerC=pt_1)
srf4pt_3 = _4PointSurface(CornerA=flatten_3, CornerB=flatten_2, CornerC=pt_1)
mirror_3 = Mirror(Geometry=srf4pt_3, Plane=pl_3pt_6)  # -> Geometry, Transform
Z = UnitZ(Factor=item_2)
join = BrepJoin(Breps=[srf4pt, mirror_3.Geometry, srf4pt_3, srf4pt_2])  # -> Breps, Closed
mirror_4 = Mirror(Geometry=join.Breps, Plane=pl_3pt_3)  # -> Geometry, Transform
join_2 = BrepJoin(Breps=[mirror_4.Geometry, join.Breps])  # -> Breps, Closed
mirror_5 = Mirror(Geometry=join_2.Breps, Plane=xy)  # -> Geometry, Transform
rotax_2 = RotateAxis(Geometry=mirror_5.Geometry, Angle=item, Axis=line_2)  # -> Geometry, Transform
move = Move(Geometry=rotax_2.Geometry, Motion=Z)  # -> Geometry, Transform
move_distance = Number(item_2)
rotate_angle = Number(item)
pt_1_2 = Point(flatten_3)
pt_2_2 = Point(mirror_2.Geometry)
pt_3_2 = Point(flatten_4)
center = Point(pt_3)
side_3 = Number(side_2)

pt_1_3 = Point(pt_1_2)
pt_2_3 = Point(pt_2_2)
pt_3_3 = Point(pt_3_2)
center_2 = Point(center)
side_4 = Number(side_3)
rotate_angle_2 = Number(rotate_angle)
move_distance_2 = Number(move_distance)
pl_3pt_7 = Plane3Pt(PointA=pt_2_3, PointB=pt_1_3, PointC=center_2)
rad_9 = Radians(Degrees="0")
rad_10 = Radians(Degrees="180")
rad_11 = Radians(Degrees="0")
rad_12 = Radians(Degrees="150")
f_x = F1(Function="((x^2)+(x^2))^.5", X=side_4)
line_4 = LineSDL(Start=center_2, Direction=Vector(0, 0, 1), Length=1)
dom_5 = Domain(DomainStart=rad_9, DomainEnd=rad_10)
arc_5 = Arc(Plane=pl_3pt_7, Radius=side_4, Angle=dom_5)  # -> Arc, Length
dom_6 = Domain(DomainStart=rad_11, DomainEnd=rad_12)
line_5 = LineSDL(Start=pt_3_3, Direction=Vector(0, 0, 1), Length=1)
sph_4 = Sphere(Base=pt_3_3, Radius=f_x)
end_3 = EndPoints(Curve=line_5)  # -> Start, End
bcx_4 = BrepCurve(Brep=sph_4, Curve=arc_5.Arc)  # -> Curves, Points
pl_3pt_8 = Plane3Pt(PointA=end_3.Start, PointB=end_3.End, PointC=center_2)
arc_6 = Arc(Plane=pl_3pt_8, Radius=side_4, Angle=dom_6)  # -> Arc, Length
flatten_5 = FlattenTree(Data=bcx_4.Points, Path="{0}")
sph_5 = Sphere(Base=flatten_5, Radius=side_4)
bcx_5 = BrepCurve(Brep=sph_5, Curve=arc_6.Arc)  # -> Curves, Points
cull_2 = CullPattern(List=bcx_5.Points, CullPattern=[True, False])
flatten_6 = FlattenTree(Data=cull_2, Path="{0}")
srf4pt_4 = _4PointSurface(CornerA=flatten_6, CornerB=flatten_5, CornerC=pt_3_3)
pt_6 = Point(flatten_5)
mirror_6 = Mirror(Geometry=pt_6, Plane=pl_3pt_8)  # -> Geometry, Transform
rad_13 = Radians(Degrees="270")
rad_14 = Radians(Degrees="360")
srf4pt_5 = _4PointSurface(CornerA=pt_3_3, CornerB=flatten_5, CornerC=pt_2_3)
pl_3pt_9 = Plane3Pt(PointA=flatten_6, PointB=mirror_6.Geometry, PointC=pt_6)
pl_3pt_10 = Plane3Pt(PointA=flatten_5, PointB=pt_2_3, PointC=pt_1_3)
dom_7 = Domain(DomainStart=rad_13, DomainEnd=rad_14)
mirror_7 = Mirror(Geometry=pt_3_3, Plane=pl_3pt_9)  # -> Geometry, Transform
arc_7 = Arc(Plane=pl_3pt_10, Radius=side_4, Angle=dom_7)  # -> Arc, Length
mirror_8 = Mirror(Geometry=srf4pt_4, Plane=pl_3pt_9)  # -> Geometry, Transform
sph_6 = Sphere(Base=mirror_7.Geometry, Radius=side_4)
xy_2 = XYPlane(Origin=Point(0, 0, 0))
bcx_6 = BrepCurve(Brep=sph_6, Curve=arc_7.Arc)  # -> Curves, Points
cull_3 = CullPattern(List=bcx_6.Points, CullPattern=[True, False])
flatten_7 = FlattenTree(Data=cull_3, Path="{0}")
srf4pt_6 = _4PointSurface(CornerA=flatten_7, CornerB=flatten_5, CornerC=mirror_7.Geometry)
join_3 = BrepJoin(Breps=[srf4pt_4, mirror_8.Geometry, srf4pt_6, srf4pt_5])  # -> Breps, Closed
mirror_9 = Mirror(Geometry=join_3.Breps, Plane=pl_3pt_8)  # -> Geometry, Transform
Z_2 = UnitZ(Factor=move_distance_2)
join_4 = BrepJoin(Breps=[join_3.Breps, mirror_9.Geometry])  # -> Breps, Closed
mirror_10 = Mirror(Geometry=join_4.Breps, Plane=xy_2)  # -> Geometry, Transform
rotax_3 = RotateAxis(Geometry=mirror_10.Geometry, Angle=rotate_angle_2, Axis=line_4)  # -> Geometry, Transform
move_2 = Move(Geometry=rotax_3.Geometry, Motion=Z_2)  # -> Geometry, Transform
move_distance_3 = Number(move_distance_2)
rotate_angle_3 = Number(rotate_angle_2)
pt_1_4 = Point(flatten_6)
pt_2_4 = Point(mirror_7.Geometry)
pt_3_4 = Point(flatten_7)
center_3 = Point(center_2)
side_5 = Number(side_4)

pt_3_5 = Point(pt_3_4)
rotate_angle_4 = Number(rotate_angle_3)
move_distance_4 = Number(move_distance_3)
pt_1_5 = Point(pt_1_4)
pt_2_5 = Point(pt_2_4)
center_4 = Point(center_3)
side_6 = Number(side_5)
pl_3pt_11 = Plane3Pt(PointA=pt_2_5, PointB=pt_1_5, PointC=center_4)
rad_15 = Radians(Degrees="0")
rad_16 = Radians(Degrees="180")
rad_17 = Radians(Degrees="0")
rad_18 = Radians(Degrees="150")
f_x_2 = F1(Function="((x^2)+(x^2))^.5", X=side_6)
line_6 = LineSDL(Start=center_4, Direction=Vector(0, 0, 1), Length=1)
dom_8 = Domain(DomainStart=rad_15, DomainEnd=rad_16)
arc_8 = Arc(Plane=pl_3pt_11, Radius=side_6, Angle=dom_8)  # -> Arc, Length
dom_9 = Domain(DomainStart=rad_17, DomainEnd=rad_18)
line_7 = LineSDL(Start=pt_3_5, Direction=Vector(0, 0, 1), Length=1)
sph_7 = Sphere(Base=pt_3_5, Radius=f_x_2)
end_4 = EndPoints(Curve=line_7)  # -> Start, End
bcx_7 = BrepCurve(Brep=sph_7, Curve=arc_8.Arc)  # -> Curves, Points
pl_3pt_12 = Plane3Pt(PointA=end_4.Start, PointB=end_4.End, PointC=center_4)
arc_9 = Arc(Plane=pl_3pt_12, Radius=side_6, Angle=dom_9)  # -> Arc, Length
flatten_8 = FlattenTree(Data=bcx_7.Points, Path="{0}")
sph_8 = Sphere(Base=flatten_8, Radius=side_6)
bcx_8 = BrepCurve(Brep=sph_8, Curve=arc_9.Arc)  # -> Curves, Points
cull_4 = CullPattern(List=bcx_8.Points, CullPattern=[True, False])
flatten_9 = FlattenTree(Data=cull_4, Path="{0}")
srf4pt_7 = _4PointSurface(CornerA=flatten_9, CornerB=flatten_8, CornerC=pt_3_5)
pt_7 = Point(flatten_8)
mirror_11 = Mirror(Geometry=pt_7, Plane=pl_3pt_12)  # -> Geometry, Transform
rad_19 = Radians(Degrees="270")
rad_20 = Radians(Degrees="360")
srf4pt_8 = _4PointSurface(CornerA=pt_3_5, CornerB=flatten_8, CornerC=pt_2_5)
pl_3pt_13 = Plane3Pt(PointA=flatten_9, PointB=mirror_11.Geometry, PointC=pt_7)
pl_3pt_14 = Plane3Pt(PointA=flatten_8, PointB=pt_2_5, PointC=pt_1_5)
dom_10 = Domain(DomainStart=rad_19, DomainEnd=rad_20)
mirror_12 = Mirror(Geometry=pt_3_5, Plane=pl_3pt_13)  # -> Geometry, Transform
arc_10 = Arc(Plane=pl_3pt_14, Radius=side_6, Angle=dom_10)  # -> Arc, Length
mirror_13 = Mirror(Geometry=srf4pt_7, Plane=pl_3pt_13)  # -> Geometry, Transform
sph_9 = Sphere(Base=mirror_12.Geometry, Radius=side_6)
xy_3 = XYPlane(Origin=Point(0, 0, 0))
bcx_9 = BrepCurve(Brep=sph_9, Curve=arc_10.Arc)  # -> Curves, Points
cull_5 = CullPattern(List=bcx_9.Points, CullPattern=[True, False])
flatten_10 = FlattenTree(Data=cull_5, Path="{0}")
srf4pt_9 = _4PointSurface(CornerA=flatten_10, CornerB=flatten_8, CornerC=mirror_12.Geometry)
join_5 = BrepJoin(Breps=[srf4pt_7, mirror_13.Geometry, srf4pt_9, srf4pt_8])  # -> Breps, Closed
mirror_14 = Mirror(Geometry=join_5.Breps, Plane=pl_3pt_12)  # -> Geometry, Transform
Z_3 = UnitZ(Factor=move_distance_4)
join_6 = BrepJoin(Breps=[join_5.Breps, mirror_14.Geometry])  # -> Breps, Closed
mirror_15 = Mirror(Geometry=join_6.Breps, Plane=xy_3)  # -> Geometry, Transform
rotax_4 = RotateAxis(Geometry=mirror_15.Geometry, Angle=rotate_angle_4, Axis=line_6)  # -> Geometry, Transform
move_3 = Move(Geometry=rotax_4.Geometry, Motion=Z_3)  # -> Geometry, Transform
move_distance_5 = Number(move_distance_4)
rotate_angle_5 = Number(rotate_angle_4)
pt_2_6 = Point(mirror_12.Geometry)
pt_3_6 = Point(flatten_10)
pt_1_6 = Point(flatten_9)
center_5 = Point(center_4)
side_7 = Number(side_6)

bakeattributes = CSharpScript(
    obj=[join.Breps, mirror_4.Geometry, join_4.Breps, move_2.Geometry, join_6.Breps, move_3.Geometry],
    activate=Toggle(False))  # -> out; inputs obj: GeometryBase, name: String, layer: String, color: Color, pWidth: Double, wires: Int32, activate: Boolean
# ---------- bakeattributes: C# ----------
    //Inserts geometry into the Rhino document, with custom attributes
    //Written by Giulio Piacentino
    //Version written 2010 11 21 - for Grasshopper 0.8.002

    if (activate)
    {
      if(obj == null)
      {
        Print("No object to bake");
        return;
      }

      //Make new attribute to set name
      Rhino.DocObjects.ObjectAttributes att = new Rhino.DocObjects.ObjectAttributes();

      //Set object name
      if(!string.IsNullOrEmpty(name))
      {
        att.Name = name;
      }

      //Set color
      if(!color.IsEmpty)
      {
        att.ColorSource = Rhino.DocObjects.ObjectColorSource.ColorFromObject; //Make the color type "by object"
        att.ObjectColor = color;

        att.PlotColorSource = Rhino.DocObjects.ObjectPlotColorSource.PlotColorFromObject; //Make the plot color type "by object"
        att.PlotColor = color;
      }

      //Set layer
      if(!string.IsNullOrEmpty(layer) && Rhino.DocObjects.Layer.IsValidName(layer))
      {
        //Get the current layer index
        Rhino.DocObjects.Tables.LayerTable layerTable = doc.Layers;
        int layerIndex = layerTable.Find(layer, true);

        if(layerIndex < 0) //This layer does not exist, we add it
        {
          Rhino.DocObjects.Layer onlayer = new Rhino.DocObjects.Layer(); //Make a new layer
          onlayer.Name = layer;

          layerIndex = layerTable.Add(onlayer); //Add the layer to the layer table
          if (layerIndex > -1) //We manged to add layer!
          {
            att.LayerIndex = layerIndex;
            Print("Added new layer to the document at position " + layerIndex + " named " + layer + ". ");
          } else
            Print("Layer did not add. Try cleaning up your layers."); //This never happened to me.
        }
        else
          att.LayerIndex = layerIndex; //We simply add to the existing layer
      }


      //Set plotweight
      if(pWidth > 0)
      {
        att.PlotWeightSource = Rhino.DocObjects.ObjectPlotWeightSource.PlotWeightFromObject;
        att.PlotWeight = pWidth;
      }


      //Set material
      bool materialByName = !string.IsNullOrEmpty(material as string);
      Rhino.Display.DisplayMaterial inMaterial = material as Rhino.Display.DisplayMaterial;
      if(material is Color)
      {
        inMaterial = new Rhino.Display.DisplayMaterial((Color) material);
      }
      if(material != null && inMaterial == null && !materialByName)
      {
        if(!(material is string))
        {
          try //We also resort to try with IConvertible
          {
            inMaterial = (Rhino.Display.DisplayMaterial) Convert.ChangeType(material, typeof(Rhino.Display.DisplayMaterial));
          }
          catch(InvalidCastException)
          {
          }
        }
      }
      if(inMaterial != null || materialByName)
      {
        string matName;

        if(!materialByName)
        {
          matName = string.Format("A:{0}-D:{1}-E:{2}-S:{3},{4}-T:{5}",
            Format(inMaterial.Ambient),
            Format(inMaterial.Diffuse),
            Format(inMaterial.Emission),
            Format(inMaterial.Specular),
            inMaterial.Shine.ToString(),
            inMaterial.Transparency.ToString()
            );
        }
        else
        {
          matName = (string) material;
        }

        int materialIndex = doc.Materials.Find(matName, true);
        if(materialIndex < 0 && !materialByName) //Material does not exist and we have its specs
        {
          materialIndex = doc.Materials.Add(); //Let's add it
          if(materialIndex > -1)
          {
            Print("Added new material at position " + materialIndex + " named \"" + matName + "\". ");
            Rhino.DocObjects.Material m = doc.Materials[materialIndex];
            m.Name = matName;
            m.AmbientColor = inMaterial.Ambient;
            m.DiffuseColor = inMaterial.Diffuse;
            m.EmissionColor = inMaterial.Emission;
            //m.ReflectionColor = no equivalent
            m.SpecularColor = inMaterial.Specular;
            m.Shine = inMaterial.Shine;
            m.Transparency = inMaterial.Transparency;
            //m.TransparentColor = no equivalent
            m.CommitChanges();

            att.MaterialSource = Rhino.DocObjects.ObjectMaterialSource.MaterialFromObject;
            att.MaterialIndex = materialIndex;
          }
          else
            Print("Material did not add. Try cleaning up your materials."); //This never happened to me.
        }
        else if(materialIndex < 0 && materialByName) //Material does not exist and we do not have its specs. We do nothing
        {
          Print("Warning: material name not found. I cannot set the source to this material name. Add a material with name: " + matName);
        }
        else
        {
          //If this material exists, we do not replace it!
          att.MaterialSource = Rhino.DocObjects.ObjectMaterialSource.MaterialFromObject;
          att.MaterialIndex = materialIndex;
        }
      }


      //Set wire density
      if(wires == -1 || wires > 0)
      {
        att.WireDensity = wires;
      }


      //Bake to the right type of object
      switch(obj.ObjectType)
      {
        case Rhino.DocObjects.ObjectType.Brep:
          doc.Objects.AddBrep(obj as Brep, att);
          break;
        case Rhino.DocObjects.ObjectType.Curve:
          doc.Objects.AddCurve(obj as Curve, att);
          break;
        case Rhino.DocObjects.ObjectType.Point:
          doc.Objects.AddPoint((obj as Rhino.Geometry.Point).Location, att);
          break;
        case Rhino.DocObjects.ObjectType.Surface:
          doc.Objects.AddSurface(obj as Surface, att);
          break;
        case Rhino.DocObjects.ObjectType.Mesh:
          doc.Objects.AddMesh(obj as Mesh, att);
          break;
        case Rhino.DocObjects.ObjectType.Extrusion:
          typeof(Rhino.DocObjects.Tables.ObjectTable).InvokeMember("AddExtrusion", BindingFlags.Instance | BindingFlags.InvokeMethod, null, doc.Objects, new object[]{obj, att});
          break;
        case Rhino.DocObjects.ObjectType.PointSet:
          doc.Objects.AddPointCloud(obj as Rhino.Geometry.PointCloud, att); //This is a speculative entry
          break;
        default:
          Print("The script does not know how to handle this type of geometry: " + obj.GetType().FullName);
          break;
      }
      Print("Added " + obj.GetType().Name);

    }
    else
    {
      Print("Inactive");
    }
# ---------- bakeattributes: C# additional code ----------
  static string Format(Color c)
  {
    return (new System.Text.StringBuilder("A")).Append(c.A.ToString()).Append("R").Append(c.R.ToString()).Append("G")
      .Append(c.G.ToString()).Append("B").Append(c.B.ToString()).ToString();
  }
# ---------- end bakeattributes ----------
pt_4_2 = Point(flatten_8)

pt_2_7 = Point(pt_2_6)
pt_3_7 = Point(pt_3_6)
side_8 = Number(side_7)
rotate_angle_6 = Number(rotate_angle_5)
move_distance_6 = Number(move_distance_5)
pt_1_7 = Point(pt_1_6)
center_6 = Point(center_5)
pt4 = Point(pt_4_2)
pl_3pt_15 = Plane3Pt(PointA=pt_2_7, PointB=pt_1_7, PointC=center_6)
rad_21 = Radians(Degrees="0")
rad_22 = Radians(Degrees="180")
rad_23 = Radians(Degrees="0")
rad_24 = Radians(Degrees="150")
f_x_3 = F1(Function="((x^2)+(x^2))^.5", X=side_8)
line_8 = LineSDL(Start=center_6, Direction=Vector(0, 0, 1), Length=1)
dom_11 = Domain(DomainStart=rad_21, DomainEnd=rad_22)
dom_12 = Domain(DomainStart=rad_23, DomainEnd=rad_24)
arc_11 = Arc(Plane=pl_3pt_15, Radius=side_8, Angle=dom_11)  # -> Arc, Length
sph_10 = Sphere(Base=pt_3_7, Radius=f_x_3)
line_9 = LineSDL(Start=pt_3_7, Direction=Vector(0, 0, 1), Length=1)
end_5 = EndPoints(Curve=line_9)  # -> Start, End
bcx_10 = BrepCurve(Brep=sph_10, Curve=arc_11.Arc)  # -> Curves, Points
flatten_11 = FlattenTree(Data=bcx_10.Points, Path="{0}")
sph_11 = Sphere(Base=flatten_11, Radius=side_8)
pl_3pt_16 = Plane3Pt(PointA=end_5.Start, PointB=end_5.End, PointC=center_6)
arc_12 = Arc(Plane=pl_3pt_16, Radius=side_8, Angle=dom_12)  # -> Arc, Length
bcx_11 = BrepCurve(Brep=sph_11, Curve=arc_12.Arc)  # -> Curves, Points
cull_6 = CullPattern(List=bcx_11.Points, CullPattern=[True, False])
flatten_12 = FlattenTree(Data=cull_6, Path="{0}")
srf4pt_10 = _4PointSurface(CornerA=flatten_12, CornerB=flatten_11, CornerC=pt_3_7)
pt_8 = Point(flatten_11)
mirror_16 = Mirror(Geometry=pt_8, Plane=pl_3pt_16)  # -> Geometry, Transform
rad_25 = Radians(Degrees="250")
rad_26 = Radians(Degrees="320")
srf4pt_11 = _4PointSurface(CornerA=pt_3_7, CornerB=flatten_11, CornerC=pt_2_7)
pl_3pt_17 = Plane3Pt(PointA=flatten_12, PointB=mirror_16.Geometry, PointC=pt_8)
pl_3pt_18 = Plane3Pt(PointA=flatten_11, PointB=pt_2_7, PointC=pt_1_7)
dom_13 = Domain(DomainStart=rad_25, DomainEnd=rad_26)
rad_27 = Radians(Degrees="0")
rad_28 = Radians(Degrees="90")
pl_3pt_19 = Plane3Pt(PointA=flatten_12, PointB=pt_3_7, PointC=pt4)
mirror_17 = Mirror(Geometry=pt_3_7, Plane=pl_3pt_17)  # -> Geometry, Transform
arc_13 = Arc(Plane=pl_3pt_18, Radius=side_8, Angle=dom_13)  # -> Arc, Length
dom_14 = Domain(DomainStart=rad_27, DomainEnd=rad_28)
sph_12 = Sphere(Base=mirror_17.Geometry, Radius=side_8)
bcx_12 = BrepCurve(Brep=sph_12, Curve=arc_13.Arc)  # -> Curves, Points
xy_4 = XYPlane(Origin=Point(0, 0, 0))
arc_14 = Arc(Plane=pl_3pt_19, Radius=side_8, Angle=dom_14)  # -> Arc, Length
cull_7 = CullPattern(List=bcx_12.Points, CullPattern=[True, False])
flatten_13 = FlattenTree(Data=cull_7, Path="{0}")
srf4pt_12 = _4PointSurface(CornerA=flatten_11, CornerB=flatten_12, CornerC=flatten_13)
sph_13 = Sphere(Base=flatten_13, Radius=side_8)
bcx_13 = BrepCurve(Brep=sph_13, Curve=arc_14.Arc)  # -> Curves, Points
flatten_14 = FlattenTree(Data=bcx_13.Points, Path="{0}")
srf4pt_13 = _4PointSurface(CornerA=flatten_13, CornerB=flatten_14, CornerC=flatten_12)
join_7 = BrepJoin(Breps=[srf4pt_10, srf4pt_11, srf4pt_12, srf4pt_13])  # -> Breps, Closed
mirror_18 = Mirror(Geometry=join_7.Breps, Plane=pl_3pt_16)  # -> Geometry, Transform
Z_4 = UnitZ(Factor=move_distance_6)
join_8 = BrepJoin(Breps=[join_7.Breps, mirror_18.Geometry])  # -> Breps, Closed
mirror_19 = Mirror(Geometry=join_8.Breps, Plane=xy_4)  # -> Geometry, Transform
rotax_5 = RotateAxis(Geometry=mirror_19.Geometry, Angle=rotate_angle_6, Axis=line_8)  # -> Geometry, Transform
move_4 = Move(Geometry=rotax_5.Geometry, Motion=Z_4)  # -> Geometry, Transform
move_distance_7 = Number(move_distance_6)
rotate_angle_7 = Number(rotate_angle_6)
pt_1_8 = Point(flatten_12)
pt_2_8 = Point(mirror_17.Geometry)
pt_3_8 = Point(flatten_13)
center_7 = Point(center_6)
side_9 = Number(side_8)
